# Grasshopper definition Designer [Jan-28 '26, 2036].gh (Grasshopper 1.0.8)
# plug-ins: Human UI, ScriptParasite2

crv = Curve([<curve referenced from the Rhino model> x3])
c_script = CSharpScript()  # -> out, a
# ---------- c_script: C# ----------
// Grasshopper Script Instance
#region Usings
using System;
using System.Linq;
using System.Collections;
using System.Collections.Generic;
using System.Drawing;

using Rhino;
using Rhino.Geometry;

using Grasshopper;
using Grasshopper.Kernel;
using Grasshopper.Kernel.Data;
using Grasshopper.Kernel.Types;
#endregion

public class Script_Instance : GH_ScriptInstance
{
    #region Notes
    /* 
      Members:
        RhinoDoc RhinoDocument
        GH_Document GrasshopperDocument
        IGH_Component Component
        int Iteration

      Methods (Virtual & overridable):
        Print(string text)
        Print(string format, params object[] args)
        Reflect(object obj)
        Reflect(object obj, string method_name)
    */
    #endregion

    private void RunScript(object x, object y, ref object a)
    {
        // Write your logic here
        a = null;
    }
}
# ---------- end c_script ----------
end = EndPoints(Curve=crv)  # -> Start, End
layer_height = Slider(0.2, range=0..1)
pdecon = Deconstruct(Point=end.Start)  # -> XComponent, YComponent, ZComponent
pt = Point(<point referenced from the Rhino model>)
pt_2 = Point([<point referenced from the Rhino model> x2])

# ----
# 2. Create UI Elements
layer = Slider(10, range=0..100)
label = CreateLabel(LabelText="Layer", LabelSize=12, Justification=0)

sort = SortList(Keys=pdecon.ZComponent, ValuesA=crv)  # -> Keys, ValuesA
panel = Panel("C:\Users\Oliver\OneDrive - University of Bristol\PhD\UIST 2026 Print Place Printegrate\Designer\Scripts")
panel_2 = Panel("C:\Users\Oliver\OneDrive - University of Bristol\PhD\UIST 2026 Print Place Printegrate\Designer\Scripts")
panel_3 = Panel("""Prusa XL
Prusa Mini""")

# ----
# Updating a UI Element
# Set the toggle to the right to "True" to launch the window.
# 1. Create a window
toggle = BooleanToggle(True)
launchwin = LaunchWindow(Show=toggle, Name="Control Window", Width=370, Height=400, ChildStatus=0, EnableHorizScroll=False)

c_script_2 = CSharpScript(
    traceLines=sort.ValuesA,
    plugPoints=pt_2,
    plugRadius="1",
    plugHeight=Slider(2.6, range=0..10),
    traceWidth=Slider(2, range=0..100),
    traceHeight=Slider(0.4, range=0..1),
    origin=pt,
    layerHeight=layer_height,
    traySpacing=Slider(2, range=0..10))  # -> out, operations, trayBrep, modelBreps, intersections, pickPlaceLines; inputs traceLines: list of Line, plugPoints: list of Point3d, plugRadius: Double, plugHeight: Double, traceWidth: Double, traceHeight: Double, origin: Point3d, layerHeight: Double, traySpacing: Double
# ---------- c_script_2: C# ----------
// Main Pick Place Logic Script
// Handles geometry generation, positioning, intersections, and tray layout

using System;
using System.Linq;
using System.Collections.Generic;
using Rhino;
using Rhino.Geometry;
using Rhino.Geometry.Intersect;
using Grasshopper.Kernel;
using Grasshopper;
using Grasshopper.Kernel.Data;

// ============================================================================
// ENUMS AND DATA STRUCTURES
// ============================================================================

/// <summary>
/// Types of tamping points based on intersection context
/// </summary>
public enum TampingType
{
    End,          // Tamping points at the ends of traces
    TraceTrace,   // Tamping points at trace-trace intersections
    TracePlug     // Tamping points at trace-plug intersections
}

/// <summary>
/// Represents a single tamping point with position and type
/// Depth offset is managed by Python G-code generation
/// </summary>
public class TampingPoint
{
    public Point3d Position { get; set; }
    public TampingType Type { get; set; }
    
    public TampingPoint(Point3d position, TampingType type)
    {
        Position = position;
        Type = type;
    }
}

// ============================================================================
// ABSTRACT BASE CLASS
// ============================================================================

/// <summary>
/// Base class for all embeddable elements (traces and plugs)
/// </summary>
public abstract class Embeddable
{
    public Point3d PickPt { get; protected set; }
    public Point3d PlacePt { get; protected set; }
    public List<TampingPoint> TampingPts { get; protected set; }
    public double PickTemperature { get; protected set; }
    public int PauseLayer { get; protected set; }

    public abstract void CalcIntersections(List<Embeddable> allEmbeddables);
    public abstract void CalculatePickPlace(Point3d pickCentre);

    protected Embeddable()
    {
        TampingPts = new List<TampingPoint>();
        PickPt = Point3d.Unset;
        PlacePt = Point3d.Unset;
    }
}

// ============================================================================
// CONCRETE IMPLEMENTATIONS
// ============================================================================

/// <summary>
/// Represents a conductive trace element with pick/place/tamp logic
/// </summary>
public class TraceElement : Embeddable
{
    // Public properties
    public double Length { get; private set; }
    public bool IsHorizontal { get; private set; }
    public double Width { get; private set; }
    public double Height { get; private set; }
    public List<Point3d> Intersections = new List<Point3d>();
    public Line ModelLine;
    public Brep ModelBox;
    public Curve TrayCurve;
    
    // Private fields
    private double traceHeight;
    private double traceWidth;
    private double safeDistAlongLine;

    public TraceElement(Line line, double width, double height, double layerHeight)
    {
        this.ModelLine = line;
        this.Length = line.Length;
        this.Height = height;
        this.Width = width;
        this.traceHeight = height;
        this.traceWidth = width;
        this.IsHorizontal = Math.Abs(line.FromY - line.ToY) < 0.001;
        this.PauseLayer = (int)Math.Round(line.FromZ / layerHeight) + 1;
        this.ModelBox = CreateBoxFromLine(line, width, height);
        this.PickTemperature = 210;
        
        // Add tamping points at 1 width away from endpoints
        Vector3d dir = line.Direction;
        dir.Unitize();
        this.TampingPts.Add(new TampingPoint(line.From + dir * width, TampingType.End));
        this.TampingPts.Add(new TampingPoint(line.To - dir * width, TampingType.End));
    }

    public override void CalcIntersections(List<Embeddable> allEmbeddables)
    {
        // Find embeddables one layer below this trace
        double targetZ = Math.Round(this.ModelLine.FromZ - this.traceHeight, 4);
        
        foreach (var embeddable in allEmbeddables)
        {
            // Check Trace-Trace intersections
            if (embeddable is TraceElement otherTrace)
            {
                double otherZ = Math.Round(otherTrace.ModelLine.FromZ, 4);
                if (Math.Abs(otherZ - targetZ) < 0.001)
                {
                    Point3d intersectPt;
                    if (TryGetIntersection(this.ModelLine, otherTrace.ModelLine, this.traceWidth, out intersectPt))
                    {
                        // Use the lower trace's Z level (targetZ) for Intersections list
                        Point3d correctedPt = new Point3d(intersectPt.X, intersectPt.Y, targetZ);
                        this.Intersections.Add(correctedPt);
                        
                        // Add to tamping points at this line's Z height
                        Point3d tampPt = new Point3d(intersectPt.X, intersectPt.Y, this.ModelLine.FromZ);
                        this.TampingPts.Add(new TampingPoint(tampPt, TampingType.TraceTrace));
                    }
                }
            }
            // Check Trace-Plug intersections
            else if (embeddable is Plug plug)
            {
                double plugZ = Math.Round(plug.PlacePt.Z, 4);
                if (Math.Abs(plugZ - targetZ) < 0.001)
                {
                    // Check if trace line passes through plug location (2D check at Z level)
                    Point3d plug2D = new Point3d(plug.PlacePt.X, plug.PlacePt.Y, 0);
                    Line trace2D = new Line(
                        new Point3d(this.ModelLine.FromX, this.ModelLine.FromY, 0),
                        new Point3d(this.ModelLine.ToX, this.ModelLine.ToY, 0)
                    );
                    
                    double t = trace2D.ClosestParameter(plug2D);
                    if (t >= -0.01 && t <= 1.01)
                    {
                        Point3d closestPt = trace2D.PointAt(t);
                        double dist = closestPt.DistanceTo(plug2D);
                        
                        // If trace passes within width/2 of plug center, it intersects
                        if (dist < this.traceWidth / 2.0 + 0.001)
                        {
                            // Add intersection at the plug's Z level
                            Point3d intersectPt = new Point3d(closestPt.X, closestPt.Y, plug.PlacePt.Z);
                            this.Intersections.Add(intersectPt);
                            
                            // Add to tamping points at this line's Z height
                            Point3d tampPt = new Point3d(closestPt.X, closestPt.Y, this.ModelLine.FromZ);
                            this.TampingPts.Add(new TampingPoint(tampPt, TampingType.TracePlug));
                        }
                    }
                }
            }
        }
    }

    public void CalculateSafePickDistance()
    {
        double L = this.Length;
        double mid = L / 2.0;
        
        // Convert 3D intersection points to 1D distances along the line
        List<double> intersectDistances = new List<double>();
        foreach (Point3d pt in Intersections)
        {
            double d = ModelLine.From.DistanceTo(pt);
            intersectDistances.Add(d);
        }

        // List of candidate coordinates to check
        List<double> candidates = new List<double> { mid };
        HashSet<double> visited = new HashSet<double>();
        double bestDistAlong = -1;

        while (candidates.Count > 0)
        {
            // Sort by proximity to center and pick the closest
            candidates = candidates.OrderBy(c => Math.Abs(c - mid)).ToList();
            double current = candidates[0];
            candidates.RemoveAt(0);

            // Avoid infinite loops
            if (visited.Contains(Math.Round(current, 4))) continue;
            visited.Add(Math.Round(current, 4));

            // Check if coordinate is on the physical line
            if (current < 0 || current > L) continue;

            // Check if current is in any "Danger Zone"
            bool inDanger = false;
            foreach (double d in intersectDistances)
            {
                if (current > d - this.Width + 0.001 && current < d + this.Width - 0.001)
                {
                    inDanger = true;
                    candidates.Add(d - this.Width);
                    candidates.Add(d + this.Width);
                    break;
                }
            }

            if (!inDanger)
            {
                bestDistAlong = current;
                break;
            }
        }

        if (bestDistAlong == -1)
            throw new Exception($"No safe pick/place spot found for trace at Z={ModelLine.FromZ}");

        this.safeDistAlongLine = bestDistAlong;
    }

    public override void CalculatePickPlace(Point3d pickCentre)
    {
        if (this.TrayCurve == null)
            throw new Exception("TrayCurve must be set before calling CalculatePickPlace");
        
        // Check orientation by comparing dimensions
        BoundingBox bbox = this.TrayCurve.GetBoundingBox(true);
        double rectWidth = bbox.Max.X - bbox.Min.X;
        double rectHeight = bbox.Max.Y - bbox.Min.Y;
        bool horizontalInTray = rectWidth > rectHeight;
        
        Point3d pickPt;
        if (horizontalInTray)
            pickPt = new Point3d(bbox.Min.X + safeDistAlongLine, pickCentre.Y, this.Height);
        else
            pickPt = new Point3d(pickCentre.X, bbox.Min.Y + safeDistAlongLine, this.Height);

        // Place point is calculated by moving along the ModelLine direction
        Vector3d dir = ModelLine.Direction;
        dir.Unitize();
        Point3d placePt = ModelLine.From + (dir * safeDistAlongLine);

        this.PickPt = pickPt;
        this.PlacePt = placePt;
    }

    private static bool TryGetIntersection(Line top, Line bottom, double width, out Point3d result)
    {
        result = Point3d.Unset;
        Line t2 = new Line(new Point3d(top.FromX, top.FromY, 0), new Point3d(top.ToX, top.ToY, 0));
        Line b2 = new Line(new Point3d(bottom.FromX, bottom.FromY, 0), new Point3d(bottom.ToX, bottom.ToY, 0));

        double a, b;
        if (Intersection.LineLine(t2, b2, out a, out b))
        {
            if (t2.PointAt(a).DistanceTo(b2.PointAt(b)) < 0.01 && a >= -0.01 && a <= 1.01 && b >= -0.01 && b <= 1.01)
            {
                result = top.PointAt(a);
                return true;
            }
        }
        
        // Co-linear check
        if (t2.DistanceTo(b2.From, true) < 0.01 && t2.DistanceTo(b2.To, true) < 0.01)
        {
            double tS = t2.ClosestParameter(b2.From);
            double tE = t2.ClosestParameter(b2.To);
            double oMin = Math.Max(0, Math.Min(tS, tE));
            double oMax = Math.Min(1, Math.Max(tS, tE));
            if (oMax - oMin > 0.01)
            {
                result = top.PointAt((oMin + oMax) / 2.0);
                return true;
            }
        }
        return false;
    }

    private Brep CreateBoxFromLine(Line l, double w, double h)
    {
        Vector3d side = Vector3d.CrossProduct(l.Direction / l.Length, Vector3d.ZAxis) * (w / 2.0);
        Polyline p = new Polyline { l.From + side, l.From - side, l.To - side, l.To + side, l.From + side };
        Curve crv = p.ToNurbsCurve();
        if (crv.ClosedCurveOrientation(Vector3d.ZAxis) == CurveOrientation.Clockwise)
            crv.Reverse();
        return Extrusion.Create(crv, -h, true).ToBrep();
    }
}

/// <summary>
/// Represents a plug/connector element with pick/place logic (no tamping)
/// </summary>
public class Plug : Embeddable
{
    public List<Point3d> Intersections = new List<Point3d>();
    public double Radius { get; private set; }
    public double Height { get; private set; }

    public Plug(Point3d centerPt, double radius, double plugHeight, double plateHeight, double layerHeight)
    {
        this.Radius = radius;
        this.Height = plugHeight;
        this.PlacePt = centerPt;
        this.PickTemperature = 100;
        this.PauseLayer = (int)Math.Round(centerPt.Z / layerHeight) + 1;
        // Note: Plugs have no tamping points (TampingPts remains empty)
    }

    public override void CalcIntersections(List<Embeddable> allEmbeddables)
    {
        // Check if plug's base intersects with traces or other plugs
        double baseZ = Math.Round(this.PlacePt.Z - this.Height, 4);
        Point3d plug2D = new Point3d(this.PlacePt.X, this.PlacePt.Y, 0);
        
        foreach (var embeddable in allEmbeddables)
        {
            if (embeddable == this) continue;
            
            // Check Plug-Trace intersections
            if (embeddable is TraceElement trace)
            {
                double traceZ = Math.Round(trace.ModelLine.FromZ, 4);
                if (Math.Abs(traceZ - baseZ) < 0.001)
                {
                    Line trace2D = new Line(
                        new Point3d(trace.ModelLine.FromX, trace.ModelLine.FromY, 0),
                        new Point3d(trace.ModelLine.ToX, trace.ModelLine.ToY, 0)
                    );
                    
                    double t = trace2D.ClosestParameter(plug2D);
                    if (t >= -0.01 && t <= 1.01)
                    {
                        Point3d closestPt = trace2D.PointAt(t);
                        double dist = closestPt.DistanceTo(plug2D);
                        
                        if (dist < this.Radius + 0.001)
                        {
                            Point3d intersectPt = new Point3d(this.PlacePt.X, this.PlacePt.Y, baseZ);
                            this.Intersections.Add(intersectPt);
                        }
                    }
                }
            }
            // Check Plug-Plug intersections
            else if (embeddable is Plug otherPlug)
            {
                double otherZ = Math.Round(otherPlug.PlacePt.Z, 4);
                if (Math.Abs(otherZ - baseZ) < 0.001)
                {
                    Point3d other2D = new Point3d(otherPlug.PlacePt.X, otherPlug.PlacePt.Y, 0);
                    double dist = plug2D.DistanceTo(other2D);
                    
                    if (dist < this.Radius + otherPlug.Radius + 0.001)
                    {
                        Point3d intersectPt = new Point3d(this.PlacePt.X, this.PlacePt.Y, baseZ);
                        this.Intersections.Add(intersectPt);
                    }
                }
            }
        }
    }

    public override void CalculatePickPlace(Point3d pickCentre)
    {
        // Pick point is at the center of the cutout at the plug height
        this.PickPt = new Point3d(pickCentre.X, pickCentre.Y, this.Height);
        // Place point is already set in constructor
    }
}

// ============================================================================
// TRAY LAYOUT HELPER
// ============================================================================

/// <summary>
/// Manages tray layout and cutout generation for embeddables
/// </summary>
public class Tray
{
    public Brep TrayBrep { get; private set; }
    public List<Line> PickPlaceLines { get; private set; }
    private List<Curve> cutoutCurves;
    
    public Tray(List<Embeddable> allEmbeddables, Point3d origin, double spacing)
    {
        cutoutCurves = new List<Curve>();
        PickPlaceLines = new List<Line>();
        
        // Separate traces and plugs
        List<TraceElement> allTraces = allEmbeddables.OfType<TraceElement>().ToList();
        List<Plug> allPlugs = allEmbeddables.OfType<Plug>().ToList();
        
        // Group traces by orientation, width, and height
        var hTraceGroups = allTraces
            .Where(t => t.IsHorizontal)
            .GroupBy(t => new { t.Width, t.Height })
            .OrderBy(g => g.Key.Width).ThenBy(g => g.Key.Height)
            .ToList();
            
        var vTraceGroups = allTraces
            .Where(t => !t.IsHorizontal)
            .GroupBy(t => new { t.Width, t.Height })
            .OrderBy(g => g.Key.Width).ThenBy(g => g.Key.Height)
            .ToList();
        
        // Group plugs by radius and height
        var plugGroups = allPlugs
            .GroupBy(p => new { p.Radius, p.Height })
            .OrderBy(g => g.Key.Radius).ThenBy(g => g.Key.Height)
            .ToList();
        
        // Calculate dimensions for horizontal traces
        double maxHLength = 0;
        double hTracesHeight = 0;
        foreach (var group in hTraceGroups)
        {
            double groupMaxLength = group.Max(t => t.Length);
            if (groupMaxLength > maxHLength) maxHLength = groupMaxLength;
            hTracesHeight += group.Count() * (group.First().Width + spacing);
        }
        
        // Calculate dimensions for vertical traces
        double maxVLength = 0;
        double vTracesWidth = 0;
        foreach (var group in vTraceGroups)
        {
            double groupMaxLength = group.Max(t => t.Length);
            if (groupMaxLength > maxVLength) maxVLength = groupMaxLength;
            vTracesWidth += group.Count() * (group.First().Width + spacing);
        }
        
        // Calculate plug area dimensions
        double plugAreaWidth = 0;
        if (allPlugs.Count > 0)
        {
            foreach (var plugGroup in plugGroups)
            {
                double plugRadius = plugGroup.First().Radius;
                double plugDiameter = plugRadius * 2.0;
                plugAreaWidth = Math.Max(plugAreaWidth, plugDiameter + spacing);
            }
        }
        
        // Initial tray dimensions
        double trayWidth = maxHLength + vTracesWidth + plugAreaWidth + 3 * spacing;
        double trayHeight = Math.Max(maxVLength + spacing * 2, hTracesHeight + spacing * 2);
        
        // Layout horizontal traces
        double currentY = origin.Y + spacing;
        foreach (var group in hTraceGroups)
        {
            double groupWidth = group.First().Width;
            
            foreach (var trace in group)
            {
                Point3d start = new Point3d(origin.X + spacing, currentY, 0);
                double rW = trace.Length;
                double rH = groupWidth;
                trace.TrayCurve = new Rectangle3d(new Plane(start, Vector3d.ZAxis), rW, rH).ToNurbsCurve();
                cutoutCurves.Add(trace.TrayCurve);
                
                Point3d cutoutCentre = new Point3d(start.X + rW / 2.0, start.Y + rH / 2.0, 0);
                trace.CalculatePickPlace(cutoutCentre);
                PickPlaceLines.Add(new Line(trace.PickPt, trace.PlacePt));
                
                currentY += groupWidth + spacing;
            }
        }
        
        // Layout vertical traces
        double currentX = origin.X + maxHLength + 2 * spacing;
        foreach (var group in vTraceGroups)
        {
            double groupWidth = group.First().Width;
            
            foreach (var trace in group)
            {
                Point3d start = new Point3d(currentX, origin.Y + spacing, 0);
                double rW = groupWidth;
                double rH = trace.Length;
                trace.TrayCurve = new Rectangle3d(new Plane(start, Vector3d.ZAxis), rW, rH).ToNurbsCurve();
                cutoutCurves.Add(trace.TrayCurve);
                
                Point3d cutoutCentre = new Point3d(start.X + rW / 2.0, start.Y + rH / 2.0, 0);
                trace.CalculatePickPlace(cutoutCentre);
                PickPlaceLines.Add(new Line(trace.PickPt, trace.PlacePt));
                
                currentX += groupWidth + spacing;
            }
        }
        
        // Place plugs to the right of traces
        if (allPlugs.Count > 0)
        {
            double plugStartX = origin.X + maxHLength + vTracesWidth + 2 * spacing;
            double plugStartY = origin.Y + spacing;
            
            foreach (var plugGroup in plugGroups)
            {
                double plugRadius = plugGroup.First().Radius;
                double plugSpacing = plugRadius * 2.0 + spacing;
                
                foreach (var plug in plugGroup)
                {
                    double x = plugStartX + plugRadius;
                    double y = plugStartY + plugRadius;
                    
                    Circle plugCircle = new Circle(new Plane(new Point3d(x, y, 0), Vector3d.ZAxis), plugRadius + 0.1);
                    cutoutCurves.Add(plugCircle.ToNurbsCurve());
                    
                    Point3d cutoutCentre = new Point3d(x, y, 0);
                    plug.CalculatePickPlace(cutoutCentre);
                    PickPlaceLines.Add(new Line(plug.PickPt, plug.PlacePt));
                    
                    plugStartY += plugSpacing;
                }
            }
            
            // Extend tray height if plugs require more space
            double requiredHeight = plugStartY + spacing - origin.Y;
            if (requiredHeight > trayHeight)
                trayHeight = requiredHeight;
        }
        
        // Create tray boundary
        Rectangle3d trayBoundary = new Rectangle3d(new Plane(origin, Vector3d.ZAxis), trayWidth, trayHeight);
        cutoutCurves.Insert(0, trayBoundary.ToNurbsCurve());
        
        // Generate Tray Brep
        double maxTraceHeight = allTraces.Count > 0 ? allTraces.Max(t => t.Height) : 1.0;
        Brep[] surfaces = Brep.CreatePlanarBreps(cutoutCurves, 0.001);
        if (surfaces != null && surfaces.Length > 0)
            this.TrayBrep = Brep.CreateFromOffsetFace(surfaces[0].Faces[0], maxTraceHeight, 0.001, false, true);
    }
}

// ============================================================================
// MAIN SCRIPT
// ============================================================================

public class Script_Instance : GH_ScriptInstance
{
    private void RunScript(
		List<Line> traceLines,
		List<Point3d> plugPoints,
		double plugRadius,
		double plugHeight,
		double traceWidth,
		double traceHeight,
		Point3d origin,
		double layerHeight,
		double traySpacing,
		ref object operations,
		ref object trayBrep,
		ref object modelBreps,
		ref object intersections,
		ref object pickPlaceLines)
    {
        // Validate inputs
        if (Math.Abs(traceHeight % layerHeight) > 0.001 && Math.Abs(traceHeight % layerHeight - layerHeight) > 0.001)
            throw new Exception("traceHeight must be a multiple of layerHeight.");
            
        if (Math.Abs(plugHeight % layerHeight) > 0.001 && Math.Abs(plugHeight % layerHeight - layerHeight) > 0.001)
            throw new Exception("plugHeight must be a multiple of layerHeight.");

        // Initialize Traces
        List<TraceElement> allTraces = new List<TraceElement>();
        foreach (Line ln in traceLines)
        {
            allTraces.Add(new TraceElement(ln, traceWidth, traceHeight, layerHeight));
        }

        // Initialize Plugs
        List<Plug> allPlugs = new List<Plug>();
        foreach (Point3d plugPt in plugPoints)
        {
            allPlugs.Add(new Plug(plugPt, plugRadius, plugHeight, traceHeight, layerHeight));
        }

        // Combine all embeddables
        List<Embeddable> allEmbeddables = new List<Embeddable>();
        allEmbeddables.AddRange(allTraces);
        allEmbeddables.AddRange(allPlugs);

        // Calculate intersections and safe pick distances
        foreach (var trace in allTraces)
        {
            trace.CalcIntersections(allEmbeddables);
            trace.CalculateSafePickDistance();
        }
        
        foreach (var plug in allPlugs)
        {
            plug.CalcIntersections(allEmbeddables);
        }

        // Create tray (calculates pick/place points)
        Tray tray = new Tray(allEmbeddables, origin, traySpacing);
        trayBrep = tray.TrayBrep;
        pickPlaceLines = tray.PickPlaceLines;

        // Collect model Breps for traces
        List<Brep> allModelBreps = allTraces.Select(t => t.ModelBox).ToList();
        
        // Add plug cylinders
        foreach (var plug in allPlugs)
        {
            Circle plugCircle = new Circle(new Plane(plug.PlacePt, Vector3d.ZAxis), plugRadius + 0.35);
            Circle plugCircle2 = new Circle(new Plane(new Point3d(plug.PlacePt.X, plug.PlacePt.Y, plug.PlacePt.Z - plugHeight), Vector3d.ZAxis), plugRadius + 0.5);
            
            List<Curve> curves = new List<Curve> { plugCircle.ToNurbsCurve(), plugCircle2.ToNurbsCurve() };
            Brep[] lofts = Brep.CreateFromLoft(curves, Point3d.Unset, Point3d.Unset, LoftType.Tight, false);
            Brep plugBrep = lofts[0].CapPlanarHoles(0.01);

            if (plugBrep != null)
                allModelBreps.Add(plugBrep);
        }
        
        // Collect all intersections
        List<Point3d> allIntersections = new List<Point3d>();
        foreach (var trace in allTraces)
        {
            allIntersections.AddRange(trace.Intersections);
        }
        foreach (var plug in allPlugs)
        {
            allIntersections.AddRange(plug.Intersections);
        }
        
        // Final outputs
        operations = allEmbeddables;
        modelBreps = allModelBreps;
        intersections = allIntersections;
    }
}
# ---------- end c_script_2 ----------
geo = Geometry(<extrusion referenced from the Rhino model>)
button = CreateButton(ButtonName="hello", ButtonStyle=0)
slider = CreateSlider(Slider=layer, ShowBounds=False, ShowTicks=False, ShowTooltip=False, ShowValLabel=True, showLabel=True)
sp = ScriptParasite2(Enable=Toggle(True), Path=panel, TargetComponent=c_script_2)
button_2 = CreateButton(ButtonName="Slice", ButtonStyle=0)
pulldown = CreatePulldownMenu(Label="Select Printer", ListItems=panel_3, SelectedIndex=Slider(0, range=0..100), showLabel=True)
sunion = SolidUnion(Breps=c_script_2.modelBreps)
pickbtn = CreateRhinoPickButton(ButtonName="draw trace", Prompt="Please select geometry...", AllowMultiple=True, AllowNone=True, Type=0, ButtonStyle=0)
line = Line(c_script_2.pickPlaceLines)
cap = CapHoles(Brep=geo)
brep = Brep(c_script_2.modelBreps)
pt_3 = Point(c_script_2.intersections)
panel_4 = Panel(button)
sdiff = SolidDifference(BrepsA=cap, BrepsB=sunion)
c_script_3 = CSharpScript(UI_In=button)  # -> out, UI_Out, Geometry; inputs UI_In: Button, another: Point3dList
#   port UI_In: Casts source data to System.Windows.Controls.Button
# ---------- c_script_3: C# ----------
// Standard WPF References
#region Usings
#r "PresentationFramework"
#r "PresentationCore"
#r "WindowsBase"
#r "System.Xaml"

using System;
using System.Linq;
using System.Collections;
using System.Collections.Generic;
using System.Reflection; // <--- REQUIRED for the fix to work

using Rhino;
using Rhino.Geometry;
using Grasshopper;
using Grasshopper.Kernel;
using Grasshopper.Kernel.Data;
using Grasshopper.Kernel.Types;
using System.Windows.Controls;
// using System.Windows.Controls.Button; 
using System.Windows;
#endregion

public class Script_Instance : GH_ScriptInstance
{
    // Store the trace points
    private List<Point3d> _tracePoints = new List<Point3d>();

    private void RunScript(
		Button UI_In,
		Rhino.Collections.Point3dList another,
		ref object UI_Out,
		ref object Geometry)
    {
        // 1. SAFETY CHECK
        // if (UI_In == null) return;

        // 2. ROBUST UNWRAP (The Fix)
        // This digs through the GH_ObjectWrapper to find the actual button
        Button btn = ExtractButton(UI_In);

        if (btn == null)
        {
            // If we still can't find it, print why so you can see it in the "out" window
            Print("Error: Could not extract Button. Input type: " + UI_In.GetType().Name);
            return;
        }

        // 3. ATTACH TRACE LOGIC
        // We remove the event first to ensure we don't add it multiple times
        btn.Click -= OnTraceClick; 
        btn.Click += OnTraceClick;

        // 4. OUTPUTS
        UI_Out = UI_In;
        Geometry = _tracePoints;
    }

    // ----------------------------------------------------------------
    // HELPER: Recursively finds the Button inside wrappers
    // ----------------------------------------------------------------
    private Button ExtractButton(object data)
    {
        if (data == null) return null;

        // Is it already a button?
        if (data is Button b) return b;

        // Is it a generic Grasshopper Wrapper? -> Peel it
        if (data is GH_ObjectWrapper wrapper)
            return ExtractButton(wrapper.Value);

        // Is it Human UI Goo? -> Use Reflection to peek inside without needing DLLs
        PropertyInfo valProp = data.GetType().GetProperty("Value");
        if (valProp != null)
        {
            object innerValue = valProp.GetValue(data);
            return ExtractButton(innerValue);
        }

        return null;
    }

    // ----------------------------------------------------------------
    // LOGIC: The Tracing Tool
    // ----------------------------------------------------------------
    private void OnTraceClick(object sender, RoutedEventArgs e)
    {
        Button btn = sender as Button;
        Window parent = Window.GetWindow(btn);
        
        if(parent != null) parent.Hide();

        try
        {
            List<Point3d> points = new List<Point3d>();
            
            while(true)
            {
                Rhino.Input.Custom.GetPoint gp = new Rhino.Input.Custom.GetPoint();
                gp.SetCommandPrompt("Trace path (Enter to finish)");
                gp.AcceptNothing(true); 

                if (points.Count > 0)
                {
                    gp.DrawLineFromPoint(points[points.Count - 1], true);
                    gp.EnableDrawLineFromPoint(true);
                }
                
                gp.Get();

                if(gp.CommandResult() == Rhino.Commands.Result.Cancel) { points.Clear(); break; }
                else if(gp.CommandResult() == Rhino.Commands.Result.Success) { points.Add(gp.Point()); }
                else { break; }
            }

            if (points.Count > 0)
            {
                _tracePoints = points;
                // Update the component to output the new geometry
                this.Component.ExpireSolution(true);
            }
        }
        finally
        {
            if(parent != null) parent.Show();
        }
    }
}
# ---------- end c_script_3 ----------
c_script_4 = CSharpScript(x=button)  # -> out, A
# ---------- c_script_4: C# ----------
// Standard WPF References
#r "PresentationFramework"
#r "PresentationCore"
#r "WindowsBase"
#r "System.Xaml"

using System;
using System.Reflection; // Needed for reflection
using System.Windows.Controls; // For Button
using Grasshopper.Kernel.Types; // For GH_ObjectWrapper

public class Script_Instance : GH_ScriptInstance
{
    private void RunScript(object x, object y, ref object A)
    {
        Button myBtn = null;
        if (x == null)
        {
            Print("null");
            return;
        }

        // --- DEBUGGING: Uncomment this to see exactly what x is ---
        // Print(x.GetType().ToString()); 
        // ----------------------------------------------------------

        // STEP 1: Remove the GH_ObjectWrapper (The Outer Layer)
        object intermediate = x;
        if (x is GH_ObjectWrapper wrapper)
        {
            intermediate = wrapper.Value;
        }

        // STEP 2: Remove the UIElement_Goo (The Middle Layer)
        // We use Reflection here to avoid the "Type Conversion Failed" error.
        // We look for a property called "Value" on the object.
        if (intermediate != null)
        {
            Type type = intermediate.GetType();
            PropertyInfo prop = type.GetProperty("Value");

            if (prop != null)
            {
                // This extracts the Button from the Goo
                object realItem = prop.GetValue(intermediate);
                
                if (realItem is Button)
                {
                    myBtn = (Button)realItem;
                }
            }
            // Fallback: Maybe intermediate was already the button?
            else if (intermediate is Button)
            {
                myBtn = (Button)intermediate;
            }
        }

        // STEP 3: Success?
        if (myBtn != null)
        {
            myBtn.Content = "Unwrapped!";
            // Print("Success: Found the button.");
        }
        else
        {
            Print("Failed to extract button.");
        }

        A = myBtn;
    }
}
# ---------- end c_script_4 ----------
dam = DataDam(DataA=sdiff, DataB=c_script_2.trayBrep, DataC=c_script_2.operations, BufferDelay=10000000, BufferMode=0)  # -> DataA, DataB, DataC
values = ValueListener(Elements=button_2, SomeProperty=True)  # -> Values, Indices
values_2 = ValueListener(Elements=pickbtn, SomeProperty=True)  # -> Values, Indices
values_3 = ValueListener(Elements=slider, SomeProperty=True)  # -> Values, Indices
values_4 = ValueListener(Elements=pulldown, SomeProperty=True)  # -> Values, Indices
merge = Merge(Data1=pulldown, Data2=label, Data3=slider, Data4=pickbtn, Data5=button_2)
panel_5 = Panel(c_script_4.out)
sp_2 = ScriptParasite2(Enable=Toggle(True), Path=panel_2, TargetComponent=py3)
or = GateOr(A=values.Values, B=Toggle(True))
pt_4 = Point(values_2.Values)
geo_2 = Geometry(dam.DataB)
panel_6 = Panel("C:\Users\Oliver\OneDrive - University of Bristol\PhD\UIST 2026 Print Place Printegrate\Designer")

# ----
# 3. Add the element to the window
addelems = AddElements(Window=launchwin, Elements=flatten(merge), DoVLChecking=True)  # -> AddedElements, ElementNames

# ----
# 4. Listen to the UI Elements
panel_7 = Panel(values_3.Values)

py3 = Python3Script(model=dam.DataA, tray=geo_2, run=or, path=panel_6, operations=dam.DataC, printer=values_4.Values)  # -> out, a; inputs model: Mesh, tray: Mesh, path: String, operations: list, printer: String
# ---------- py3: Python ----------
import subprocess
import os
import shutil
import re
import sys
import Rhino
import System


# --- USER CONFIGURATION ---
MODULE_PATH = r"C:\Users\Oliver\OneDrive - University of Bristol\PhD\UIST 2026 Print Place Printegrate\Conductor_tests"
SLICER_PATH = r"C:\Program Files\Prusa3D\PrusaSlicer\prusa-slicer-console.exe"
WIPE_LOCATION = (350, 10, 9)

# --- PICK AND PLACE CONFIGURATION ---
CONFIG = {
    'trace': {
        # Pick parameters
        'pick_z_offset': -0.2,          # Z offset below pick point (mm)
        'pick_extrude_amount': 0.5,      # Extrusion during pick (mm)
        'pick_extrude_feedrate': 600,    # Feedrate during pick extrusion (mm/min)
        'pick_cool_temp': 140,           # Temperature to cool to for grabbing (°C)
        
        # Place parameters
        'place_z_offset': -0.4,          # Final Z offset below place point (mm)
        'place_heat_temp': 210,          # Temperature to heat to for release (°C)
        'place_preheat_height': 0,       # Height above place point to pre-heat (mm) - 0 means at place point
        'place_dwell_time': 1000,        # Dwell time after placement (ms)
        
        # Movement feedrates
        'travel_feedrate': 6000,         # XY travel speed (mm/min)
        'z_lift_feedrate': 1000,         # Z lift speed (mm/min)
        'place_feedrate': 300,           # Z approach speed for placement (mm/min)
    },
    'plug': {
        # Pick parameters
        'pick_z_offset': -0.45,          # Z offset below pick point (mm)
        'pick_extrude_amount': 2.0,      # Extrusion during pick (mm)
        'pick_extrude_feedrate': 200,    # Feedrate during pick extrusion (mm/min)
        'pick_cool_temp': 140,           # Temperature to cool to for grabbing (°C)
        
        # Place parameters
        'place_z_offset': -1.4,          # Final Z offset below place point (mm)
        'place_heat_temp': 210,          # Temperature to heat to for release (°C)
        'place_preheat_height': 0.25,    # Height above place point to pre-heat (mm)
        'place_dwell_time': 1000,        # Dwell time after placement (ms)
        
        # Movement feedrates
        'travel_feedrate': 6000,         # XY travel speed (mm/min)
        'z_lift_feedrate': 1000,         # Z lift speed (mm/min)
        'place_feedrate': 100,           # Z approach speed for placement (mm/min)
    },
    'tamping': {
        # Tamping parameters by type (TampingType enum: 0=End, 1=TraceTrace, 2=TracePlug)
        0: {  # End
            'depth_offset': 1.0,         # Depth below tamp position (mm)
            'feedrate': 300,             # Z approach speed (mm/min)
            'dwell_time': 250,           # Dwell time at tamp position (ms)
        },
        1: {  # TraceTrace
            'depth_offset': 2.0,         # Depth below tamp position (mm)
            'feedrate': 200,             # Z approach speed (mm/min)
            'dwell_time': 500,           # Dwell time at tamp position (ms)
        },
        2: {  # TracePlug
            'depth_offset': 2.8,         # Depth below tamp position (mm)
            'feedrate': 200,             # Z approach speed (mm/min)
            'dwell_time': 100,          # Dwell time at tamp position (ms)
        },
        'travel_feedrate': 3000,         # XY travel speed to tamping points (mm/min)
        'lift_feedrate': 1000,           # Z lift speed after tamping (mm/min)
        'lift_height': 2.0,              # Height to lift after tamping (mm)
    }
}

if MODULE_PATH not in sys.path:
    sys.path.append(MODULE_PATH)

from gcode_writer import GcodeWriter


def process_print():
    """Main processing function for pick-and-place printing."""
    
    # --- 1. DIRECTORY & PATH MANAGEMENT ---
    project_dir = path
    printer_name = str(globals().get("printer", "")).strip().lower()
    
    # Determine file prefix based on printer type
    if printer_name == "prusa xl" or printer_name == "xl":
        file_prefix = "XL_"
    elif printer_name == "prusa mini" or printer_name == "mini":
        file_prefix = "MINI_"
    else:
        file_prefix = ""
    
    output_dir = os.path.join(project_dir, "output")
    snippet_dir = os.path.join(project_dir, "resources", "gcode_snippets")

    # Clean and recreate the output folder
    if os.path.exists(output_dir):
        shutil.rmtree(output_dir)
    os.makedirs(output_dir)

    # Define all file paths
    tray_3mf_path = os.path.join(output_dir, "tray.3mf")
    model_3mf_path = os.path.join(output_dir, "model.3mf")
    setup_gcode_path = os.path.join(output_dir, "setup.gcode")
    part_gcode_path = os.path.join(output_dir, "part.gcode")
    config_path = os.path.join(project_dir, "resources", f"{file_prefix}config.ini")
    final_output_path = os.path.join(output_dir, "combined_output.gcode")

    # --- 2. 3MF EXPORT STAGE ---
    def export_to_3mf(mesh_data, file_path):
        """Export a mesh to 3MF format."""
        doc = Rhino.RhinoDoc.CreateHeadless(None)
        opts = Rhino.FileIO.File3mfWriteOptions()
        opts.Title = "Grasshopper Export"
        doc.Objects.AddMesh(mesh_data)
        success = doc.Export(file_path, opts.ToDictionary())
        doc.Dispose()
        return success

    if export_to_3mf(tray, tray_3mf_path) and export_to_3mf(model, model_3mf_path):
        print("3MF Files Exported Successfully.")
    else:
        print("Failed to export 3MF files.")
        return

    # --- 3. SLICING STAGE ---
    def run_slicer(input_file, output_file):
        """Run PrusaSlicer on an input file."""
        cmd = [
            SLICER_PATH, "-s", "-g",
            "--load", config_path,
            "-o", output_file,
            input_file
        ]
        return subprocess.run(cmd, capture_output=True, text=True).stdout

    print("Slicing Setup...")
    run_slicer(tray_3mf_path, setup_gcode_path)
    print("Slicing Part...")
    run_slicer(model_3mf_path, part_gcode_path)

    # --- 4. G-CODE GENERATION FUNCTIONS ---
    def perform_nozzle_wipe(writer, location):
        """Perform nozzle wipe sequence at specified location."""
        writer.comment("Nozzle Wipe Sequence")
        orig_pos = writer.state.position
        wx, wy, wz = location
        
        # Move to wipe station
        writer.move_to(x=wx, y=wy, z=wz+10, feedrate=24000)
        writer.move_to(z=wz, feedrate=24000)
        writer.extrude(amount=10.0, feedrate=2400)
        
        # Back and forth wipes
        for _ in range(1):
            writer.move_to(y=wy + 30, feedrate=12000)
            writer.move_to(y=wy, feedrate=12000)
        writer.move_to(y=wy + 30, feedrate=12000)
        
        # Clear and return
        writer.move_to(z=wz+10, feedrate=24000)
        writer.move_to(x=orig_pos.x, y=orig_pos.y, z=orig_pos.z, feedrate=24000)

    def perform_pick_and_place(writer, embeddable, embeddable_type):
        """
        Execute pick and place operation for an embeddable element.
        
        Args:
            writer: GcodeWriter instance
            embeddable: The embeddable object (TraceElement or Plug) from C#
            embeddable_type: 'trace' or 'plug'
        """
        cfg = CONFIG[embeddable_type]
        writer.comment(f"=== Pick and Place: {embeddable_type.upper()} ===")

        pick_pt = embeddable.PickPt
        place_pt = embeddable.PlacePt
        tamp_pts = embeddable.TampingPts or []

        # Lift nozzle
        writer.move_to(z=writer.state.current_z + 10, feedrate=cfg['z_lift_feedrate'])

        # Turn off part cooling fan to prevent blowing parts away
        writer.write_line("M107")

        # Wipe nozzle and retract
        perform_nozzle_wipe(writer, WIPE_LOCATION)
        writer.extrude(-1, feedrate=2000)

        # === PICK SEQUENCE ===
        writer.comment("Pick Sequence")
        writer.move_to(x=pick_pt.X, y=pick_pt.Y, feedrate=cfg['travel_feedrate'])
        writer.move_to(z=pick_pt.Z + cfg['pick_z_offset'], feedrate=cfg['z_lift_feedrate'])
        writer.extrude(amount=cfg['pick_extrude_amount'], feedrate=cfg['pick_extrude_feedrate'])
        
        writer.comment("Cooling to grab...")
        writer.set_extruder_temp(cfg['pick_cool_temp'], wait=True)

        # === PLACE SEQUENCE ===
        writer.comment("Place Sequence")
        writer.move_to(z=place_pt.Z + 10, feedrate=cfg['z_lift_feedrate'])
        writer.move_to(x=place_pt.X, y=place_pt.Y, feedrate=cfg['travel_feedrate'])
        
        # Pre-heat and place behavior
        if cfg['place_preheat_height'] > 0:
            # Plug-style: pre-heat above the place point, then press down
            writer.move_to(z=place_pt.Z + cfg['place_preheat_height'], feedrate=cfg['z_lift_feedrate'])
            writer.comment("Preheating before placement...")
            writer.set_extruder_temp(cfg['place_heat_temp'], wait=True)
            writer.move_to(z=place_pt.Z + cfg['place_z_offset'], feedrate=cfg['place_feedrate'])
            writer.extrude(-1, feedrate=2000)
        else:
            # Trace-style: pre-heat at the final place position
            writer.move_to(z=place_pt.Z + cfg['place_z_offset'], feedrate=cfg['place_feedrate'])
            writer.comment("Heating to release...")
            writer.set_extruder_temp(cfg['place_heat_temp'], wait=True)
        
        writer.write_line(f"G4 P{cfg['place_dwell_time']}")
        writer.move_to(z=place_pt.Z + 2, feedrate=cfg['z_lift_feedrate'])
        writer.extrude(-1, feedrate=2000)

        # === TAMPING SEQUENCE ===
        if tamp_pts and len(tamp_pts) > 0:
            writer.comment(f"Tamping {len(tamp_pts)} Points")
            tamp_cfg = CONFIG['tamping']
            
            for tamp_pt in tamp_pts:
                # Access TampingPoint properties from C#
                position = tamp_pt.Position
                tamp_type = int(tamp_pt.Type)
                
                # Get type-specific parameters from Python CONFIG
                type_cfg = tamp_cfg[tamp_type]
                depth_offset = type_cfg['depth_offset']
                
                # Perform tamping motion
                writer.move_to(x=position.X, y=position.Y, feedrate=tamp_cfg['travel_feedrate'])
                writer.move_to(z=position.Z - depth_offset, feedrate=type_cfg['feedrate'])
                writer.write_line(f"G4 P{type_cfg['dwell_time']}")
                writer.move_to(z=position.Z + tamp_cfg['lift_height'], feedrate=tamp_cfg['lift_feedrate'])

        # Turn part cooling fan back on
        writer.write_line("M106")

    # --- 5. FINAL G-CODE ASSEMBLY ---
    with GcodeWriter(final_output_path) as writer:
        # Write preamble
        with open(os.path.join(snippet_dir, f"{file_prefix}preamble.gcode"), "r") as f:
            for line in f:
                writer.write_line(line.rstrip())

        # Write setup G-code (skip preamble, start from layer change)
        with open(setup_gcode_path, "r") as f:
            lines = f.readlines()
            start_idx = next((i for i, l in enumerate(lines) if ";LAYER_CHANGE" in l), 0)
            for line in lines[start_idx:]:
                writer.write_line(line.rstrip())

        last_setup_z = writer.state.current_z
        writer.pause()
        perform_nozzle_wipe(writer, WIPE_LOCATION)

        # Process part G-code with dynamic pick and place insertion
        writer.state.current_layer = 0
        z_has_been_adjusted = False
        completed_embeddable_indices = set()

        with open(part_gcode_path, "r") as f:
            part_lines = f.readlines()
            start_idx = next((i for i, l in enumerate(part_lines) if ";LAYER_CHANGE" in l), 0)
            
            for line in part_lines[start_idx:]:
                clean_line = line.rstrip()
                
                # Check for layer change to trigger pick and place
                if clean_line.startswith(";LAYER_CHANGE"):
                    writer.write_line(clean_line)
                    
                    embedded = False
                    # Search for embeddables scheduled for this layer
                    for i, embeddable in enumerate(operations):
                        if writer.state.current_layer == embeddable.PauseLayer and i not in completed_embeddable_indices:
                            embedded = True
                            
                            # Determine embeddable type
                            is_plug = hasattr(embeddable, 'Radius')
                            embeddable_type = 'plug' if is_plug else 'trace'
                            
                            writer.comment(f"Placing {embeddable_type.upper()} #{i+1}")
                            perform_pick_and_place(writer, embeddable, embeddable_type)
                            
                            completed_embeddable_indices.add(i)
                    
                    if embedded:
                        perform_nozzle_wipe(writer, WIPE_LOCATION)
                    continue

                # Adjust the very first Z-move to be relative to the previous setup height
                if not z_has_been_adjusted and "G1" in clean_line and "Z" in clean_line:
                    adjusted_z = last_setup_z + 30
                    clean_line = re.sub(r'Z[\d\.]+', f'Z{adjusted_z:.1f}', clean_line)
                    z_has_been_adjusted = True
                
                writer.write_line(clean_line)

        # Write end snippet
        with open(os.path.join(snippet_dir, f"{file_prefix}end.gcode"), "r") as f:
            for line in f:
                writer.write_line(line.rstrip())

    print("Process Complete. Final G-Code saved in output folder.")


if run:
    process_print()
# ---------- end py3 ----------
panel_8 = Panel("""C:\Users\Oliver\OneDrive - University of Bristol\PhD\UIST 2026 Print Place Printegrate\Designer\resources\xl_bed.stl
C:\Users\Oliver\OneDrive - University of Bristol\PhD\UIST 2026 Print Place Printegrate\Designer\resources\mini_bed.stl""")
panel_9 = Panel(pt_4)
panel_10 = Panel("C:\Users\Oliver\OneDrive - University of Bristol\PhD\UIST 2026 Print Place Printegrate\Designer\Scripts")

# ----
# 5. Update the contents of existing elements
pan = Panel("The current layer is {0}")
format = Format(Format=pan, Culture=127, Data0=values_3.Values)
setlabel = SetLabelContents(LabelToModify=label, NewLabelContents=format)

panel_11 = Panel(py3.out)
keysearch = KeyValueSearch(Keys=panel_3, Values=panel_8, Search=values_4.Values)
panel_12 = Panel("C:\Users\Oliver\OneDrive - University of Bristol\PhD\UIST 2026 Print Place Printegrate\Designer\Scripts")
c_script_5 = CSharpScript(filePath=keysearch)  # -> out, a; inputs filePath: String, offset: Double
# ---------- c_script_5: C# ----------
// Grasshopper Script Instance
#region Usings
using System;
using System.Linq;
using System.Collections;
using System.Collections.Generic;
using System.Drawing;

using Rhino;
using Rhino.Geometry;

using Grasshopper;
using Grasshopper.Kernel;
using Grasshopper.Kernel.Data;
using Grasshopper.Kernel.Types;
#endregion

public class Script_Instance : GH_ScriptInstance
{
    #region Notes
    /* 
      Members:
        RhinoDoc RhinoDocument
        GH_Document GrasshopperDocument
        IGH_Component Component
        int Iteration

      Methods (Virtual & overridable):
        Print(string text)
        Print(string format, params object[] args)
        Reflect(object obj)
        Reflect(object obj, string method_name)
    */
    #endregion

    private void RunScript(string filePath, double offset, ref object a)
        {
            if (string.IsNullOrEmpty(filePath) || !System.IO.File.Exists(filePath)) return;

            // 1. Reference the active Rhino Document
            RhinoDoc doc = RhinoDoc.ActiveDoc;

            // 2. Manage the "Print Bed" Layer
            string layerName = "Print Bed";
            int layerIndex = doc.Layers.Find(layerName, true);

            if (layerIndex != -1)
            {
                // Layer exists: Find and delete all objects on it
                var rhinoObjects = doc.Objects.FindByLayer(layerName);
                if (rhinoObjects != null)
                {
                    foreach (var obj in rhinoObjects)
                    {
                        doc.Objects.Delete(obj, true);
                    }
                }
            }
            else
            {
                // Layer doesn't exist: Create it
                Rhino.DocObjects.Layer newLayer = new Rhino.DocObjects.Layer();
                newLayer.Name = layerName;
                newLayer.Color = System.Drawing.Color.Cyan;
                layerIndex = doc.Layers.Add(newLayer);
            }

            // 3. Import the STL
            // We use a scripted command to ensure it goes directly to the active layer
            doc.Layers.SetCurrentLayerIndex(layerIndex, true);
            
            // Formatting the string for the Rhino command
            string command = string.Format("_-Import \"{0}\" _Enter", filePath);
            RhinoApp.RunScript(command, false);

            a = "Import Successful on " + DateTime.Now.ToString("HH:mm:ss");
        }
}
# ---------- end c_script_5 ----------
sp_3 = ScriptParasite2(Enable=Toggle(True), Path=panel_10, TargetComponent=c_script_5)
number_slider = Slider(10, range=0..10)
brep_2 = Brep(<brep referenced from the Rhino model>)
c_script_6 = CSharpScript(brepGeometry=brep_2, LayerIndex=values_3.Values, S=Slider(2.54, range=0..10), tracePoints=pt_4, clear=Toggle(False))  # -> out, A, Layer; inputs brepGeometry: Brep, LayerIndex: Int32, S: Double, tracePoints: list of Point3d, clear: Boolean
# ---------- c_script_6: C# ----------
using System;
using System.Collections;
using System.Collections.Generic;
using Rhino;
using Rhino.Geometry;
using Rhino.DocObjects;
using System.Linq;
using System.Drawing;

public class Script_Instance : GH_ScriptInstance
{
    private void RunScript(
		Brep brepGeometry,
		int LayerIndex,
		double S,
		List<Point3d> tracePoints,
		bool clear,
		ref object A,
		ref object Layer)
{
  // 1. Safety Checks
  if (brepGeometry == null || S <= 0) return;

  // 2. Create a plane at the specified Z height
  Plane slicePlane = new Plane(new Point3d(0, 0, LayerIndex*0.2), Vector3d.ZAxis);

  // 3. Intersect the plane with the brep to get the boundary curve(s)
  Curve[] intersectionCurves;
  Point3d[] intersectionPoints;
  
  Rhino.Geometry.Intersect.Intersection.BrepPlane(brepGeometry, slicePlane, 0.001, out intersectionCurves, out intersectionPoints);

  if (intersectionCurves == null || intersectionCurves.Length == 0) return;

  // Get the boundary curve from intersection (use the first/largest curve)
  Curve boundaryCurve = intersectionCurves[0];
  if (intersectionCurves.Length > 1)
  {
    boundaryCurve = intersectionCurves.OrderByDescending(c => c.GetLength()).First();
  }

  if (boundaryCurve == null || !boundaryCurve.IsClosed) return;

  // 4. Setup Rhino Layer
  string layerName = "GH_Generated_Grid";
  int layerIndex = RhinoDoc.ActiveDoc.Layers.Find(layerName, true);
  if (layerIndex == -1)
    layerIndex = RhinoDoc.ActiveDoc.Layers.Add(layerName, System.Drawing.Color.Blue);

  // 5. Delete existing points on that layer
  RhinoObject[] rhObjs = RhinoDoc.ActiveDoc.Objects.FindByLayer(layerName);
  if (rhObjs != null)
  {
    foreach (RhinoObject obj in rhObjs)
      RhinoDoc.ActiveDoc.Objects.Delete(obj, true);
  }

  // 6. Generate Grid
  BoundingBox bbox = boundaryCurve.GetBoundingBox(true);
  List<Point3d> gridPoints = new List<Point3d>();

  // Iterate based on Bounding Box
  for (double x = bbox.Min.X; x <= bbox.Max.X; x += S)
  {
    for (double y = bbox.Min.Y; y <= bbox.Max.Y; y += S)
    {
      Point3d testPt = new Point3d(x, y, LayerIndex*0.2);

      // 7. The "Planar" Point-in-Curve Test
      // RegionContainment.Inside means it's strictly inside the boundary
      PointContainment result = boundaryCurve.Contains(testPt, slicePlane, RhinoDoc.ActiveDoc.ModelAbsoluteTolerance);
      
      if (result == PointContainment.Inside || result == PointContainment.Coincident)
      {
        gridPoints.Add(testPt);

        // 8. Bake to Rhino
        ObjectAttributes attr = new ObjectAttributes();
        attr.LayerIndex = layerIndex;
        RhinoDoc.ActiveDoc.Objects.AddPoint(testPt, attr);
      }
    }
  }

  // Finalize
  RhinoDoc.ActiveDoc.Views.Redraw();
  A = gridPoints;
  
  // Lines for tracePoints on "Traces" layer
  string tracesLayerName = "Traces";
  int tracesLayerIndex = RhinoDoc.ActiveDoc.Layers.Find(tracesLayerName, true);
  if (tracesLayerIndex == -1)
    tracesLayerIndex = RhinoDoc.ActiveDoc.Layers.Add(tracesLayerName, Color.Red);

  if (tracePoints != null && tracePoints.Count >= 2)
  {
    double tol = RhinoDoc.ActiveDoc.ModelAbsoluteTolerance;
    RhinoObject[] existingTraceObjs = RhinoDoc.ActiveDoc.Objects.FindByLayer(tracesLayerName);
    for (int i = 0; i < tracePoints.Count - 1; i++)
    {
      Point3d p0 = tracePoints[i];
      Point3d p1 = tracePoints[i + 1];
      if (p0.DistanceTo(p1) <= tol) continue;

      bool exists = LineExistsBetween(p0, p1, existingTraceObjs, tol);
      if (exists) continue;

      ObjectAttributes attrLine = new ObjectAttributes();
      attrLine.LayerIndex = tracesLayerIndex;
      RhinoDoc.ActiveDoc.Objects.AddLine(new Line(p0, p1), attrLine);
    }
    RhinoDoc.ActiveDoc.Views.Redraw();
    Layer = tracesLayerIndex;
  }
  
}

  private bool LineExistsBetween(Point3d a, Point3d b, RhinoObject[] layerObjs, double tol)
  {
    if (layerObjs == null || layerObjs.Length == 0) return false;
    foreach (var obj in layerObjs)
    {
      var curve = obj.Geometry as Curve;
      if (curve == null) continue;
      var lc = curve as LineCurve;
      if (lc == null) continue;
      var s = lc.PointAtStart;
      var e = lc.PointAtEnd;
      bool direct = a.DistanceTo(s) <= tol && b.DistanceTo(e) <= tol;
      bool reverse = a.DistanceTo(e) <= tol && b.DistanceTo(s) <= tol;
      if (direct || reverse) return true;
    }
    return false;
  }
}
# ---------- end c_script_6 ----------
sp_4 = ScriptParasite2(Enable=Toggle(True), Path=panel_12, TargetComponent=c_script_6)
panel_13 = Panel(c_script_6.out)
