# Grasshopper definition Designer.gh (Grasshopper 1.0.8)
# plug-ins: Human UI, ScriptParasite2, Human, GraphicPlus

panel = Panel("C:\Users\Oliver\OneDrive - University of Bristol\PhD\UIST 2026 Print Place Printegrate\Designer\resources\Components\CR2032.png")
trim = TrimWithBreps()  # -> Inside, Outside
pipeline = GeometryPipeline(
    GroupByLayer=False,
    GroupByType=False,
    IncludeHidden=True,
    IncludeLocked=True,
    LayerFilter="Traces",
    NameFilter="*",
    SublayerFiltering=True,
    TypeFilter=1)
pipeline_2 = GeometryPipeline(
    GroupByLayer=False,
    GroupByType=False,
    IncludeHidden=True,
    IncludeLocked=True,
    LayerFilter="PLA",
    NameFilter="*",
    SublayerFiltering=True,
    TypeFilter=1073741848)
pipeline_3 = GeometryPipeline(
    GroupByLayer=False,
    GroupByType=False,
    IncludeHidden=True,
    IncludeLocked=True,
    LayerFilter="Part",
    NameFilter="*",
    SublayerFiltering=True,
    TypeFilter=1073741849)
pipeline_4 = GeometryPipeline(
    GroupByLayer=False,
    GroupByType=False,
    IncludeHidden=True,
    IncludeLocked=True,
    LayerFilter="Traces",
    NameFilter="*",
    SublayerFiltering=True,
    TypeFilter=4)
pipeline_5 = GeometryPipeline(
    GroupByLayer=False,
    GroupByType=False,
    IncludeHidden=True,
    IncludeLocked=True,
    LayerFilter="Default",
    NameFilter="*",
    SublayerFiltering=True,
    TypeFilter=1073741848)
pipeline_6 = GeometryPipeline(
    GroupByLayer=False,
    GroupByType=False,
    IncludeHidden=True,
    IncludeLocked=True,
    LayerFilter="Subtract",
    NameFilter="*",
    SublayerFiltering=True,
    TypeFilter=1073741848)
panel_2 = Panel("""0.5
0.75
1.0
1.25
1.5
1.75
2.0
2.25
2.5
2.75
3.0""")
line = Line(pipeline_4)
geo = Geometry(pipeline_3)
c_script = CSharpScript()  # -> out, a
# ---------- c_script: C# ----------
// Grasshopper Script Instance
#region Usings
using System;
using System.Linq;
using System.Collections;
using System.Collections.Generic;
using System.Drawing;

using Rhino;
using Rhino.Geometry;

using Grasshopper;
using Grasshopper.Kernel;
using Grasshopper.Kernel.Data;
using Grasshopper.Kernel.Types;
#endregion

public class Script_Instance : GH_ScriptInstance
{
    #region Notes
    /* 
      Members:
        RhinoDoc RhinoDocument
        GH_Document GrasshopperDocument
        IGH_Component Component
        int Iteration

      Methods (Virtual & overridable):
        Print(string text)
        Print(string format, params object[] args)
        Reflect(object obj)
        Reflect(object obj, string method_name)
    */
    #endregion

    private void RunScript(object x, object y, ref object a)
    {
        // Write your logic here
        a = null;
    }
}
# ---------- end c_script ----------
geo_2 = Geometry(pipeline_6)
number_slider = Slider(2.5, range=0..100)
pt = Point(pipeline)
layer_height = Slider(0.2, range=0..1)
panel_3 = Panel(pipeline_4)
join = BrepJoin(Breps=pipeline_5)  # -> Breps, Closed
pt_2 = Point(<point referenced from the Rhino model>)

# ----
# 2. Create UI Elements
grid = Slider(2, range=0.2..10)
pan = Panel("Grid")

# ----
# 2. Create UI Elements
layer = Slider(13, range=0..100)
label = CreateLabel(LabelText="Layer", LabelSize=12, Justification=0)

# ----
# Set the toggle to the right to "True" to launch the window.
panel_4 = Panel("Print & Place")
panel_5 = Panel("_-Insert _File \"C:\\Users\\Oliver\\OneDrive - University of Bristol\\PhD\\UIST 2026 Print Place Printegrate\\Designer\\resources\\Components\\FloraPixel.3dm\" _Enter _Group")
panel_6 = Panel("C:\Users\Oliver\OneDrive - University of Bristol\PhD\UIST 2026 Print Place Printegrate\Designer\resources\Components\florapixel.png")
panel_7 = Panel("_Import \"C:\\Users\\Oliver\\OneDrive - University of Bristol\\PhD\\UIST 2026 Print Place Printegrate\\Designer\\resources\\Components\\CR2032.3dm\"")
panel_8 = Panel("_-Insert _File \"C:\\Users\\Oliver\\OneDrive - University of Bristol\\PhD\\UIST 2026 Print Place Printegrate\\Designer\\resources\\Components\\WS2812b.3dm\" _Enter _Group")
panel_9 = Panel("C:\Users\Oliver\OneDrive - University of Bristol\PhD\UIST 2026 Print Place Printegrate\Designer\resources\Components\WS2812b.png")
panel_10 = Panel("_-Insert _File \"C:\\Users\\Oliver\\OneDrive - University of Bristol\\PhD\\UIST 2026 Print Place Printegrate\\Designer\\resources\\Components\\Xiao.3dm\" _Enter _Group")
panel_11 = Panel("_-Insert _File \"C:\\Users\\Oliver\\OneDrive - University of Bristol\\PhD\\UIST 2026 Print Place Printegrate\\Designer\\resources\\Components\\Sequin.3dm\" _Group")
panel_12 = Panel("C:\Users\Oliver\OneDrive - University of Bristol\PhD\UIST 2026 Print Place Printegrate\Designer\resources\Components\Xiao.png")
panel_13 = Panel("C:\Users\Oliver\OneDrive - University of Bristol\PhD\UIST 2026 Print Place Printegrate\Designer\Scripts")
panel_14 = Panel("C:\Users\Oliver\OneDrive - University of Bristol\PhD\UIST 2026 Print Place Printegrate\Designer\resources\Components\sequin1.png")
panel_15 = Panel("C:\Users\Oliver\OneDrive - University of Bristol\PhD\UIST 2026 Print Place Printegrate\Designer\Scripts")

# ----
# 1. Create a window
toggle = BooleanToggle(True)
launchwin = LaunchWindow(Show=toggle, Name=panel_4, Width=370, Height=400, ChildStatus=0, EnableHorizScroll=False)

# ----
# Updating a UI Element
number_slider_2 = Slider(100, range=0..100)
c_script_2 = CSharpScript(
    traceLines=line,
    plugPoints=pt,
    embedGeometry=pipeline_3,
    PrintEmbedGeometry=pipeline_2,
    plugRadius="0.95",
    plugHeight=Slider(2.8, range=0..10),
    traceWidth=Slider(2.5, range=0..10),
    traceHeight=Slider(0.2, range=0..1),
    origin=pt_2,
    layerHeight=layer_height,
    traySpacing=Slider(3, range=0..10),
    geometry=pipeline_5)  # -> out, operations, trayBrep, modelBreps, intersections, pickPlaceLines, badGeometry, reverse(traceCuts); inputs traceLines: list of Line, plugPoints: list of Point3d, embedGeometry: list of GeometryBase, PrintEmbedGeometry: list of GeometryBase, plugRadius: Double, plugHeight: Double, traceWidth: list of Double, traceHeight: Double, origin: Point3d, layerHeight: Double, traySpacing: Double, geometry: list of Brep
# ---------- c_script_2: C# ----------
// Main Pick Place Logic Script
// Handles geometry generation, positioning, intersections, and tray layout
// This one hello

using System;
using System.Linq;
using System.Collections.Generic;
using Rhino;
using Rhino.DocObjects;
using Rhino.Geometry;
using Rhino.Geometry.Intersect;
using Grasshopper.Kernel;
using Grasshopper;
using Grasshopper.Kernel.Data;

// ============================================================================
// ENUMS AND DATA STRUCTURES
// ============================================================================

/// <summary>
/// Types of tamping points based on intersection context
/// </summary>
public enum TampingType
{
    End,          // Tamping points at the ends of traces
    TraceTrace,   // Tamping points at trace-trace intersections
    TracePlug,    // Tamping points at trace-plug intersections
    TracePCB      // Tamping points at trace-PCB intersections
}

/// <summary>
/// Represents a single tamping point with position and type
/// Depth offset is managed by Python G-code generation
/// </summary>
public class TampingPoint
{
    public Point3d Position { get; set; }
    public TampingType Type { get; set; }
    public Dictionary<string, string> Overrides { get; set; }
    
    public TampingPoint(Point3d position, TampingType type)
    {
        Position = position;
        Type = type;
        Overrides = new Dictionary<string, string>();
    }

    /// <summary>
    /// Parse user text string in format "key1=value1;key2=value2" into the Overrides dictionary
    /// </summary>
    public void ParseOverridesFromUserText(string userText)
    {
        if (string.IsNullOrWhiteSpace(userText))
            return;

        var pairs = userText.Split(new[] { ';' }, System.StringSplitOptions.RemoveEmptyEntries);
        foreach (var pair in pairs)
        {
            var kv = pair.Split(new[] { '=' }, System.StringSplitOptions.RemoveEmptyEntries);
            if (kv.Length == 2)
            {
                string key = kv[0].Trim();
                string value = kv[1].Trim();
                Overrides[key] = value;
            }
        }
    }
}

/// <summary>
/// Represents a single prinjection point (PCB hole) with position and customizable parameters
/// Per-hole overrides are managed by Python G-code generation
/// </summary>
public class PrinjectionPoint
{
    public Point3d Position { get; set; }
    public Dictionary<string, string> Overrides { get; set; }
    
    public PrinjectionPoint(Point3d position)
    {
        Position = position;
        Overrides = new Dictionary<string, string>();
    }

    /// <summary>
    /// Parse user text string in format "key1=value1;key2=value2" into the Overrides dictionary
    /// Typically used for prinjection_extrude_amount, prinjection_inject_z_offset, etc.
    /// </summary>
    public void ParseOverridesFromUserText(string userText)
    {
        if (string.IsNullOrWhiteSpace(userText))
            return;

        var pairs = userText.Split(new[] { ';' }, System.StringSplitOptions.RemoveEmptyEntries);
        foreach (var pair in pairs)
        {
            var kv = pair.Split(new[] { '=' }, System.StringSplitOptions.RemoveEmptyEntries);
            if (kv.Length == 2)
            {
                string key = kv[0].Trim();
                string value = kv[1].Trim();
                Overrides[key] = value;
            }
        }
    }
}

/// <summary>
/// Represents a contact point (embedGeometry point) for trace-PCB intersections
/// Per-point overrides customize tamping behavior where traces cross PCB contact points
/// </summary>
public class ContactPoint
{
    public Point3d Position { get; set; }
    public Dictionary<string, string> Overrides { get; set; }
    
    public ContactPoint(Point3d position)
    {
        Position = position;
        Overrides = new Dictionary<string, string>();
    }

    /// <summary>
    /// Parse user text string in format "key1=value1;key2=value2" into the Overrides dictionary
    /// Typically used for depth_offset, feedrate, dwell_time for trace-PCB tamping
    /// </summary>
    public void ParseOverridesFromUserText(string userText)
    {
        if (string.IsNullOrWhiteSpace(userText))
            return;

        var pairs = userText.Split(new[] { ';' }, System.StringSplitOptions.RemoveEmptyEntries);
        foreach (var pair in pairs)
        {
            var kv = pair.Split(new[] { '=' }, System.StringSplitOptions.RemoveEmptyEntries);
            if (kv.Length == 2)
            {
                string key = kv[0].Trim();
                string value = kv[1].Trim();
                Overrides[key] = value;
            }
        }
    }
}

// ============================================================================
// ABSTRACT BASE CLASS
// ============================================================================

/// <summary>
/// Base class for all embeddable elements (traces and plugs)
/// </summary>
public abstract class Embeddable
{
    public Point3d PickPt { get; protected set; }
    public Point3d PlacePt { get; protected set; }
    public Point3d PreferredPickPoint { get; private set; }
    public bool HasPreferredPickPoint { get; private set; }
    public List<TampingPoint> TampingPts { get; protected set; }
    public double PickTemperature { get; protected set; }
    public int PauseLayer { get; protected set; }
    public double PickupExtrusionMultiplier { get; protected set; }
    public Dictionary<string, string> Overrides { get; set; }

    public abstract void CalcIntersections(List<Embeddable> allEmbeddables);
    public abstract void CalculatePickPlace(Point3d pickCentre);

    protected Embeddable()
    {
        TampingPts = new List<TampingPoint>();
        PickPt = Point3d.Unset;
        PlacePt = Point3d.Unset;
        PreferredPickPoint = Point3d.Unset;
        HasPreferredPickPoint = false;
        PickupExtrusionMultiplier = 1.0;
        Overrides = new Dictionary<string, string>();
    }

    public void SetPreferredPickPoint(Point3d point)
    {
        PreferredPickPoint = point;
        HasPreferredPickPoint = true;
    }

    /// <summary>
    /// Parse user text string in format "key1=value1;key2=value2" into the Overrides dictionary
    /// Trims whitespace around keys and values
    /// </summary>
    public void ParseOverridesFromUserText(string userText)
    {
        if (string.IsNullOrWhiteSpace(userText))
            return;

        var pairs = userText.Split(new[] { ';' }, System.StringSplitOptions.RemoveEmptyEntries);
        foreach (var pair in pairs)
        {
            var kv = pair.Split(new[] { '=' }, System.StringSplitOptions.RemoveEmptyEntries);
            if (kv.Length == 2)
            {
                string key = kv[0].Trim();
                string value = kv[1].Trim();
                Overrides[key] = value;
            }
        }
    }
}

// ============================================================================
// CONCRETE IMPLEMENTATIONS
// ============================================================================

/// <summary>
/// Represents a conductive trace element with pick/place/tamp logic
/// </summary>
public class TraceElement : Embeddable
{
    // Public properties
    public double Length { get; private set; }
    public bool IsHorizontal { get; private set; }
    public double Width { get; private set; }
    public double Height { get; private set; }
    public List<Point3d> Intersections = new List<Point3d>();
    public Line ModelLine;
    public Brep ModelBox;
    public Curve TrayCurve;
    public List<string> SafePickDebugLog { get; private set; }
    
    // Static list of contact points (populated from embedGeometry points)
    public static List<ContactPoint> ContactPoints = new List<ContactPoint>();
    
    // Private fields
    private double traceHeight;
    private double traceWidth;
    private double safeDistAlongLine;

    /// <summary>
    /// Check if a line is perpendicular (horizontal or vertical)
    /// </summary>
    public static bool IsPerpendicular(Line line, out bool isHorizontal)
    {
        Vector3d dir = line.Direction;
        dir.Unitize();
        
        double angleThreshold = 0.01; // ~0.57 degrees tolerance
        isHorizontal = Math.Abs(dir.Y) < angleThreshold;
        bool isVertical = Math.Abs(dir.X) < angleThreshold;
        
        return isHorizontal || isVertical;
    }
    
    /// <summary>
    /// Create an extruded box from a line (for bad geometry visualization)
    /// </summary>
    public static Brep CreateBadGeometryBox(Line line, double width, double height, double endOffset)
    {
        Vector3d dir = line.Direction;
        dir.Unitize();
        double endExtension = width / 2.0 + endOffset;
        Point3d extendedFrom = line.From - dir * endExtension;
        Point3d extendedTo = line.To + dir * endExtension;
        Line extendedLine = new Line(extendedFrom, extendedTo);
        
        Vector3d perp = Vector3d.CrossProduct(extendedLine.Direction, Vector3d.ZAxis);
        perp.Unitize();
        perp *= width / 2.0;
        
        Point3d[] corners = new Point3d[4];
        corners[0] = extendedLine.From + perp;
        corners[1] = extendedLine.To + perp;
        corners[2] = extendedLine.To - perp;
        corners[3] = extendedLine.From - perp;
        
        Polyline poly = new Polyline(corners);
        poly.Add(corners[0]);
        Curve crv = poly.ToNurbsCurve();
        
        if (crv.ClosedCurveOrientation(Vector3d.ZAxis) == CurveOrientation.Clockwise)
            crv.Reverse();
        
        return Extrusion.Create(crv, height, true).ToBrep();
    }

    public TraceElement(Line line, double width, double height, double layerHeight, double endOffset)
    {
        this.SafePickDebugLog = new List<string>();
        // Check if line is perpendicular (horizontal or vertical) BEFORE any processing
        Vector3d dir = line.Direction;
        dir.Unitize();
        
        double angleThreshold = 0.01; // ~0.57 degrees tolerance
        bool isHorizontal = Math.Abs(dir.Y) < angleThreshold;
        bool isVertical = Math.Abs(dir.X) < angleThreshold;
        
        if (!isHorizontal && !isVertical)
        {
            throw new Exception("TraceElement constructor called with non-perpendicular line. Use IsPerpendicular() to check first.");
        }
        
        // Extend by half trace width plus extra side offset on each end.
        double endExtension = width / 2.0 + endOffset;
        Point3d extendedFrom = line.From - dir * endExtension;
        Point3d extendedTo = line.To + dir * endExtension;
        Line extendedLine = new Line(extendedFrom, extendedTo);
        
        this.ModelLine = extendedLine;
        this.Length = extendedLine.Length;
        this.Height = height;
        this.Width = width;
        this.traceHeight = height;
        this.traceWidth = width;
        this.IsHorizontal = isHorizontal;
        this.PauseLayer = (int)Math.Round(extendedLine.FromZ / layerHeight) + 1;
        this.ModelBox = CreateBoxFromLine(extendedLine, width, height);
        this.PickTemperature = 210;
        
        // Add tamping points, ensuring they are at least 1.0mm away from the extreme ends
        double tampInset = Math.Max(1.0 - endExtension, 0.0);
        if (line.Length >= Math.Max(width, tampInset * 2.0))
        {
            Point3d startTamp = line.From + dir * tampInset;
            Point3d endTamp = line.To - dir * tampInset;
            this.TampingPts.Add(new TampingPoint(startTamp, TampingType.End));
            this.TampingPts.Add(new TampingPoint(endTamp, TampingType.End));
        }
    }

    public override void CalcIntersections(List<Embeddable> allEmbeddables)
    {
        // Find embeddables one layer below this trace or on the same layer
        double targetZ = Math.Round(this.ModelLine.FromZ - this.traceHeight, 4);
        double thisZ = Math.Round(this.ModelLine.FromZ, 4);
        int thisIndex = allEmbeddables.IndexOf(this);
        
        foreach (var embeddable in allEmbeddables)
        {
            // Check Trace-Trace intersections
            if (embeddable is TraceElement otherTrace && embeddable != this)
            {
                double otherZ = Math.Round(otherTrace.ModelLine.FromZ, 4);
                bool isLayerBelow = Math.Abs(otherZ - targetZ) < 0.001;
                bool isSameLayer = Math.Abs(otherZ - thisZ) < 0.001;

                // For same layer intersections, only tamp if the other trace was placed BEFORE this one
                if (isLayerBelow || (isSameLayer && allEmbeddables.IndexOf(otherTrace) < thisIndex))
                {
                    Point3d intersectPt;
                    if (TryGetIntersection(this.ModelLine, otherTrace.ModelLine, this.traceWidth, out intersectPt))
                    {
                        // Use the appropriate Z level for Intersections list
                        double intersectZ = isSameLayer ? thisZ : targetZ;
                        Point3d correctedPt = new Point3d(intersectPt.X, intersectPt.Y, intersectZ);
                        this.Intersections.Add(correctedPt);
                        
                        // Add to tamping points at this line's Z height
                        Point3d tampPt = new Point3d(intersectPt.X, intersectPt.Y, this.ModelLine.FromZ);
                        this.TampingPts.Add(new TampingPoint(tampPt, TampingType.TraceTrace));
                    }
                }
            }
            // Check Trace-Plug intersections
            else if (embeddable is Plug plug)
            {
                double plugZ = Math.Round(plug.PlacePt.Z, 4);
                if (Math.Abs(plugZ - targetZ) < 0.001)
                {
                    // Check if trace line passes through plug location (2D check at Z level)
                    Point3d plug2D = new Point3d(plug.PlacePt.X, plug.PlacePt.Y, 0);
                    Line trace2D = new Line(
                        new Point3d(this.ModelLine.FromX, this.ModelLine.FromY, 0),
                        new Point3d(this.ModelLine.ToX, this.ModelLine.ToY, 0)
                    );
                    
                    double t = trace2D.ClosestParameter(plug2D);
                    if (t >= -0.01 && t <= 1.01)
                    {
                        Point3d closestPt = trace2D.PointAt(t);
                        double dist = closestPt.DistanceTo(plug2D);
                        
                        // If trace passes within width/2 of plug center, it intersects
                        if (dist < this.traceWidth / 2.0 + 0.001)
                        {
                            // Add intersection at the plug's Z level
                            Point3d intersectPt = new Point3d(closestPt.X, closestPt.Y, plug.PlacePt.Z);
                            this.Intersections.Add(intersectPt);
                            
                            // Add to tamping points at this line's Z height
                            Point3d tampPt = new Point3d(closestPt.X, closestPt.Y, this.ModelLine.FromZ);
                            this.TampingPts.Add(new TampingPoint(tampPt, TampingType.TracePlug));
                        }
                    }
                }
            }
        }
        
        // Check Trace-ContactPoint intersections
        double traceTopZ = this.ModelLine.FromZ;
        double traceBottomZ = this.ModelLine.FromZ - this.traceHeight - 0.01;
        
        foreach (ContactPoint contactPt in ContactPoints)
        {
            Point3d contactPos = contactPt.Position;
            // Check if contact point Z is within the trace's vertical range
            if (contactPos.Z <= traceTopZ && contactPos.Z >= traceBottomZ)
            {
                // Check if contact point is on/near the trace line (2D check)
                Point3d contact2D = new Point3d(contactPos.X, contactPos.Y, 0);
                Line trace2D = new Line(
                    new Point3d(this.ModelLine.FromX, this.ModelLine.FromY, 0),
                    new Point3d(this.ModelLine.ToX, this.ModelLine.ToY, 0)
                );
                
                double t = trace2D.ClosestParameter(contact2D);
                if (t >= -0.01 && t <= 1.01)
                {
                    Point3d closestPt = trace2D.PointAt(t);
                    double dist = closestPt.DistanceTo(contact2D);
                    
                    // If contact point is within trace width
                    if (dist < this.traceWidth / 2.0 + 0.001)
                    {
                        // Add intersection at the contact point's Z level
                        this.Intersections.Add(contactPos);
                        
                        // Add tamping point at this trace's Z height
                        Point3d tampPt = new Point3d(contactPos.X, contactPos.Y, this.ModelLine.FromZ);
                        TampingPoint tp = new TampingPoint(tampPt, TampingType.TracePCB);
                        // Copy contact point overrides to tamping point
                        if (contactPt.Overrides != null)
                        {
                            foreach (var kvp in contactPt.Overrides)
                            {
                                tp.Overrides[kvp.Key] = kvp.Value;
                            }
                        }
                        this.TampingPts.Add(tp);
                    }
                }
            }
        }
        
        // Remove end tamping points that are within 3mm of any intersection tamping point
        var intersectionTamps = this.TampingPts.Where(t => t.Type != TampingType.End).ToList();
        this.TampingPts.RemoveAll(t => 
            t.Type == TampingType.End && 
            intersectionTamps.Any(ip => t.Position.DistanceTo(ip.Position) <= 3.0)
        );
    }

    public void CalculateSafePickDistance(List<Brep> partGeometry = null)
    {
        SafePickDebugLog.Clear();

        double L = this.Length;
        double mid = L / 2.0;
        
        // Convert 3D intersection points to 1D distances along the line
        List<double> intersectDistances = Intersections.Select(pt => ModelLine.From.DistanceTo(pt)).ToList();

        // 1. Generate a discrete set of candidates radiating outward from the midpoint
        HashSet<double> candidateSet = new HashSet<double>();
        candidateSet.Add(mid);
        
        double step = 0.5; // 0.5mm physical increments
        int steps = (int)((L / step) / 2.0) + 1;
        for (int i = 1; i <= steps; i++)
        {
            candidateSet.Add(Math.Round(mid + i * step, 4));
            candidateSet.Add(Math.Round(mid - i * step, 4));
        }

        // Add exact boundaries of intersection danger zones (to hug the clearances tightly if needed)
        foreach (double d in intersectDistances)
        {
            candidateSet.Add(Math.Round(d - this.Width/2, 4));
            candidateSet.Add(Math.Round(d + this.Width/2, 4));
        }

        // Filter out-of-bounds and sort by proximity to trace center
        var validCandidates = candidateSet
            .Where(c => c >= 0 && c <= L)
            .OrderBy(c => Math.Abs(c - mid))
            .ToList();

        double bestDistAlong = -1;

        // 2. Test candidates sequentially
        foreach (double current in validCandidates)
        {
            // Cheap Check: Is it in the "Danger Zone" of any intersection?
            bool inDanger = intersectDistances.Any(d => current > d - this.Width/2 + 0.001 && current < d + this.Width/2 - 0.001);
            if (inDanger) 
            {
                continue;
            }

            // Expensive Check: Part Geometry Bounds
            if (partGeometry != null && partGeometry.Count > 0)
            {
                Vector3d dir = ModelLine.Direction;
                dir.Unitize();
                Point3d candidatePt = ModelLine.From + (dir * current);
                
                // Check just below the bottom of the trace for solid material
                Point3d checkPt = new Point3d(candidatePt.X, candidatePt.Y, candidatePt.Z - this.traceHeight - 0.05);
                
                // Only enforce if we're above the build plate
                if (checkPt.Z > 0)
                {
                    double minInsetDistance = 0.6; // Matches original threshold
                    bool sufficientlyInside = false;

                    foreach (Brep brep in partGeometry)
                    {
                        if (brep == null) continue;
                        if (!brep.IsSolid) continue;
                        if (!brep.IsPointInside(checkPt, 0.001, false)) continue;
                        
                        // To avoid being tricked by short Z-distances to thin floors/ceilings,
                        // we directly verify an XY perimeter ring at the exact same Z height.
                        bool allInside = true;
                        int numTests = 6;
                        for (int i = 0; i < numTests; i++)
                        {
                            double angle = (2.0 * Math.PI / numTests) * i;
                            Point3d p = new Point3d(
                                checkPt.X + minInsetDistance * Math.Cos(angle),
                                checkPt.Y + minInsetDistance * Math.Sin(angle),
                                checkPt.Z
                            );
                            
                            if (!brep.IsPointInside(p, 0.001, false))
                            {
                                allInside = false;
                                break;
                            }
                        }
                        
                        if (allInside)
                        {
                            sufficientlyInside = true;
                            break; 
                        }
                    }
                    
                    if (!sufficientlyInside)
                    {
                        continue; // Fails geometry test, try next sample
                    }
                }
            }
            
            // If it passed both intersection and geometry checks, it's our best safe point
            bestDistAlong = current;
            break;
        }

        if (bestDistAlong == -1)
        {
            throw new Exception($"No safe pick spot found for trace at Z={ModelLine.FromZ}");
        }

        this.safeDistAlongLine = bestDistAlong;
    }

    public void SetSafePickDistanceToMidpoint()
    {
        this.safeDistAlongLine = this.Length / 2.0;
        SafePickDebugLog.Add($"Fallback: forced midpoint d={this.safeDistAlongLine:F3}");
    }

    public override void CalculatePickPlace(Point3d pickCentre)
    {
        if (this.TrayCurve == null)
            throw new Exception("TrayCurve must be set before calling CalculatePickPlace");

        if (this.HasPreferredPickPoint)
        {
            Vector3d projectedDir = ModelLine.Direction;
            projectedDir.Unitize();
            double projectedDist = Vector3d.Multiply(this.PreferredPickPoint - ModelLine.From, projectedDir);
            safeDistAlongLine = Math.Max(0.0, Math.Min(this.Length, projectedDist));
        }

        Vector3d dir = ModelLine.Direction;
        dir.Unitize();
        
        // Determine original line direction (positive or negative axis)
        bool pointsLeft = dir.X < -0.5; // Horizontal pointing negative X
        bool pointsDown = dir.Y < -0.5; // Vertical pointing negative Y
        
        // Check orientation by comparing dimensions of the tray slot
        BoundingBox bbox = this.TrayCurve.GetBoundingBox(true);
        double rectWidth = bbox.Max.X - bbox.Min.X;
        double rectHeight = bbox.Max.Y - bbox.Min.Y;
        bool horizontalInTray = rectWidth > rectHeight;
        
        // If the model line was drawn "backwards" (right-to-left or top-to-bottom),
        // we must flip the mapping inside the left-to-right/bottom-to-top tray cutout.
        double remappedDist = safeDistAlongLine;
        if ((horizontalInTray && pointsLeft) || (!horizontalInTray && pointsDown))
        {
            remappedDist = this.Length - safeDistAlongLine;
        }
        
        Point3d pickPt;
        if (horizontalInTray)
            pickPt = new Point3d(bbox.Min.X + remappedDist, pickCentre.Y, this.Height);
        else
            pickPt = new Point3d(pickCentre.X, bbox.Min.Y + remappedDist, this.Height);

        // Place point is calculated by moving along the ModelLine direction
        Point3d placePt = this.HasPreferredPickPoint ? this.PreferredPickPoint : ModelLine.From + (dir * safeDistAlongLine);

        this.PickPt = pickPt;
        this.PlacePt = placePt;
    }

    private static bool TryGetIntersection(Line top, Line bottom, double width, out Point3d result)
    {
        result = Point3d.Unset;
        Line t2 = new Line(new Point3d(top.FromX, top.FromY, 0), new Point3d(top.ToX, top.ToY, 0));
        Line b2 = new Line(new Point3d(bottom.FromX, bottom.FromY, 0), new Point3d(bottom.ToX, bottom.ToY, 0));

        double a, b;
        if (Intersection.LineLine(t2, b2, out a, out b))
        {
            if (t2.PointAt(a).DistanceTo(b2.PointAt(b)) < 0.01 && a >= -0.01 && a <= 1.01 && b >= -0.01 && b <= 1.01)
            {
                result = top.PointAt(a);
                return true;
            }
        }
        
        // Co-linear check (parallel traces on the same line)
        if (t2.DistanceTo(b2.From, true) < 0.01 && t2.DistanceTo(b2.To, true) < 0.01)
        {
            double tS = t2.ClosestParameter(b2.From);
            double tE = t2.ClosestParameter(b2.To);
            double oMin = Math.Max(0, Math.Min(tS, tE));
            double oMax = Math.Min(1, Math.Max(tS, tE));
            if (oMax - oMin > 0.01)
            {
                result = top.PointAt((oMin + oMax) / 2.0);
                return true;
            }
        }
        
        // Parallel traces check (traces that are parallel and cross over each other)
        Vector3d t2Dir = t2.Direction;
        Vector3d b2Dir = b2.Direction;
        t2Dir.Unitize();
        b2Dir.Unitize();
        
        // Check if lines are parallel (dot product close to 1 or -1)
        double dotProduct = Math.Abs(Vector3d.Multiply(t2Dir, b2Dir));
        if (dotProduct > 0.99) // Lines are parallel
        {
            // Check if traces overlap along their length
            // Project bottom line endpoints onto top line
            double t2_b2From = t2.ClosestParameter(b2.From);
            double t2_b2To = t2.ClosestParameter(b2.To);
            
            // Find overlap region
            double overlapMin = Math.Max(0, Math.Min(t2_b2From, t2_b2To));
            double overlapMax = Math.Min(1, Math.Max(t2_b2From, t2_b2To));
            
            if (overlapMax > overlapMin) // There is some overlap
            {
                // Check if traces are close enough (within width distance)
                Point3d overlapCenter = t2.PointAt((overlapMin + overlapMax) / 2.0);
                double distanceBetweenTraces = b2.DistanceTo(overlapCenter, true);
                
                if (distanceBetweenTraces < width + 0.01)
                {
                    result = top.PointAt((overlapMin + overlapMax) / 2.0);
                    return true;
                }
            }
        }
        
        return false;
    }

    private Brep CreateBoxFromLine(Line l, double w, double h)
    {
        Vector3d side = Vector3d.CrossProduct(l.Direction / l.Length, Vector3d.ZAxis) * (w / 2.0);
        Polyline p = new Polyline { l.From + side, l.From - side, l.To - side, l.To + side, l.From + side };
        Curve crv = p.ToNurbsCurve();
        if (crv.ClosedCurveOrientation(Vector3d.ZAxis) == CurveOrientation.Clockwise)
            crv.Reverse();
        return Extrusion.Create(crv, -h, true).ToBrep();
    }
}

/// <summary>
/// Represents a plug/connector element with pick/place logic (no tamping)
/// </summary>
public class Plug : Embeddable
{
    public List<Point3d> Intersections = new List<Point3d>();
    public double Radius { get; private set; }
    public double Height { get; private set; }
    private Point3d nominalPlacePoint;

    public Plug(Point3d centerPt, double radius, double plugHeight, double plateHeight, double layerHeight)
    {
        this.Radius = radius;
        this.Height = plugHeight;
        this.PlacePt = centerPt;
        this.nominalPlacePoint = centerPt;
        this.PickTemperature = 100;
        this.PauseLayer = (int)Math.Round(centerPt.Z / layerHeight) + 1;
        // Note: Plugs have no tamping points (TampingPts remains empty)
    }

    public override void CalcIntersections(List<Embeddable> allEmbeddables)
    {
        // Check if plug's base intersects with traces or other plugs
        double baseZ = Math.Round(this.PlacePt.Z - this.Height, 4);
        Point3d plug2D = new Point3d(this.PlacePt.X, this.PlacePt.Y, 0);
        
        foreach (var embeddable in allEmbeddables)
        {
            if (embeddable == this) continue;
            
            // Check Plug-Trace intersections
            if (embeddable is TraceElement trace)
            {
                double traceZ = Math.Round(trace.ModelLine.FromZ, 4);
                if (Math.Abs(traceZ - baseZ) < 0.001)
                {
                    Line trace2D = new Line(
                        new Point3d(trace.ModelLine.FromX, trace.ModelLine.FromY, 0),
                        new Point3d(trace.ModelLine.ToX, trace.ModelLine.ToY, 0)
                    );
                    
                    double t = trace2D.ClosestParameter(plug2D);
                    if (t >= -0.01 && t <= 1.01)
                    {
                        Point3d closestPt = trace2D.PointAt(t);
                        double dist = closestPt.DistanceTo(plug2D);
                        
                        if (dist < this.Radius + 0.001)
                        {
                            Point3d intersectPt = new Point3d(this.PlacePt.X, this.PlacePt.Y, baseZ);
                            this.Intersections.Add(intersectPt);
                        }
                    }
                }
            }
            // Check Plug-Plug intersections
            else if (embeddable is Plug otherPlug)
            {
                double otherZ = Math.Round(otherPlug.PlacePt.Z, 4);
                if (Math.Abs(otherZ - baseZ) < 0.001)
                {
                    Point3d other2D = new Point3d(otherPlug.PlacePt.X, otherPlug.PlacePt.Y, 0);
                    double dist = plug2D.DistanceTo(other2D);
                    
                    if (dist < this.Radius + otherPlug.Radius + 0.001)
                    {
                        Point3d intersectPt = new Point3d(this.PlacePt.X, this.PlacePt.Y, baseZ);
                        this.Intersections.Add(intersectPt);
                    }
                }
            }
        }
    }

    public override void CalculatePickPlace(Point3d pickCentre)
    {
        if (this.HasPreferredPickPoint)
        {
            Vector3d delta = this.PreferredPickPoint - this.nominalPlacePoint;
            this.PickPt = new Point3d(pickCentre.X + delta.X, pickCentre.Y + delta.Y, this.Height + delta.Z);
            this.PlacePt = this.PreferredPickPoint;
            return;
        }

        // Pick point is at the center of the cutout at the plug height
        this.PickPt = new Point3d(pickCentre.X, pickCentre.Y, this.Height);
        // Place point is already set in constructor
    }
}

/// <summary>
/// Represents a PCB or arbitrary embedded geometry with pick/place logic
/// </summary>
public class PCB : Embeddable
{
    public Brep Geometry { get; private set; }
    public BoundingBox BBox { get; private set; }
    public double TrayOffset { get; private set; }
    public List<PrinjectionPoint> PrinjectionPoints { get; set; }
    private Point3d nominalPlacePoint;
    
    public PCB(Brep geometry, double trayOffset, double layerHeight)
    {
        if (geometry == null)
            throw new Exception("PCB requires a Brep.");
        
        this.Geometry = geometry;
        this.TrayOffset = trayOffset;
        this.PrinjectionPoints = new List<PrinjectionPoint>();
        
        // Calculate bounding box
        this.BBox = geometry.GetBoundingBox(true);
        
        // Calculate pickup extrusion multiplier based on bounding box volume
        double bboxVolume = (this.BBox.Max.X - this.BBox.Min.X) 
                          * (this.BBox.Max.Y - this.BBox.Min.Y) 
                          * (this.BBox.Max.Z - this.BBox.Min.Z);
        if (bboxVolume > 100.0)
            this.PickupExtrusionMultiplier = bboxVolume / 500.0;
        
        // Place point is the center of the top surface of the bounding box
        Point3d bboxCenter = this.BBox.Center;
        this.PlacePt = new Point3d(bboxCenter.X, bboxCenter.Y, this.BBox.Max.Z);
        this.nominalPlacePoint = this.PlacePt;
        
        this.PauseLayer = (int)Math.Round(this.BBox.Max.Z / layerHeight) + 1;
        this.PickTemperature = 0; // No heating for PCBs
    }
    
    public override void CalcIntersections(List<Embeddable> allEmbeddables)
    {
        // PCBs don't calculate intersections with other embeddables
        // They are placed independently
    }
    
    public override void CalculatePickPlace(Point3d pickCentre)
    {
        double nominalPickZ = this.BBox.Max.Z - this.BBox.Min.Z + 1.0;

        if (this.HasPreferredPickPoint)
        {
            Vector3d delta = this.PreferredPickPoint - this.nominalPlacePoint;
            this.PickPt = new Point3d(pickCentre.X + delta.X, pickCentre.Y + delta.Y, nominalPickZ + delta.Z);
            this.PlacePt = this.PreferredPickPoint;
            return;
        }

        // Pick point is at the center of the tray cutout at the correct height
        this.PickPt = new Point3d(pickCentre.X, pickCentre.Y, nominalPickZ);
        // Place point is already set in constructor
    }
}

/// <summary>
/// Represents printed embedded geometry with PCB-like pick/place mapping.
/// Thermal behavior differences are handled in Python toolpath generation.
/// </summary>
public class Print : PCB
{
    public Print(Brep geometry, double trayOffset, double layerHeight)
        : base(geometry, trayOffset, layerHeight)
    {
    }
}

// ============================================================================
// TRAY LAYOUT HELPER
// ============================================================================

/// <summary>
/// Manages tray layout and cutout generation for embeddables
/// </summary>
public class Tray
{
    public Brep TrayBrep { get; private set; }
    public List<Line> PickPlaceLines { get; private set; }
    private List<Curve> cutoutCurves;
    private List<List<Curve>> hColumns;
    private List<List<Curve>> vColumns;
    private List<Curve> plugCutoutCurves;
    private List<List<Curve>> pcbColumns;
    
    public Tray(List<Embeddable> allEmbeddables, Point3d origin, double spacing)
    {
        cutoutCurves = new List<Curve>();
        hColumns = new List<List<Curve>>();
        vColumns = new List<List<Curve>>();
        plugCutoutCurves = new List<Curve>();
        pcbColumns = new List<List<Curve>>();
        PickPlaceLines = new List<Line>();
        
        // Toggle this flag to turn on/off the extra widenings at the trace pick points
        bool enablePickClearanceCutouts = false;
        
        // Separate traces, plugs, and PCBs
        List<TraceElement> allTraces = allEmbeddables.OfType<TraceElement>().ToList();
        List<Plug> allPlugs = allEmbeddables.OfType<Plug>().ToList();
        List<PCB> allPCBs = allEmbeddables.OfType<PCB>().ToList();
        
        // Group traces by orientation, width, and height
        var hTraceGroups = allTraces
            .Where(t => t.IsHorizontal)
            .GroupBy(t => new { t.Width, t.Height })
            .OrderBy(g => g.Key.Width).ThenBy(g => g.Key.Height)
            .ToList();
            
        var vTraceGroups = allTraces
            .Where(t => !t.IsHorizontal)
            .GroupBy(t => new { t.Width, t.Height })
            .OrderBy(g => g.Key.Width).ThenBy(g => g.Key.Height)
            .ToList();
        
        // Group plugs by radius and height
        var plugGroups = allPlugs
            .GroupBy(p => new { p.Radius, p.Height })
            .OrderBy(g => g.Key.Radius).ThenBy(g => g.Key.Height)
            .ToList();
        
        // Calculate dimensions for horizontal traces
        double maxHLength = 0;
        double hTracesHeight = 0;
        foreach (var group in hTraceGroups)
        {
            double groupMaxLength = group.Max(t => t.Length);
            if (groupMaxLength > maxHLength) maxHLength = groupMaxLength;
            hTracesHeight += group.Count() * (group.First().Width + spacing);
        }
        
        // Calculate dimensions for vertical traces
        double maxVLength = 0;
        double vTracesWidth = 0;
        foreach (var group in vTraceGroups)
        {
            double groupMaxLength = group.Max(t => t.Length);
            if (groupMaxLength > maxVLength) maxVLength = groupMaxLength;
            vTracesWidth += group.Count() * (group.First().Width + spacing);
        }
        
        // Calculate plug area dimensions
        double plugAreaWidth = 0;
        if (allPlugs.Count > 0)
        {
            foreach (var plugGroup in plugGroups)
            {
                double plugRadius = plugGroup.First().Radius;
                double plugDiameter = plugRadius * 2.0;
                plugAreaWidth = Math.Max(plugAreaWidth, plugDiameter + spacing);
            }
        }
        
        // Maximum tray height before wrapping to a new column
        double maxTrayHeight = 110;
        
        // Track the right edge of each section for positioning the next section
        double hSectionRightEdge = origin.X;
        
        // Layout horizontal traces with column wrapping
        double currentY = origin.Y + spacing;
        double hColumnX = origin.X + spacing;
        double hColumnMaxLength = 0; // Track max trace length in current column
        double hSectionRequiredHeight = spacing * 2;
        int hColumnCount = 0;
        
        List<Curve> currentHCol = new List<Curve>();

        foreach (var group in hTraceGroups)
        {
            double groupWidth = group.First().Width;
            
            foreach (var trace in group)
            {
                // Start first column or wrap to new column if exceeding max height
                if (hColumnCount == 0)
                {
                    hColumnCount = 1;
                }
                else if (currentY + groupWidth + spacing - origin.Y > maxTrayHeight)
                {
                    // Save previous column
                    if (currentHCol.Count > 0) hColumns.Add(new List<Curve>(currentHCol));
                    currentHCol.Clear();

                    // Advance X by the max trace length in the column we just finished
                    hColumnX += hColumnMaxLength + spacing;
                    hColumnMaxLength = 0;
                    currentY = origin.Y + spacing;
                    hColumnCount++;
                }
                
                // Track the widest (longest) trace in this column
                if (trace.Length > hColumnMaxLength)
                    hColumnMaxLength = trace.Length;
                
                Point3d start = new Point3d(hColumnX, currentY, 0);
                double rW = trace.Length;
                double rH = groupWidth;
                trace.TrayCurve = new Rectangle3d(new Plane(start, Vector3d.ZAxis), rW, rH).ToNurbsCurve();
                
                Point3d cutoutCentre = new Point3d(start.X + rW / 2.0, start.Y + rH / 2.0, 0);
                
                // Calculate pick/place first so we can center the inner rectangle on the pick point
                trace.CalculatePickPlace(cutoutCentre);
                
                currentHCol.Add(trace.TrayCurve);
                
                if (enablePickClearanceCutouts)
                {
                    // Create wider rectangle cutout centered on pick point
                    double innerRectWidth = 5;
                    double innerRectHeight = groupWidth +spacing*0.8;
                    // Center on pick point X, cutout centre Y
                    Point3d innerStart = new Point3d(trace.PickPt.X - innerRectWidth / 2.0, cutoutCentre.Y - innerRectHeight / 2.0, 0);
                    Rectangle3d innerRect = new Rectangle3d(new Plane(innerStart, Vector3d.ZAxis), innerRectWidth, innerRectHeight);
                    Curve innerCurve = innerRect.ToNurbsCurve();
                    
                    // Merge rectangle and inner rectangle into a single cutout
                    Curve[] unionCurves = Curve.CreateBooleanUnion(new Curve[] { trace.TrayCurve, innerCurve }, 0.001);
                    if (unionCurves != null && unionCurves.Length > 0)
                    {
                        cutoutCurves.Add(unionCurves[0]);
                    }
                    else
                    {
                        // Fallback: add both separately if union fails
                        cutoutCurves.Add(trace.TrayCurve);
                        cutoutCurves.Add(innerCurve);
                    }
                }
                else
                {
                    cutoutCurves.Add(trace.TrayCurve);
                }
                
                PickPlaceLines.Add(new Line(trace.PickPt, trace.PlacePt));
                
                currentY += groupWidth + spacing;

                // Track max occupied height across all wrapped horizontal-trace columns.
                double requiredHeight = currentY + spacing - origin.Y;
                if (requiredHeight > hSectionRequiredHeight)
                    hSectionRequiredHeight = requiredHeight;
            }
        }
        
        if (currentHCol.Count > 0) hColumns.Add(currentHCol);
        
        // Calculate the right edge of horizontal trace section using the last column's actual max length
        if (hColumnCount > 0)
            hSectionRightEdge = hColumnX + hColumnMaxLength;
        
        // Layout vertical traces (each trace is its own column, no Y-stacking to wrap)
        double currentX = hSectionRightEdge + spacing;
        foreach (var group in vTraceGroups)
        {
            double groupWidth = group.First().Width;
            
            foreach (var trace in group)
            {
                List<Curve> currentVCol = new List<Curve>();
                Point3d start = new Point3d(currentX, origin.Y + spacing, 0);
                double rW = groupWidth;
                double rH = trace.Length;
                trace.TrayCurve = new Rectangle3d(new Plane(start, Vector3d.ZAxis), rW, rH).ToNurbsCurve();
                
                Point3d cutoutCentre = new Point3d(start.X + rW / 2.0, start.Y + rH / 2.0, 0);
                
                // Calculate pick/place first so we can center the inner rectangle on the pick point
                trace.CalculatePickPlace(cutoutCentre);
                
                currentVCol.Add(trace.TrayCurve);
                
                if (enablePickClearanceCutouts)
                {
                    // Create wider rectangle cutout centered on pick point
                    double innerRectWidth = groupWidth+spacing*0.8;
                    double innerRectHeight = 5;
                    // Center on cutout centre X, pick point Y
                    Point3d innerStart = new Point3d(cutoutCentre.X - innerRectWidth / 2.0, trace.PickPt.Y - innerRectHeight / 2.0, 0);
                    Rectangle3d innerRect = new Rectangle3d(new Plane(innerStart, Vector3d.ZAxis), innerRectWidth, innerRectHeight);
                    Curve innerCurve = innerRect.ToNurbsCurve();
                    
                    // Merge rectangle and inner rectangle into a single cutout
                    Curve[] unionCurves = Curve.CreateBooleanUnion(new Curve[] { trace.TrayCurve, innerCurve }, 0.001);
                    if (unionCurves != null && unionCurves.Length > 0)
                    {
                        cutoutCurves.Add(unionCurves[0]);
                    }
                    else
                    {
                        // Fallback: add both separately if union fails
                        cutoutCurves.Add(trace.TrayCurve);
                        cutoutCurves.Add(innerCurve);
                    }
                }
                else
                {
                    cutoutCurves.Add(trace.TrayCurve);
                }
                
                PickPlaceLines.Add(new Line(trace.PickPt, trace.PlacePt));
                
                vColumns.Add(currentVCol);
                currentX += groupWidth + spacing;
            }
        }
        
        // Right edge after vertical traces
        double vSectionRightEdge = currentX;
        
        // Ensure there is a minimum distance between the furthest right trace pick point and the plugs
        double maxTracePickX = origin.X;
        if (allTraces.Count > 0)
        {
            maxTracePickX = allTraces.Max(t => t.PickPt.X);
        }
        
        double minPickToPlugClearance = 15.0; // Minimum clearance string. Adjust if necessary.
        if (vSectionRightEdge < maxTracePickX + minPickToPlugClearance)
        {
            vSectionRightEdge = maxTracePickX + minPickToPlugClearance;
        }
        
        // Place plugs to the right of traces, trying to maintain a 3:1 (width:height) aspect ratio.
        int plugColumnCount = 0;
        double plugSectionRightEdge = vSectionRightEdge;
        double plugSectionRequiredWidth = 0;
        double plugSectionRequiredHeight = 0;
        if (allPlugs.Count > 0)
        {
            int totalPlugs = allPlugs.Count;
            // 3:1 aspect ratio roughly means 3 times as many columns as rows
            int targetCols = (int)Math.Max(1, Math.Round(Math.Sqrt(totalPlugs * 3.0)));
            plugColumnCount = targetCols;

            double currentPlugX = vSectionRightEdge;
            double currentPlugY = origin.Y + spacing;
            int currentColumn = 0;
            double maxPlugX = vSectionRightEdge;
            
            foreach (var plugGroup in plugGroups)
            {
                double plugRadius = plugGroup.First().Radius;
                double plugSpacing = plugRadius * 2.0 + spacing;
                
                foreach (var plug in plugGroup)
                {
                    // Wrap to new row if exceeding target columns
                    if (currentColumn >= targetCols)
                    {
                        currentPlugX = vSectionRightEdge;
                        currentPlugY += plugSpacing;
                        currentColumn = 0;
                    }
                    
                    double x = currentPlugX + plugRadius;
                    double y = currentPlugY + plugRadius;
                    
                    Circle plugCircle = new Circle(new Plane(new Point3d(x, y, 0), Vector3d.ZAxis), plugRadius + 0.25);
                    var plugCurve = plugCircle.ToNurbsCurve();
                    cutoutCurves.Add(plugCurve);
                    plugCutoutCurves.Add(plugCurve);
                    
                    Point3d cutoutCentre = new Point3d(x, y, 0);
                    plug.CalculatePickPlace(cutoutCentre);
                    PickPlaceLines.Add(new Line(plug.PickPt, plug.PlacePt));
                    
                    currentPlugX += plugSpacing;
                    currentColumn++;

                    if (currentPlugX > maxPlugX)
                        maxPlugX = currentPlugX;

                    // Track tray requirements from actual placed plugs.
                    double requiredWidth = maxPlugX - origin.X;
                    if (requiredWidth > plugSectionRequiredWidth)
                        plugSectionRequiredWidth = requiredWidth;

                    double requiredHeight = currentPlugY + plugSpacing - origin.Y;
                    if (requiredHeight > plugSectionRequiredHeight)
                        plugSectionRequiredHeight = requiredHeight;
                }
            }
            
            plugSectionRightEdge = maxPlugX;
        }
        
        // Layout PCBs with column wrapping, storing positions for later use
        List<Point3d> pcbTrayPositions = new List<Point3d>();
        List<double> pcbTrayRotations = new List<double>();
        double pcbColumnX = plugSectionRightEdge + spacing;
        double pcbStartY = origin.Y + spacing;
        double pcbColumnMaxWidth = 0;
        double trayWidth = 0;
        double trayHeight = Math.Max(maxVLength + spacing * 2, spacing * 2);

        // Track actual column heights for tray height calculation
        double maxActualColumnHeight = hSectionRequiredHeight; // from h-traces

        List<Curve> currentPcbCol = new List<Curve>();

        foreach (var pcb in allPCBs)
        {
            // Parse tray offset/rotation overrides
            double offsetX = 0.0;
            double offsetY = 0.0;
            double rotationDeg = 0.0;

            if (pcb.Overrides.ContainsKey("tray_x") && double.TryParse(pcb.Overrides["tray_x"], out double tx))
                offsetX = tx;
            if (pcb.Overrides.ContainsKey("tray_y") && double.TryParse(pcb.Overrides["tray_y"], out double ty))
                offsetY = ty;
            if (pcb.Overrides.ContainsKey("tray_rotation") && double.TryParse(pcb.Overrides["tray_rotation"], out double tr))
                rotationDeg = tr;

            // Calculate PCB area with offset
            double pcbWidth = pcb.BBox.Max.X - pcb.BBox.Min.X + 2 * pcb.TrayOffset;
            double pcbHeight = pcb.BBox.Max.Y - pcb.BBox.Min.Y + 2 * pcb.TrayOffset;

            // Wrap to new column if exceeding max height
            if (pcbStartY + pcbHeight + spacing - origin.Y > maxTrayHeight
                && pcbStartY > origin.Y + spacing)
            {
                if (currentPcbCol.Count > 0) pcbColumns.Add(new List<Curve>(currentPcbCol));
                currentPcbCol.Clear();

                pcbColumnX += pcbColumnMaxWidth + spacing;
                pcbStartY = origin.Y + spacing;
                pcbColumnMaxWidth = 0;
            }

            if (pcbWidth > pcbColumnMaxWidth)
                pcbColumnMaxWidth = pcbWidth;

            // Calculate slot origin, then apply offsets
            Point3d slotOrigin = new Point3d(pcbColumnX, pcbStartY, 0);
            Point3d offsetSlotOrigin = new Point3d(slotOrigin.X + offsetX, slotOrigin.Y + offsetY, 0);

            // Store position and rotation for later deep section and subtraction
            pcbTrayPositions.Add(offsetSlotOrigin);
            pcbTrayRotations.Add(rotationDeg);

            // Add a virtual cutout curve for the PCB to enable bounded padded boxes
            // PCBs don't actually use cutoutCurves for their boundary in the main loop (they use boolean difference on 3D brep)
            // But we add a boundary here just to help pad the sub-tray.
            Rectangle3d pcbAreaRect = new Rectangle3d(new Plane(offsetSlotOrigin, Vector3d.ZAxis), pcbWidth, pcbHeight);
            currentPcbCol.Add(pcbAreaRect.ToNurbsCurve());

            // Calculate pick/place center for PCB (use original slot, not offset - pick/place shouldn't change with tray offset)
            Point3d cutoutCentre = new Point3d(slotOrigin.X + pcbWidth / 2.0, slotOrigin.Y + pcbHeight / 2.0, 0);
            pcb.CalculatePickPlace(cutoutCentre);
            PickPlaceLines.Add(new Line(pcb.PickPt, pcb.PlacePt));

            pcbStartY += pcbHeight + spacing;

            // Update tray width if PCBs extend beyond current width
            double requiredWidth = offsetSlotOrigin.X + pcbWidth + spacing - origin.X;
            if (requiredWidth > trayWidth)
                trayWidth = requiredWidth;

            // Track height for this column
            double requiredHeight = pcbStartY + spacing - origin.Y;
            if (requiredHeight > trayHeight)
                trayHeight = requiredHeight;
        }
        
        if (currentPcbCol.Count > 0) pcbColumns.Add(currentPcbCol);
        
        // Ensure tray width covers all sections even without PCBs
        double minTrayWidth = plugSectionRightEdge + spacing - origin.X;
        if (minTrayWidth > trayWidth)
            trayWidth = minTrayWidth;

        // Ensure tray dimensions also cover the plug section footprint.
        if (plugSectionRequiredWidth > trayWidth)
            trayWidth = plugSectionRequiredWidth;
        if (plugSectionRequiredHeight > trayHeight)
            trayHeight = plugSectionRequiredHeight;
        
        // Ensure tray height accounts for all column heights
        if (maxActualColumnHeight > trayHeight)
            trayHeight = maxActualColumnHeight;
        
        // Cap tray height to maxTrayHeight (columns should have wrapped)
        // but still respect any single item taller than maxTrayHeight
        
        // --- NEW BOUNDARY LOGIC ---
        // Create separate bounding boxes for each column, expand by spacing, and union them.
        List<Curve> sectionBoundaries = new List<Curve>();
        
        BoundingBox GetPaddedBBox(IEnumerable<Curve> crvs)
        {
            BoundingBox b = BoundingBox.Empty;
            foreach (var c in crvs) b.Union(c.GetBoundingBox(true));
            if (b.IsValid)
            {
                b.Min = new Point3d(b.Min.X - spacing, b.Min.Y - spacing, 0);
                b.Max = new Point3d(b.Max.X + spacing, b.Max.Y + spacing, 0);
            }
            return b;
        }
        
        List<BoundingBox> validBoxes = new List<BoundingBox>();
        Curve[] unionedBoundary = null;
        
        foreach (var col in hColumns)
        {
            BoundingBox b = GetPaddedBBox(col);
            if (b.IsValid) validBoxes.Add(b);
        }
        foreach (var col in vColumns)
        {
            BoundingBox b = GetPaddedBBox(col);
            if (b.IsValid) validBoxes.Add(b);
        }
        BoundingBox plugBox = GetPaddedBBox(plugCutoutCurves);
        if (plugBox.IsValid) validBoxes.Add(plugBox);
        foreach (var col in pcbColumns)
        {
            BoundingBox b = GetPaddedBBox(col);
            if (b.IsValid) validBoxes.Add(b);
        }
        
        // Sort boxes left to right
        validBoxes = validBoxes.OrderBy(b => b.Min.X).ToList();
        
        // Extend boxes to right to ensure they overlap and connect into a single tray
        for (int i = 0; i < validBoxes.Count - 1; i++)
        {
            BoundingBox current = validBoxes[i];
            BoundingBox next = validBoxes[i+1];
            if (current.Max.X < next.Min.X + 0.1)
            {
                // Connect columns with a bridge
                current.Max = new Point3d(next.Min.X + 0.1, current.Max.Y, 0);
                validBoxes[i] = current;
            }
        }
        
        foreach (var b in validBoxes)
        {
            Rectangle3d rect = new Rectangle3d(Plane.WorldXY, b.Min, b.Max);
            sectionBoundaries.Add(rect.ToNurbsCurve());
        }
        
        if (sectionBoundaries.Count > 0)
        {
            unionedBoundary = Curve.CreateBooleanUnion(sectionBoundaries, 0.001);
        }
        
        if (unionedBoundary != null && unionedBoundary.Length > 0)
        {
            // Use the largest boundary curve in case there are tiny artefacts
            var mainBoundary = unionedBoundary.OrderByDescending(c => c.GetLength()).First();
            cutoutCurves.Insert(0, mainBoundary);
        }
        else
        {
            // Fallback
            Rectangle3d trayBoundary = new Rectangle3d(new Plane(origin, Vector3d.ZAxis), trayWidth, trayHeight);
            cutoutCurves.Insert(0, trayBoundary.ToNurbsCurve());
        }
        // --------------------------
        
        // Generate Tray Brep with different depths
        // Traces and plugs need 0.4mm depth, PCBs need 1.5mm depth
        double tracePlugDepth = 0.4;
        
        Brep[] surfaces = Brep.CreatePlanarBreps(cutoutCurves, 0.001);
        if (surfaces != null && surfaces.Length > 0)
        {
            // Start with the trace/plug depth (0.4mm) for the entire tray
            this.TrayBrep = Brep.CreateFromOffsetFace(surfaces[0].Faces[0], tracePlugDepth, 0.001, false, true);
            
            // If there are PCBs, we need to extend the depth in PCB areas to 1.5mm
            if (allPCBs.Count > 0)
            {
                for (int idx = 0; idx < allPCBs.Count; idx++)
                {
                    var pcb = allPCBs[idx];
                    Point3d pos = pcbTrayPositions[idx];
                    double pcbWidth = pcb.BBox.Max.X - pcb.BBox.Min.X + 2 * pcb.TrayOffset;
                    double pcbHeight = pcb.BBox.Max.Y - pcb.BBox.Min.Y + 2 * pcb.TrayOffset;
                    
                    // Create a rectangle for the PCB area
                    Point3d pcbStart = new Point3d(pos.X, pos.Y, 0);
                    Rectangle3d pcbRect = new Rectangle3d(new Plane(pcbStart, Vector3d.ZAxis), pcbWidth, pcbHeight);
                    
                    // Extrude this rectangle to the PCB height minus 1mm
                    double depth = pcb.BBox.Max.Z - pcb.BBox.Min.Z - 0.5;
                    Brep pcbDepthBlock = Extrusion.Create(pcbRect.ToNurbsCurve(), depth, true).ToBrep();
                    
                    // Union with main tray to extend the depth
                    Brep[] union = Brep.CreateBooleanUnion(new Brep[] { this.TrayBrep, pcbDepthBlock }, 0.001);
                    if (union != null && union.Length > 0)
                        this.TrayBrep = union[0];
                }
            }
            
            // Now subtract PCB geometry from the tray
            for (int idx = 0; idx < allPCBs.Count; idx++)
            {
                var pcb = allPCBs[idx];
                Point3d pos = pcbTrayPositions[idx];
                double rotationDeg = pcbTrayRotations[idx];

                Point3d pcbBBoxCenter = pcb.BBox.Center;
                double pcbWidth = pcb.BBox.Max.X - pcb.BBox.Min.X + 2 * pcb.TrayOffset;
                double pcbHeight = pcb.BBox.Max.Y - pcb.BBox.Min.Y + 2 * pcb.TrayOffset;

                Point3d trayPcbCenter = new Point3d(pos.X + pcbWidth / 2.0, pos.Y + pcbHeight / 2.0, 0);

                // Create translation to move PCB geometry into tray position
                // Move from original position to tray position, and lower so bottom face is at tray base
                Vector3d translation = new Vector3d(
                    trayPcbCenter.X - pcbBBoxCenter.X,
                    trayPcbCenter.Y - pcbBBoxCenter.Y,
                    -pcb.BBox.Min.Z
                );

                Transform moveToTray = Transform.Translation(translation);

                // Subtract PCB brep from tray
                Brep geomCopy = pcb.Geometry.DuplicateBrep();
                geomCopy.Transform(moveToTray);

                // Apply rotation around Z-axis if specified
                if (Math.Abs(rotationDeg) > 0.001)
                {
                    Point3d rotCentre = trayPcbCenter;
                    Transform rotation = Transform.Rotation(rotationDeg * Math.PI / 180.0, Vector3d.ZAxis, rotCentre);
                    geomCopy.Transform(rotation);
                }

                Brep[] difference = Brep.CreateBooleanDifference(this.TrayBrep, geomCopy, 0.001);
                if (difference != null && difference.Length > 0)
                    this.TrayBrep = difference[0];
            }
        }
    }
}

// ============================================================================
// MAIN SCRIPT
// ============================================================================

public class Script_Instance : GH_ScriptInstance
{
    private const bool DEBUG = true;

    private void DebugPrint(string message)
    {
        if (DEBUG)
            Print(message);
    }

    private void Print(string message)
    {
        RhinoApp.WriteLine(message);
    }

    private List<Point3d> GetPickLayerPoints()
    {
        List<Point3d> points = new List<Point3d>();
        RhinoDoc doc = RhinoDoc.ActiveDoc;
        if (doc == null)
            return points;

        Layer pickLayer = doc.Layers.FindName("Pick");
        if (pickLayer == null)
            return points;

        RhinoObject[] objs = doc.Objects.FindByLayer(pickLayer);
        if (objs == null)
            return points;

        foreach (RhinoObject obj in objs)
        {
            if (obj?.Geometry is Point pointGeom)
                points.Add(pointGeom.Location);
        }

        return points;
    }

    private static bool IsPointOnOrInBrep(Brep brep, Point3d pt, double tol)
    {
        if (brep == null)
            return false;

        if (brep.IsPointInside(pt, tol, true))
            return true;

        Point3d closestPt;
        ComponentIndex ci;
        double s, t;
        Vector3d normal;
        if (brep.ClosestPoint(pt, out closestPt, out ci, out s, out t, 0, out normal))
            return pt.DistanceTo(closestPt) <= tol;

        return false;
    }

    private static void AssignPreferredPickPoints(List<TraceElement> traces, List<Plug> plugs, List<PCB> pcbLikeEmbeddables, List<Point3d> pickLayerPoints, double tol)
    {
        foreach (TraceElement trace in traces)
        {
            Point3d best = Point3d.Unset;
            double bestDist = double.MaxValue;
            Point3d traceCenter = trace.ModelLine.PointAt(0.5);

            foreach (Point3d pt in pickLayerPoints)
            {
                if (!IsPointOnOrInBrep(trace.ModelBox, pt, tol))
                    continue;

                double dist = pt.DistanceTo(traceCenter);
                if (dist < bestDist)
                {
                    bestDist = dist;
                    best = pt;
                }
            }

            if (best != Point3d.Unset)
                trace.SetPreferredPickPoint(best);
        }

        foreach (Plug plug in plugs)
        {
            Point3d best = Point3d.Unset;
            double bestDist = double.MaxValue;
            Point3d center = plug.PlacePt;

            foreach (Point3d pt in pickLayerPoints)
            {
                double radialDist = Math.Sqrt((pt.X - center.X) * (pt.X - center.X) + (pt.Y - center.Y) * (pt.Y - center.Y));
                bool withinRadius = radialDist <= plug.Radius + tol;
                bool withinHeight = pt.Z <= center.Z + tol && pt.Z >= center.Z - plug.Height - tol;
                if (!withinRadius || !withinHeight)
                    continue;

                double dist = pt.DistanceTo(center);
                if (dist < bestDist)
                {
                    bestDist = dist;
                    best = pt;
                }
            }

            if (best != Point3d.Unset)
                plug.SetPreferredPickPoint(best);
        }

        foreach (PCB pcb in pcbLikeEmbeddables)
        {
            Point3d best = Point3d.Unset;
            double bestDist = double.MaxValue;
            Point3d center = pcb.PlacePt;

            foreach (Point3d pt in pickLayerPoints)
            {
                if (!IsPointOnOrInBrep(pcb.Geometry, pt, tol))
                    continue;

                double dist = pt.DistanceTo(center);
                if (dist < bestDist)
                {
                    bestDist = dist;
                    best = pt;
                }
            }

            if (best != Point3d.Unset)
                pcb.SetPreferredPickPoint(best);
        }
    }


    private void RunScript(
		List<Line> traceLines,
		List<Point3d> plugPoints,
		List<GeometryBase> embedGeometry,
		List<GeometryBase> PrintEmbedGeometry,
		double plugRadius,
		double plugHeight,
		List<double> traceWidth,
		double traceHeight,
		Point3d origin,
		double layerHeight,
		double traySpacing,
		List<Brep> geometry,
		ref object operations,
		ref object trayBrep,
		ref object modelBreps,
		ref object intersections,
		ref object pickPlaceLines,
		ref object badGeometry,
		ref object traceCuts)
    {
        // Apply 0.2mm side offset so both tray cutouts and generated trace
        // geometry are expanded equally from the provided nominal trace width.
        const double traceSideOffset = 0.15;
        
        // Handle list access for traceWidth
        traceWidth = traceWidth ?? new List<double>();
        if (traceWidth.Count == 0) throw new Exception("At least one trace width must be provided.");

        // Validate inputs
        if (Math.Abs(traceHeight % layerHeight) > 0.001 && Math.Abs(traceHeight % layerHeight - layerHeight) > 0.001)
            throw new Exception("traceHeight must be a multiple of layerHeight.");
            
        if (Math.Abs(plugHeight % layerHeight) > 0.001 && Math.Abs(plugHeight % layerHeight - layerHeight) > 0.001)
            throw new Exception("plugHeight must be a multiple of layerHeight.");

        // Treat missing lists as empty so the script still runs on partial inputs.
        traceLines = traceLines ?? new List<Line>();
        plugPoints = plugPoints ?? new List<Point3d>();
        embedGeometry = embedGeometry ?? new List<GeometryBase>();
        PrintEmbedGeometry = PrintEmbedGeometry ?? new List<GeometryBase>();

        // Separate good and bad traces
        List<TraceElement> allTraces = new List<TraceElement>();
        List<Brep> badTraceGeometry = new List<Brep>();
        
        for (int i = 0; i < traceLines.Count; i++)
        {
            Line ln = traceLines[i];
            
            // Get corresponding trace width (or default to first element)
            double currentWidth = traceWidth.Count == 1 ? traceWidth[0] : (i < traceWidth.Count ? traceWidth[i] : traceWidth[0]);
            double effectiveTraceWidth = currentWidth + 2.0 * traceSideOffset;

            bool isHorizontal;
            if (TraceElement.IsPerpendicular(ln, out isHorizontal))
            {
                allTraces.Add(new TraceElement(ln, effectiveTraceWidth, traceHeight, layerHeight, traceSideOffset));
            }
            else
            {
                // Create bad geometry for non-perpendicular traces
                badTraceGeometry.Add(TraceElement.CreateBadGeometryBox(ln, effectiveTraceWidth, traceHeight, traceSideOffset));
            }
        }

        // Initialize Plugs
        List<Plug> allPlugs = new List<Plug>();
        if (plugPoints != null)
        {
            foreach (Point3d plugPt in plugPoints)
            {
                allPlugs.Add(new Plug(plugPt, plugRadius, plugHeight, traceHeight, layerHeight));
            }
        }
        
        // Initialize PCBs and contact points from embedGeometry
        List<PCB> allPCBs = new List<PCB>();
        TraceElement.ContactPoints.Clear();
        
        if (embedGeometry != null && embedGeometry.Count > 0)
        {
            foreach (GeometryBase geom in embedGeometry)
            {
                if (geom is Brep brep)
                {
                    PCB pcb = new PCB(brep, 2.0, layerHeight); // 2mm tray offset
                    
                    // Try to read user text from the corresponding Rhino Brep object in the document
                    RhinoDoc doc = RhinoDoc.ActiveDoc;
                    if (doc != null)
                    {
                        BoundingBox brepBB = brep.GetBoundingBox(true);

                        foreach (RhinoObject rhObj in doc.Objects.GetObjectList(ObjectType.Brep))
                        {
                            if (rhObj.Geometry is Brep rhBrep)
                            {
                                BoundingBox rhBB = rhBrep.GetBoundingBox(true);

                                // Bounding box matching: center distance < 0.001mm and diagonal length match < 0.001mm
                                bool centersMatch = brepBB.Center.DistanceTo(rhBB.Center) < 0.001;
                                bool diagonalsMatch = Math.Abs((brepBB.Max - brepBB.Min).Length - (rhBB.Max - rhBB.Min).Length) < 0.001;

                                if (centersMatch && diagonalsMatch)
                                {
                                    string userText = "";

                                    // Try multiple common key names
                                    string[] keyNames = { "notes", "overrides", "config", "params", "", null };
                                    foreach (string key in keyNames)
                                    {
                                        try
                                        {
                                            string val = key != null ? rhObj.Attributes.GetUserString(key) : null;
                                            if (!string.IsNullOrWhiteSpace(val))
                                            {
                                                userText = val;
                                                break;
                                            }
                                        }
                                        catch { }
                                    }

                                    // If no specific key found, try to get all user strings
                                    if (string.IsNullOrWhiteSpace(userText))
                                    {
                                        var allStrings = rhObj.Attributes.GetUserStrings();
                                        if (allStrings.Count > 0)
                                        {
                                            string[] parts = new string[allStrings.Count];
                                            for (int i = 0; i < allStrings.Count; i++)
                                            {
                                                parts[i] = $"{allStrings.AllKeys[i]}={allStrings[i]}";
                                            }
                                            userText = string.Join(";", parts);
                                        }
                                    }

                                    DebugPrint($"[Brep] Found matching Brep with attributes: {(string.IsNullOrWhiteSpace(userText) ? "(none)" : userText)}");

                                    pcb.ParseOverridesFromUserText(userText);
                                    break;
                                }
                            }
                        }
                    }
                    
                    allPCBs.Add(pcb);
                }
                else if (geom is Point point)
                {
                    ContactPoint cp = new ContactPoint(point.Location);
                    
                    // Try to read user text from the corresponding Rhino Point object in the document
                    RhinoDoc doc = RhinoDoc.ActiveDoc;
                    if (doc != null)
                    {
                        foreach (RhinoObject rhObj in doc.Objects.GetObjectList(ObjectType.Point))
                        {
                            if (rhObj.Geometry is Point rhPoint && rhPoint.Location.DistanceTo(point.Location) < 0.001)
                            {
                                string userText = "";
                                
                                // Try multiple common key names
                                string[] keyNames = { "notes", "overrides", "config", "params", "", null };
                                foreach (string key in keyNames)
                                {
                                    try
                                    {
                                        string val = key != null ? rhObj.Attributes.GetUserString(key) : null;
                                        if (!string.IsNullOrWhiteSpace(val))
                                        {
                                            userText = val;
                                            break;
                                        }
                                    }
                                    catch { }
                                }
                                
                                // If no specific key found, try to get all user strings
                                if (string.IsNullOrWhiteSpace(userText))
                                {
                                    var allStrings = rhObj.Attributes.GetUserStrings();
                                    if (allStrings.Count > 0)
                                    {
                                        string[] parts = new string[allStrings.Count];
                                        for (int i = 0; i < allStrings.Count; i++)
                                        {
                                            parts[i] = $"{allStrings.AllKeys[i]}={allStrings[i]}";
                                        }
                                        userText = string.Join(";", parts);
                                    }
                                }
                                
                                cp.ParseOverridesFromUserText(userText);
                                break;
                            }
                        }
                    }
                    
                    TraceElement.ContactPoints.Add(cp);
                }
            }
        }

        // Debug: Output contact point overrides
        if (TraceElement.ContactPoints.Count > 0)
        {
            DebugPrint($"[DEBUG] Found {TraceElement.ContactPoints.Count} contact point(s):");
            for (int i = 0; i < TraceElement.ContactPoints.Count; i++)
            {
                ContactPoint cp = TraceElement.ContactPoints[i];
                if (cp.Overrides.Count > 0)
                {
                    string overrideStr = string.Join("; ", cp.Overrides.Select(kv => $"{kv.Key}={kv.Value}"));
                    DebugPrint($"  Point {i}: ({cp.Position.X:F2}, {cp.Position.Y:F2}, {cp.Position.Z:F2}) → Overrides: {overrideStr}");
                }
                else
                {
                    DebugPrint($"  Point {i}: ({cp.Position.X:F2}, {cp.Position.Y:F2}, {cp.Position.Z:F2}) → No overrides");
                }
            }
        }
        else
        {
            DebugPrint("[DEBUG] No contact points found in embedGeometry");
        }

        // Debug: Output PCB overrides
        if (allPCBs.Count > 0)
        {
            DebugPrint($"[DEBUG] Found {allPCBs.Count} PCB(s):");
            for (int i = 0; i < allPCBs.Count; i++)
            {
                PCB pcb = allPCBs[i];
                if (pcb.Overrides.Count > 0)
                {
                    string overrideStr = string.Join("; ", pcb.Overrides.Select(kv => $"{kv.Key}={kv.Value}"));
                    DebugPrint($"  PCB {i}: Overrides: {overrideStr}");
                }
                else
                {
                    DebugPrint($"  PCB {i}: No overrides");
                }
            }
        }
        else
        {
            DebugPrint("[DEBUG] No PCBs found in embedGeometry");
        }

        // Debug: Show all Point objects in Rhino doc
        RhinoDoc docDebug = RhinoDoc.ActiveDoc;
        if (docDebug != null)
        {
            var rhPoints = docDebug.Objects.GetObjectList(ObjectType.Point).ToList();
            DebugPrint($"[DEBUG] Rhino document has {rhPoints.Count} Point object(s)");
            for (int i = 0; i < rhPoints.Count && i < 5; i++)
            {
                RhinoObject rhObj = rhPoints[i];
                var userStrs = rhObj.Attributes.GetUserStrings();
                string userStrContent = "";
                for (int j = 0; j < userStrs.Count; j++)
                {
                    userStrContent += userStrs.AllKeys[j] + "=" + userStrs[j];
                    if (j < userStrs.Count - 1) userStrContent += "; ";
                }
                DebugPrint($"  Rhino Point {i}: {userStrs.Count} user string(s) → {userStrContent}");
            }
        }

        // Initialize print embeddables from PrintEmbedGeometry
        List<Print> allPrints = new List<Print>();
        if (PrintEmbedGeometry != null && PrintEmbedGeometry.Count > 0)
        {
            foreach (GeometryBase geom in PrintEmbedGeometry)
            {
                if (geom is Brep brep)
                    allPrints.Add(new Print(brep, 2.0, layerHeight));
            }
        }
        
        // Find ContactPoints that fall within the bounds of each PCB for prinjection
        double pcbTol = 0.5; // Slight inflation to capture points near edges/faces
        foreach (PCB pcb in allPCBs)
        {
            if (pcb == null || !pcb.BBox.IsValid)
                continue;

            if (pcb.PrinjectionPoints == null)
                pcb.PrinjectionPoints = new List<PrinjectionPoint>();

            BoundingBox inflatedBBox = pcb.BBox;
            inflatedBBox.Inflate(pcbTol);
            
            Print($"[DEBUG] PCB BBox: min=({pcb.BBox.Min.X:F2}, {pcb.BBox.Min.Y:F2}, {pcb.BBox.Min.Z:F2}) max=({pcb.BBox.Max.X:F2}, {pcb.BBox.Max.Y:F2}, {pcb.BBox.Max.Z:F2})");
            
            if (TraceElement.ContactPoints != null)
            {
                foreach (ContactPoint contactPt in TraceElement.ContactPoints)
                {
                    if (inflatedBBox.Contains(contactPt.Position))
                    {
                        PrinjectionPoint pp = new PrinjectionPoint(contactPt.Position);
                        // Copy contact point overrides to prinjection point
                        // Only copy keys that are relevant to prinjection (those starting with prinjection_)
                        if (contactPt.Overrides != null)
                        {
                            foreach (var kvp in contactPt.Overrides)
                            {
                                // Only copy prinjection-specific overrides; skip tamping-only keys like depth_offset
                                if (kvp.Key.StartsWith("prinjection_"))
                                {
                                    pp.Overrides[kvp.Key] = kvp.Value;
                                }
                            }
                        }
                        if (pp.Overrides.Count > 0)
                        {
                            string[] parts = new string[pp.Overrides.Count];
                            int idx = 0;
                            foreach (var kv in pp.Overrides)
                            {
                                parts[idx++] = $"{kv.Key}={kv.Value}";
                            }
                            string overrideStr = string.Join("; ", parts);
                            Print($"  [DEBUG] Added PrinjectionPoint with overrides: {overrideStr}");
                        }
                        else
                        {
                            Print($"  [DEBUG] Added PrinjectionPoint at ({contactPt.Position.X:F2}, {contactPt.Position.Y:F2}, {contactPt.Position.Z:F2}) with NO overrides");
                        }
                        pcb.PrinjectionPoints.Add(pp);
                    }
                }
                Print($"[DEBUG] Total prinjection points for this PCB: {pcb.PrinjectionPoints.Count}");
            }
        }

        // Combine all embeddables (including PCBs)
        List<Embeddable> allEmbeddables = new List<Embeddable>();
        allEmbeddables.AddRange(allTraces);
        allEmbeddables.AddRange(allPlugs);
        allEmbeddables.AddRange(allPCBs);
        allEmbeddables.AddRange(allPrints);

        // Optional per-embeddable pick override points from Rhino layer "Pick".
        List<Point3d> pickLayerPoints = GetPickLayerPoints();
        if (pickLayerPoints.Count > 0)
        {
            double tol = RhinoDoc.ActiveDoc != null ? RhinoDoc.ActiveDoc.ModelAbsoluteTolerance : 0.01;
            List<PCB> allPcbLike = new List<PCB>();
            allPcbLike.AddRange(allPCBs);
            allPcbLike.AddRange(allPrints.Cast<PCB>());
            AssignPreferredPickPoints(allTraces, allPlugs, allPcbLike, pickLayerPoints, tol);
            Print($"Pick layer points detected: {pickLayerPoints.Count}");
        }

        // No valid components to process.
        if (allEmbeddables.Count == 0)
        {
            operations = null;
            trayBrep = null;
            modelBreps = null;
            intersections = null;
            pickPlaceLines = null;
            traceCuts = null;
            badGeometry = badTraceGeometry.Count > 0 ? (object) badTraceGeometry : null;
            return;
        }

        // Calculate intersections and safe pick distances
        for (int traceIdx = 0; traceIdx < allTraces.Count; traceIdx++)
        {
            var trace = allTraces[traceIdx];
            trace.CalcIntersections(allEmbeddables);

            bool usedFallback = false;
            try
            {
                trace.CalculateSafePickDistance(geometry);
            }
            catch (Exception ex)
            {
                Print($"Safe pick error for trace {traceIdx}: {ex.Message}");
                // Print the geometry tests from the primary attempt
                Print("Retrying without geometry constraints...");
                try
                {
                    trace.CalculateSafePickDistance(null);
                    usedFallback = true;
                    Print("Fallback succeeded: selected safe point using intersection checks only.");
                }
                catch (Exception exNoGeom)
                {
                    usedFallback = true;
                    Print($"Secondary fallback failed for trace {traceIdx}: {exNoGeom.Message}");
                    trace.SetSafePickDistanceToMidpoint();
                    Print("Final fallback: forced midpoint pick distance.");
                }
            }

            // Debug output: why each safe-pick candidate was rejected/accepted.
            if (usedFallback)
                Print($"Trace {traceIdx} used fallback safe-pick handling.");
        }
        
        foreach (var plug in allPlugs)
        {
            plug.CalcIntersections(allEmbeddables);
        }

        // Create tray (calculates pick/place points)
        Tray tray = new Tray(allEmbeddables, origin, traySpacing);
        trayBrep = tray.TrayBrep;
        pickPlaceLines = tray.PickPlaceLines;

        // Build nominal trace rectangles (remove the +offset applied to tray/model trace dimensions)
        List<Curve> traceCutCurves = new List<Curve>();
        foreach (var trace in allTraces)
        {
            if (trace.TrayCurve == null) continue;
            BoundingBox bb = trace.TrayCurve.GetBoundingBox(true);
            double rW = (bb.Max.X - bb.Min.X) - 2 * traceSideOffset;
            double rH = (bb.Max.Y - bb.Min.Y) - 2 * traceSideOffset;
            if (rW > 0 && rH > 0)
            {
                Point3d corner = new Point3d(bb.Min.X + traceSideOffset, bb.Min.Y + traceSideOffset, 0);
                Rectangle3d nominalRect = new Rectangle3d(new Plane(corner, Vector3d.ZAxis), rW, rH);
                traceCutCurves.Add(nominalRect.ToNurbsCurve());
            }
        }
        traceCuts = traceCutCurves;

        // Collect model Breps for traces
        List<Brep> allModelBreps = allTraces.Where(t => t.ModelBox != null).Select(t => t.ModelBox).ToList();
        DebugPrint($"[ModelBreps] Found {allTraces.Count} traces, {allModelBreps.Count} with valid ModelBox");
        
        // Add plug cylinders
        foreach (var plug in allPlugs)
        {
            Circle plugCircle = new Circle(new Plane(plug.PlacePt, Vector3d.ZAxis), plugRadius + 0.35);
            Circle plugCircle2 = new Circle(new Plane(new Point3d(plug.PlacePt.X, plug.PlacePt.Y, plug.PlacePt.Z - plugHeight), Vector3d.ZAxis), plugRadius + 0.5);
            
            List<Curve> curves = new List<Curve> { plugCircle.ToNurbsCurve(), plugCircle2.ToNurbsCurve() };
            Brep[] lofts = Brep.CreateFromLoft(curves, Point3d.Unset, Point3d.Unset, LoftType.Tight, false);
            Brep plugBrep = lofts[0].CapPlanarHoles(0.01);

            if (plugBrep != null)
                allModelBreps.Add(plugBrep);
        }
        
        // Original PCBs and prints are intentionally excluded from allModelBreps 
        // so that they are not included in the final unioned model breps.
        
        // Collect all intersections
        List<Point3d> allIntersections = new List<Point3d>();
        foreach (var trace in allTraces)
        {
            allIntersections.AddRange(trace.Intersections);
        }
        foreach (var plug in allPlugs)
        {
            allIntersections.AddRange(plug.Intersections);
        }
        
        // Check for Brep intersections and add to bad geometry
        for (int i = 0; i < allModelBreps.Count; i++)
        {
            for (int j = i + 1; j < allModelBreps.Count; j++)
            {
                Brep[] intersectionBreps = Brep.CreateBooleanIntersection(
                    allModelBreps[i], 
                    allModelBreps[j], 
                    0.001);
                
                if (intersectionBreps != null && intersectionBreps.Length > 0)
                {
                    badTraceGeometry.AddRange(intersectionBreps);
                }
            }
        }
        
        // Final outputs
        operations = allEmbeddables;
        
        if (allModelBreps.Count > 0)
        {
            Brep[] unionedBreps = Brep.CreateBooleanUnion(allModelBreps, 0.001);
            if (unionedBreps != null && unionedBreps.Length > 0)
                modelBreps = unionedBreps.ToList();
            else
                modelBreps = allModelBreps;
        }
        else
        {
            modelBreps = allModelBreps;
        }

        intersections = allIntersections;
        badGeometry = badTraceGeometry;
    }
}
# ---------- end c_script_2 ----------
geo_3 = Geometry(pipeline_5)
colour = ColourPicker(PickedColour=RGB(31, 110, 194))
colour_2 = ColourPicker(PickedColour=RGB(59, 59, 59))
panel_16 = Panel("""Prusa XL
Prusa Mini""")
cmdbutton = CreateRhinoCommandButton(ButtonName="  Insert Flora Pixel", ImagePath=panel_6, RhinoScript=panel_5, ButtonStyle=0)
cmdbutton_2 = CreateRhinoCommandButton(ButtonName="  Insert WS2812b", ImagePath=panel_9, RhinoScript=panel_8, ButtonStyle=0)
cmdbutton_3 = CreateRhinoCommandButton(ButtonName="  Insert CR2032", ImagePath=panel, RhinoScript=panel_7, ButtonStyle=0)
cmdbutton_4 = CreateRhinoCommandButton(ButtonName="  Insert Xiao", ImagePath=panel_12, RhinoScript=panel_10, ButtonStyle=0)
sp = ScriptParasite2(Enable=Toggle(True), Path=panel_13, TargetComponent=c_script_2)
cmdbutton_5 = CreateRhinoCommandButton(ButtonName="  Insert Sequin", ImagePath=panel_14, RhinoScript=panel_11, ButtonStyle=0)
cmdbutton_6 = CreateRhinoCommandButton(ButtonName="Add Via", RhinoScript="! _-Layer _Current \"Traces\" _Enter _Point", ButtonStyle=0)
cmdbutton_7 = CreateRhinoCommandButton(ButtonName="Draw trace", RhinoScript="! _-Layer _Current \"Traces\" _Enter _Line", ButtonStyle=0)
slider = CreateSlider(Slider=layer, ShowBounds=False, ShowTicks=False, ShowTooltip=False, ShowValLabel=True, showLabel=True)
slider_2 = CreateSlider(Slider=grid, ShowBounds=False, ShowTicks=False, ShowTooltip=False, ShowValLabel=True, showLabel=True)
colour_3 = ColourPicker(PickedColour=RGB(141, 227, 61))
crv = Curve(c_script_2.traceCuts)
panel_17 = Panel(sp)
list = ItemSelector(
    pipeline_6,
    {"Referenced Brep", "Referenced Brep", "Referenced Brep", "Referenced Brep", "Referenced Brep", "Referenced Brep", "Referenced Brep", "Referenced Brep", "Referenced Brep", "Referenced Brep"}, selected="Referenced Brep")
cap = CapHoles(Brep=geo_3)
pulldown = CreatePulldownMenu(Label="Select Printer", ListItems=panel_16, SelectedIndex=Slider(0, range=0..100), showLabel=True)
pt_3 = Point(flatten(c_script_2.intersections))
line_2 = Line(c_script_2.pickPlaceLines)
brep = Brep(c_script_2.modelBreps)
scale = Scale(Geometry=c_script_2.traceCuts, Center=Point(0, 0, 0), Factor=3.8)  # -> Geometry, Transform
sunion = SolidUnion(Breps=flatten([pipeline_6, c_script_2.modelBreps]))  # -> flatten(Result)
sunion_2 = SolidUnion(Breps=c_script_2.modelBreps)
button = CreateButton(ButtonName="Slice!", ButtonStyle=0)
adjustpos = AdjustElementPositioning(
    ElementsToAdjust=[cmdbutton_7, pulldown, cmdbutton_6, cmdbutton_3, cmdbutton_5, cmdbutton_4, cmdbutton_2, cmdbutton, button],
    AbsolutePositioning=False,
    Width=Slider(304, range=0..1000),
    HorizontalAlignment=0)
material = CreateMaterial(Diffuse=colour, Specular=RGB(255, 255, 255), Emission=RGB(0, 0, 0), Transparency=0, Shine=0)
material_2 = CreateMaterial(Diffuse=colour_2, Specular=RGB(255, 255, 255), Emission=RGB(0, 0, 0), Transparency=0, Shine=0)
values = ValueListener(Elements=slider, SomeProperty=True)  # -> Values, Indices
values_2 = ValueListener(Elements=slider_2, SomeProperty=True)  # -> Values, Indices
merge = Merge(
    Data1=pulldown,
    Data2=label,
    Data3=slider,
    Data4=slider_2,
    Data6=cmdbutton_7,
    Data7=cmdbutton_6,
    Data8=button,
    Data10=cmdbutton_5,
    Data12=cmdbutton_4,
    Data14=cmdbutton,
    Data15=cmdbutton_2,
    Data16=cmdbutton_3,
    Data17=cmdbutton_3)
bbox = BoundingBox(Content=sunion, Plane=PlaneXY(0, 0, 0))  # -> Box, Box_2
values_3 = ValueListener(Elements=pulldown, SomeProperty=True)  # -> Values, Indices
sdiff = SolidDifference(BrepsA=cap, BrepsB=sunion)
values_4 = ValueListener(Elements=button, SomeProperty=True)  # -> Values, Indices
adjustelem = AdjustElementAppearance(ElementsToAdjust=cmdbutton_7)
adjustelem_2 = AdjustElementAppearance(ElementsToAdjust=button, Background=colour_3, FontSize=Slider(27, range=0..100))
simplegrid = CreateSimpleGrid(RowDefinitions="Auto", ColumnDefinitions="Auto")
boxprop = BoxProperties(Box=bbox.Box)  # -> Center, Diagonal, Area, Volume, Degeneracy
scale_2 = Scale(Geometry=sunion, Center=boxprop.Center, Factor=Slider(1.001, range=0..10))  # -> Geometry, Transform
sdiff_2 = SolidDifference(BrepsA=flatten(cap), BrepsB=flatten(sunion_2))
or = GateOr(A=values_4.Values, B=Toggle(False))
geo_4 = Geometry(c_script_2.trayBrep)
panel_18 = Panel("C:\Users\Oliver\OneDrive - University of Bristol\PhD\UIST 2026 Print Place Printegrate\Designer")
savesvg = SaveSvg(DrawingsShapesGeometry=scale.Geometry, FolderPath=panel_18, FileName="output.svg", Save=Button())
sdiff_3 = SolidDifference(BrepsA=flatten(sdiff_2), BrepsB=flatten(scale_2.Geometry))

# ----
# 5. Update the contents of existing elements
# 4. Listen to the UI Elements
panel_19 = Panel(values_2.Values)

geo_5 = Geometry(sdiff)

# ----
# 4. Listen to the UI Elements
panel_20 = Panel(values.Values)

# ----
# 3. Add the element to the window
addelems = AddElements(Window=launchwin, Elements=flatten(merge), DoVLChecking=True)  # -> AddedElements, ElementNames

preview = CustomPreview(Geometry=c_script_2.badGeometry, Material=material_2)
preview_2 = CustomPreview(Geometry=[c_script_2.modelBreps, c_script_2.trayBrep], Material=material)
py3 = Python3Script(
    model=sdiff_3,
    tray=geo_4,
    run=or,
    path=panel_18,
    operations=c_script_2.operations,
    printer=values_3.Values,
    braid=Toggle(False))  # -> out, a; inputs model: list of Mesh, tray: Mesh, path: String, operations: list, printer: String, braid: Boolean
# ---------- py3: Python ----------
import subprocess
import os
import shutil
import re
import sys
import Rhino
import System


# --- USER CONFIGURATION ---
SLICER_PATH = r"C:\Program Files\Prusa3D\PrusaSlicer\prusa-slicer-console.exe"
MODULE_PATH = r"C:\Users\Oliver\OneDrive - University of Bristol\PhD\UIST 2026 Print Place Printegrate\Designer\Scripts"
XL_WIPE_LOCATION = (225, -8, 3)
MINI_WIPE_LOCATION = (150, -3, 3)
PART_START_Z_HOP = 30.0
PART_START_EXTRA_PRIME = 0.25
PLACE_HOVER_DWELL_TIME_MS = 0 

if MODULE_PATH not in sys.path:
    sys.path.append(MODULE_PATH)

# --- PICK AND PLACE CONFIGURATION ---
CONFIG = {
    'trace_braid': {
        # Pick parameters
        'pick_z_offset': -0.06,          # Z offset below pick point (mm)
        'pick_pre_extrude_amount': 1.0,  # Pre-extrusion before descending to pick (mm)
        'pick_extrude_amount': 0.5,      # Extrusion during pick (mm)
        'pick_extrude_feedrate': 100,    # Feedrate during pick extrusion (mm/min)
        'pick_cool_temp': 160,           # Temperature to cool to for grabbing (°C)
        
        # Place parameters
        'place_z_offset': -0.4,          # Final Z offset below place point (mm)
        'place_heat_temp': 210,          # Temperature to heat to for release (°C)
        'place_preheat_height': 0,       # Height above place point to pre-heat (mm) - 0 means at place point
        'place_dwell_time': 1000,        # Dwell time after placement (ms)
        
        # Movement feedrates
        'travel_feedrate': 6000,         # XY travel speed (mm/min)
        'z_lift_feedrate': 1000,         # Z lift speed (mm/min)
        'place_feedrate': 300,           # Z approach speed for placement (mm/min)
    },
    'trace_cloth': {
        # Pick parameters
        'pick_z_offset': -0.3,          # Z offset below pick point (mm)
        'pick_pre_extrude_amount': 1.0,  # Pre-extrusion before descending to pick (mm)
        'pick_extrude_amount': 0,      # Extrusion during pick (mm)
        'pick_extrude_feedrate': 100,    # Feedrate during pick extrusion (mm/min)
        'pick_cool_temp': 180,           # Temperature to cool to for grabbing (°C)
        
        # Place parameters
        'place_z_offset': -0.3,          # Final Z offset below place point (mm)
        'place_heat_temp': 210,          # Temperature to heat to for release (°C)
        'place_preheat_height': 0,       # Height above place point to pre-heat (mm) - 0 means at place point
        'place_dwell_time': 1000,        # Dwell time after placement (ms)
        
        # Movement feedrates
        'travel_feedrate': 6000,         # XY travel speed (mm/min)
        'z_lift_feedrate': 1000,         # Z lift speed (mm/min)
        'place_feedrate': 300,           # Z approach speed for placement (mm/min)
    },
    'plug': {
        # Pick parameters
        'pick_z_offset': -0.65,          # Z offset below pick point (mm)
        'pick_extrude_amount': 1.8,      # Extrusion during pick (mm)
        'pick_extrude_feedrate': 100,    # Feedrate during pick extrusion (mm/min)
        'pick_cool_temp': 140,           # Temperature to cool to for grabbing (°C)
        
        # Place parameters
        'place_z_offset': -1.4,          # Final Z offset below place point (mm)
        'place_heat_temp': 210,          # Temperature to heat to for release (°C)
        'place_preheat_height': 0.25,    # Height above place point to pre-heat (mm)
        'place_dwell_time': 1000,        # Dwell time after placement (ms)
        
        # Movement feedrates
        'travel_feedrate': 6000,         # XY travel speed (mm/min)
        'z_lift_feedrate': 1000,         # Z lift speed (mm/min)
        'place_feedrate': 100,           # Z approach speed for placement (mm/min)
    },
    'pcb': {
        # Pick parameters
        'pick_z_offset': -0.45,          # Z offset below pick point (mm)
        'pick_extrude_amount': 2.0,      # Extrusion during pick (mm)
        'pick_extrude_feedrate': 200,    # Feedrate during pick extrusion (mm/min)
        'pick_cool_temp': 100,           # Temperature to cool to for grabbing (°C) - colder for PCBs
        
        # Place parameters
        'place_z_offset': -1.0,          # Final Z offset below place point (mm)
        'place_heat_temp': 210,          # Temperature to heat to for release (°C)
        'place_preheat_height': 0.25,    # Height above place point to pre-heat (mm)
        'place_dwell_time': 1000,        # Dwell time after placement (ms)
        'place_side_offset': 1.0,        # X offset to move aside after placement (mm)
        
        # Prinjection parameters
        'prinjection': {
            'hover_z_offset': 5.0,       # Height above point to hover before injecting (mm)
            'inject_z_offset': -1.4,     # Z offset relative to point for extrusion (mm)
            'swipe_z_offset': -0.4,      # Z offset relative to point to perform swipe (mm)
            'extrude_amount': 0.5,       # Amount to extrude (mm)
            'initial_extra_prime': 0.5,  # Extra unretract amount for the very first hole (mm)
            'extrude_feedrate': 300,     # Feedrate for extrusion (mm/min)
            'retract_amount': 3,         # Amount to retract after injection (mm)
        },
        
        # Movement feedrates
        'travel_feedrate': 6000,         # XY travel speed (mm/min)
        'z_lift_feedrate': 1000,         # Z lift speed (mm/min)
        'place_feedrate': 100,           # Z approach speed for placement (mm/min)
    },
    'print': {
        # Pick parameters (PCB-like, but colder grab)
        'pick_z_offset': -0.65,          # Z offset below pick point (mm)
        'pick_extrude_amount': 5.0,      # Extrusion during pick (mm)
        'pick_extrude_feedrate': 200,    # Feedrate during pick extrusion (mm/min)
        'pick_cool_temp': 50,            # Cool lower for printed inserts (°C)

        # Place parameters
        'place_z_offset': -1.4,         # Final Z offset below place point (mm)
        'place_heat_temp': 230,          # Heat to print/release temperature (°C)
        'wipe_temp': 210,                # Heat to wipe temperature (°C) before wiping
        'place_preheat_height': 0.25,    # Height above place point to pre-heat (mm)
        'place_dwell_time': 1000,        # Dwell time after placement (ms)
        'place_side_offset': 3.0,        # X offset to move aside after placement (mm)

        # Movement feedrates
        'travel_feedrate': 6000,         # XY travel speed (mm/min)
        'z_lift_feedrate': 1000,         # Z lift speed (mm/min)
        'place_feedrate': 50,           # Z approach speed for placement (mm/min)
        'post_place_lift_feedrate': 50,  # extremely slow lift after placing
    },
    'tamping': {
        # Tamping parameters by type (TampingType enum: 0=End, 1=TraceTrace, 2=TracePlug, 3=TracePCB)
        0: {  # End
            'depth_offset': 0.6,         # Depth below tamp position (mm)
            'feedrate': 300,             # Z approach speed (mm/min)
            'dwell_time': 250,           # Dwell time at tamp position (ms)
        },
        1: {  # TraceTrace
            'depth_offset': 1.8,         # Depth below tamp position (mm)
            'feedrate': 200,             # Z approach speed (mm/min)
            'dwell_time': 500,           # Dwell time at tamp position (ms)
        },
        2: {  # TracePlug
            'depth_offset': 2.8,         # Depth below tamp position (mm)
            'feedrate': 200,             # Z approach speed (mm/min)
            'dwell_time': 500,          # Dwell time at tamp position (ms)
        },
        3: {  # TracePCB
            'depth_offset': 2.3,         # Depth below tamp position (mm)
            'feedrate': 200,             # Z approach speed (mm/min)
            'dwell_time': 500,           # Dwell time at tamp position (ms)
        },
        'travel_feedrate': 3000,         # XY travel speed to tamping points (mm/min)
        'lift_feedrate': 1000,           # Z lift speed after tamping (mm/min)
        'lift_height': 2.0,              # Height to lift after tamping (mm)
    }
}

import gcode_writer
import importlib
importlib.reload(gcode_writer)
from gcode_writer import GcodeWriter


def process_print():
    """Main processing function for pick-and-place printing."""
    use_trace_braid = bool(globals().get("braid", True))
    
    # --- 1. DIRECTORY & PATH MANAGEMENT ---
    project_dir = path
    printer_name = str(globals().get("printer", "")).strip().lower()
    
    # Determine file prefix, wipe location, and retraction amount based on printer type
    if printer_name == "prusa xl" or printer_name == "xl":
        file_prefix = "XL_"
        wipe_location = XL_WIPE_LOCATION
        retract_amount = 0.7
    elif printer_name == "prusa mini" or printer_name == "mini":
        file_prefix = "MINI_"
        wipe_location = MINI_WIPE_LOCATION
        retract_amount = 0
    else:
        file_prefix = ""
        wipe_location = XL_WIPE_LOCATION
        retract_amount = 0.5
    
    output_dir = os.path.join(project_dir, "output")
    snippet_dir = os.path.join(project_dir, "resources", "gcode_snippets")

    # Clean and recreate the output folder
    if os.path.exists(output_dir):
        shutil.rmtree(output_dir)
    os.makedirs(output_dir)

    # Define all file paths
    tray_3mf_path = os.path.join(output_dir, "tray.3mf")
    model_3mf_path = os.path.join(output_dir, "model.3mf")
    setup_gcode_path = os.path.join(output_dir, "setup.gcode")
    part_gcode_path = os.path.join(output_dir, "part.gcode")
    config_path = os.path.join(project_dir, "resources", f"{file_prefix}config.ini")
    final_output_path = os.path.join(output_dir, "combined_output.gcode")

    # --- 2. 3MF EXPORT STAGE ---
    def export_mesh_to_3mf(mesh_data, file_path):
        """Export a single mesh to 3MF format."""
        doc = Rhino.RhinoDoc.CreateHeadless(None)
        opts = Rhino.FileIO.File3mfWriteOptions()
        opts.Title = "Grasshopper Export"
        doc.Objects.AddMesh(mesh_data)
        success = doc.Export(file_path, opts.ToDictionary())
        doc.Dispose()
        return success

    def export_meshes_to_3mf(mesh_list, file_path):
        """Export a list of meshes to a single 3MF file."""
        doc = Rhino.RhinoDoc.CreateHeadless(None)
        opts = Rhino.FileIO.File3mfWriteOptions()
        opts.Title = "Grasshopper Export"
        combined = Rhino.Geometry.Mesh()
        for m in mesh_list:
            combined.Append(m)
        doc.Objects.AddMesh(combined)
        success = doc.Export(file_path, opts.ToDictionary())
        doc.Dispose()
        return success

    if export_mesh_to_3mf(tray, tray_3mf_path) and export_meshes_to_3mf(model, model_3mf_path):
        print("3MF Files Exported Successfully.")
    else:
        print("Failed to export 3MF files.")
        return

    # --- 3. SLICING STAGE ---
    def run_slicer(input_file, output_file):
        """Run PrusaSlicer on an input file."""
        cmd = [
            SLICER_PATH, "-s", "-g",
            "--load", config_path,
            "-o", output_file,
            input_file
        ]
        return subprocess.run(cmd, capture_output=True, text=True).stdout

    print("Slicing Setup...")
    run_slicer(tray_3mf_path, setup_gcode_path)
    print("Slicing Part...")
    run_slicer(model_3mf_path, part_gcode_path)

    # --- 4. G-CODE GENERATION FUNCTIONS ---
    def merge_config_with_overrides(base_config, embeddable_overrides):
        """
        Merge embeddable overrides with base config, handling type conversions.
        Non-prinjection_ keys override base config directly.
        Returns a merged config dict.
        """
        merged = dict(base_config)
        
        if not embeddable_overrides:
            return merged
        
        for key, value in embeddable_overrides.items():
            if key.startswith('prinjection_'):
                # Handle prinjection overrides
                prinjection_key = key[12:]  # Remove 'prinjection_' prefix (12 chars, not 11!)
                if 'prinjection' not in merged:
                    merged['prinjection'] = {}
                else:
                    merged['prinjection'] = dict(merged['prinjection'])
                
                # Try to convert to appropriate type
                try:
                    if prinjection_key in merged['prinjection']:
                        orig_val = merged['prinjection'][prinjection_key]
                        if isinstance(orig_val, bool):
                            merged['prinjection'][prinjection_key] = value.lower() in ('true', '1', 'yes')
                        elif isinstance(orig_val, int):
                            merged['prinjection'][prinjection_key] = int(float(value))
                        elif isinstance(orig_val, float):
                            merged['prinjection'][prinjection_key] = float(value)
                        else:
                            merged['prinjection'][prinjection_key] = value
                    else:
                        # Try to infer type
                        try:
                            merged['prinjection'][prinjection_key] = float(value)
                        except ValueError:
                            merged['prinjection'][prinjection_key] = value
                except Exception as e:
                    print(f"Warning: Could not parse prinjection override {key}={value}: {e}")
            else:
                # Handle regular config overrides
                try:
                    if key in merged:
                        orig_val = merged[key]
                        if isinstance(orig_val, bool):
                            merged[key] = value.lower() in ('true', '1', 'yes')
                        elif isinstance(orig_val, int):
                            merged[key] = int(float(value))
                        elif isinstance(orig_val, float):
                            merged[key] = float(value)
                        else:
                            merged[key] = value
                    else:
                        # Try to infer type
                        try:
                            merged[key] = float(value)
                        except ValueError:
                            merged[key] = value
                except Exception as e:
                    print(f"Warning: Could not parse override {key}={value}: {e}")
        
        return merged

    def perform_nozzle_wipe(writer, location, retract_amount=2.5):
        """Perform nozzle wipe sequence at specified location.
        
        Args:
            writer: GcodeWriter instance
            location: Tuple of (x, y, z) coordinates for wipe location
            retract_amount: Amount to retract before wipe movements (mm), default 2.5mm
        """
        writer.comment("Nozzle Wipe Sequence")
        wx, wy, wz = location
        
        # Move to wipe station
        writer.move_to(x=wx, y=wy, z=wz+10, feedrate=24000)
        writer.move_to(z=wz, feedrate=24000)
        writer.extrude(amount=10.0, feedrate=2400)
        writer.write_line("G4 P500")  # Dwell for 500ms
        
        # Retract before wipe movements
        writer.retract(amount=retract_amount)
        
        # Back and forth wipes
        for _ in range(1):
            writer.move_to(x=wx + 30, feedrate=12000)
            writer.move_to(x=wx, feedrate=12000)
        writer.move_to(x=wx + 30, feedrate=12000)
        
        # Clear and stay near wipe station; caller controls return/unretract timing.
        writer.move_to(z=wz+10, feedrate=24000)

    def perform_pick_and_place(writer, embeddable, embeddable_type):
        """
        Execute pick and place operation for an embeddable element.
        
        Args:
            writer: GcodeWriter instance
            embeddable: The embeddable object (TraceElement, Plug, or PCB) from C#
            embeddable_type: 'trace_braid', 'trace_cloth', 'plug', 'pcb', or 'print'
        """
        cfg = CONFIG[embeddable_type]
        
        # Merge embeddable-level overrides
        if hasattr(embeddable, 'Overrides') and embeddable.Overrides:
            cfg = merge_config_with_overrides(cfg, embeddable.Overrides)
        
        writer.comment(f"=== Pick and Place: {embeddable_type.upper()} ===")

        pick_pt = embeddable.PickPt
        place_pt = embeddable.PlacePt
        tamp_pts = embeddable.TampingPts or []

        # Lift nozzle
        writer.move_to(z=writer.state.current_z + 10, feedrate=cfg['z_lift_feedrate'])

        # Turn off part cooling fan to prevent blowing parts away
        writer.write_line("M107")

        # Wipe nozzle and retract
        perform_nozzle_wipe(writer, wipe_location, retract_amount)

        # === PICK SEQUENCE ===
        writer.comment("Pick Sequence")
        writer.move_to(x=pick_pt.X, y=pick_pt.Y, feedrate=cfg['travel_feedrate'])
        writer.move_to(z=pick_pt.Z + 10, feedrate=cfg['z_lift_feedrate'])
        writer.unretract(amount=retract_amount)
        
        # Pre-extrude step if configured
        if 'pick_pre_extrude_amount' in cfg and cfg['pick_pre_extrude_amount'] > 0:
            writer.move_to(z=pick_pt.Z, feedrate=cfg['z_lift_feedrate'])
            writer.extrude(amount=cfg['pick_pre_extrude_amount'], feedrate=cfg['pick_extrude_feedrate'])
            writer.move_to(z=pick_pt.Z + cfg['pick_z_offset'], feedrate=cfg['z_lift_feedrate'])
        else:
            writer.move_to(z=pick_pt.Z + cfg['pick_z_offset'], feedrate=cfg['z_lift_feedrate'])
        
        writer.extrude(amount=cfg['pick_extrude_amount'], feedrate=cfg['pick_extrude_feedrate'])
        
        writer.comment("Cooling to grab...")
        writer.set_extruder_temp(cfg['pick_cool_temp'], wait=True)
        pick_dwell_time = cfg.get('pick_dwell_time', 0)
        if pick_dwell_time > 0:
            writer.write_line(f"G4 P{pick_dwell_time}")

        # === PLACE SEQUENCE ===
        writer.comment("Place Sequence")
        writer.move_to(z=place_pt.Z + 10, feedrate=cfg['z_lift_feedrate'])
        writer.move_to(x=place_pt.X, y=place_pt.Y, feedrate=cfg['travel_feedrate'])
        
        if PLACE_HOVER_DWELL_TIME_MS > 0:
            writer.comment(f"Hover dwell before placing into cavity ({PLACE_HOVER_DWELL_TIME_MS} ms)")
            writer.write_line(f"G4 P{PLACE_HOVER_DWELL_TIME_MS}")
        
        # Pre-heat and place behavior
        if embeddable_type == 'pcb':
            # PCB-style: place cold, then release at wipe station
            writer.move_to(z=place_pt.Z + cfg['place_preheat_height'], feedrate=cfg['z_lift_feedrate'])
            writer.move_to(z=place_pt.Z + cfg['place_z_offset'], feedrate=cfg['place_feedrate'])
            writer.extrude(-1, feedrate=2000)
            writer.write_line(f"G4 P{cfg['place_dwell_time']}")
            
            # Move aside while still cold
            writer.comment("Moving aside while cold...")
            writer.move_to(x=place_pt.X + cfg.get('place_side_offset', 1.0), feedrate=cfg['travel_feedrate'])
            writer.extrude(-2.5, feedrate=2000)
            writer.move_to(z=place_pt.Z + 10, feedrate=cfg['z_lift_feedrate'])
            
            # Travel to wipe station, then heat to release
            wx, wy, wz = wipe_location
            writer.comment("Traveling to wipe station to release...")
            writer.move_to(x=wx, y=wy, z=wz + 10, feedrate=cfg['travel_feedrate'])
            writer.move_to(z=wz, feedrate=cfg['z_lift_feedrate'])
            writer.set_extruder_temp(cfg['place_heat_temp'], wait=True)
        elif embeddable_type == 'print':
            # Print-style: place cold, heat to print temperature, then shear move to release.
            writer.move_to(z=place_pt.Z + cfg['place_preheat_height'], feedrate=cfg['z_lift_feedrate'])
            writer.move_to(z=place_pt.Z + cfg['place_z_offset'], feedrate=cfg['place_feedrate'])
            writer.extrude(-1, feedrate=2000)
            writer.comment("Heating to release...")
            writer.set_extruder_temp(cfg['place_heat_temp'], wait=True)
        elif cfg['place_preheat_height'] > 0:
            # Plug/PCB-style: pre-heat above the place point, then press down
            writer.move_to(z=place_pt.Z + cfg['place_preheat_height'], feedrate=cfg['z_lift_feedrate'])
            writer.comment("Preheating before placement...")
            writer.set_extruder_temp(cfg['place_heat_temp'], wait=True)
            writer.move_to(z=place_pt.Z + cfg['place_z_offset'], feedrate=cfg['place_feedrate'])
            writer.extrude(-1, feedrate=2000)
        else:
            # Trace-style: pre-heat at the final place position
            writer.move_to(z=place_pt.Z + cfg['place_z_offset'], feedrate=cfg['place_feedrate'])
            writer.comment("Heating to release...")
            writer.set_extruder_temp(cfg['place_heat_temp'], wait=True)
        
        writer.write_line(f"G4 P{cfg['place_dwell_time']}")
        
        # Print-specific: perform a shear move to release the part
        if embeddable_type == 'print' and 'place_side_offset' in cfg:
            writer.comment("Shear moving aside to release...")
            writer.move_to(z=place_pt.Z, feedrate=cfg.get('post_place_lift_feedrate', cfg['z_lift_feedrate']))
            writer.move_to(x=place_pt.X + cfg['place_side_offset'], feedrate=cfg['travel_feedrate'])

        # Prinjection sequence for PCB
        if embeddable_type == 'pcb':
            if hasattr(embeddable, 'PrinjectionPoints') and embeddable.PrinjectionPoints and len(list(embeddable.PrinjectionPoints)) > 0:
                writer.comment("Starting Prinjection Sequence for PCB holes")
                
                # Perform an interim wipe to clear oozing after heating up
                perform_nozzle_wipe(writer, wipe_location, retract_amount)
                
                prinjection_cfg = cfg['prinjection']
                
                # Turn cooling fan back on during prinjection if desired (optional, maybe leave it off)
                writer.write_line("M106")
                
                # Unretract after wipe. Note we map the main parameter first to neutralise the manual system retract, 
                # then shift to local prinjection cfg length for inter-hole stringing mitigation.
                writer.unretract(amount=retract_amount)
                writer.retract(amount=prinjection_cfg['retract_amount'])
                
                is_first_hole = True
                
                for hole_idx, pt in enumerate(list(embeddable.PrinjectionPoints)):
                    # Extract position from PrinjectionPoint object
                    hole_pos = pt.Position
                    
                    # Merge point-level overrides (takes precedence over embeddable-level prinjection config)
                    pt_prinjection_cfg = dict(prinjection_cfg)
                    
                    # DEBUG: Check if Overrides exist
                    has_overrides = hasattr(pt, 'Overrides') and pt.Overrides
                    overrides_count = len(pt.Overrides) if has_overrides else 0
                    print(f"[DEBUG] Hole {hole_idx}: hasattr(pt, 'Overrides')={hasattr(pt, 'Overrides')}, overrides_count={overrides_count}")
                    
                    if has_overrides:
                        print(f"[DEBUG]   Overrides dict keys: {list(pt.Overrides.keys())}")
                        for key, value in pt.Overrides.items():
                            print(f"[DEBUG]   Processing override: {key}={value}")
                            if key.startswith('prinjection_'):
                                prinjection_key = key[12:]  # Remove 'prinjection_' prefix (12 chars, not 11!)
                                print(f"[DEBUG]     Stripped key: {prinjection_key}")
                                try:
                                    if prinjection_key in pt_prinjection_cfg:
                                        orig_val = pt_prinjection_cfg[prinjection_key]
                                        print(f"[DEBUG]     Found in cfg, orig_val={orig_val} (type={type(orig_val).__name__})")
                                        if isinstance(orig_val, bool):
                                            pt_prinjection_cfg[prinjection_key] = value.lower() in ('true', '1', 'yes')
                                        elif isinstance(orig_val, int):
                                            pt_prinjection_cfg[prinjection_key] = int(float(value))
                                        elif isinstance(orig_val, float):
                                            pt_prinjection_cfg[prinjection_key] = float(value)
                                        else:
                                            pt_prinjection_cfg[prinjection_key] = value
                                        print(f"[DEBUG]     Updated to: {pt_prinjection_cfg[prinjection_key]}")
                                    else:
                                        print(f"[DEBUG]     NOT found in cfg")
                                        try:
                                            pt_prinjection_cfg[prinjection_key] = float(value)
                                        except ValueError:
                                            pt_prinjection_cfg[prinjection_key] = value
                                except Exception as e:
                                    print(f"Warning: Could not parse point prinjection override {key}={value}: {e}")
                    
                    print(f"[DEBUG]   Final extrude_amount for hole {hole_idx}: {pt_prinjection_cfg['extrude_amount']}")
                    
                    # Hover over the hole
                    hover_z = hole_pos.Z + pt_prinjection_cfg['hover_z_offset']
                    target_z = hole_pos.Z + pt_prinjection_cfg['inject_z_offset']
                    
                    # Move to hover position
                    writer.move_to(x=hole_pos.X, y=hole_pos.Y, feedrate=cfg['travel_feedrate'])
                    writer.move_to(z=hover_z, feedrate=cfg['z_lift_feedrate'])
                    
                    # Lower to injection point at a normal speed instead of the slow place speed
                    writer.move_to(z=target_z, feedrate=cfg['z_lift_feedrate'])
                    
                    # Unretract from previous hole or initial wipe if retract_amount from config matches what was pulled
                    unretract_amt = pt_prinjection_cfg['retract_amount']
                    if is_first_hole and 'initial_extra_prime' in pt_prinjection_cfg:
                        unretract_amt += pt_prinjection_cfg['initial_extra_prime']
                        is_first_hole = False
                        
                    writer.unretract(amount=unretract_amt)
                    
                    # Inject filament
                    writer.extrude(amount=pt_prinjection_cfg['extrude_amount'], feedrate=pt_prinjection_cfg['extrude_feedrate'])
                    
                    # Retract and lift
                    writer.retract(amount=pt_prinjection_cfg['retract_amount'])
                    
                    # If we injected below the swipe offset, lift to the swipe offset first
                    if pt_prinjection_cfg['inject_z_offset'] < pt_prinjection_cfg['swipe_z_offset']:
                        writer.move_to(z=hole_pos.Z + pt_prinjection_cfg['swipe_z_offset'], feedrate=cfg['place_feedrate'])

                    # Do a little side swipe to break the string
                    writer.comment("Side swipe to break stringing")
                    writer.move_to(x=hole_pos.X + 1.5, y=hole_pos.Y + 1.5, feedrate=cfg['travel_feedrate'])
                    
                    # Quick lift to hover z
                    writer.move_to(z=hover_z, feedrate=cfg['z_lift_feedrate'])
                    
                # Turn cooling fan back off if we turned it on
                writer.write_line("M107")

        elif embeddable_type == 'print' and 'place_side_offset' in cfg:
            # Print-specific: lift, move to wipe station, and cool to wipe temp
            writer.extrude(-2.5, feedrate=2000)
            writer.move_to(z=place_pt.Z + 10, feedrate=cfg.get('post_place_lift_feedrate', cfg['z_lift_feedrate']))
            
            wx, wy, wz = wipe_location
            writer.comment("Moving to wipe location before adjusting temp...")
            writer.move_to(x=wx, y=wy, feedrate=cfg['travel_feedrate'])
            writer.comment(f"Cooling down to wipe temp ({cfg.get('wipe_temp', 210)})...")
            writer.set_extruder_temp(cfg.get('wipe_temp', 210), wait=True)

        else:
            writer.extrude(-2.5, feedrate=2000)
            writer.move_to(z=place_pt.Z + 2, feedrate=cfg['z_lift_feedrate'])

        # === TAMPING SEQUENCE ===
        if tamp_pts and len(tamp_pts) > 0:
            writer.comment(f"Tamping {len(tamp_pts)} Points")
            tamp_cfg = CONFIG['tamping']
            
            for tamp_pt in tamp_pts:
                # Access TampingPoint properties from C#
                position = tamp_pt.Position
                tamp_type = int(tamp_pt.Type)
                
                # Get type-specific parameters from Python CONFIG
                type_cfg = dict(tamp_cfg[tamp_type])
                
                # Merge point-level overrides (takes precedence over embeddable-level)
                if hasattr(tamp_pt, 'Overrides') and tamp_pt.Overrides:
                    for key, value in tamp_pt.Overrides.items():
                        # Skip prinjection_ prefix for tamping points
                        if not key.startswith('prinjection_'):
                            try:
                                if key in type_cfg:
                                    orig_val = type_cfg[key]
                                    if isinstance(orig_val, bool):
                                        type_cfg[key] = value.lower() in ('true', '1', 'yes')
                                    elif isinstance(orig_val, int):
                                        type_cfg[key] = int(float(value))
                                    elif isinstance(orig_val, float):
                                        type_cfg[key] = float(value)
                                    else:
                                        type_cfg[key] = value
                                else:
                                    try:
                                        type_cfg[key] = float(value)
                                    except ValueError:
                                        type_cfg[key] = value
                            except Exception as e:
                                print(f"Warning: Could not parse tamping point override {key}={value}: {e}")
                
                depth_offset = type_cfg['depth_offset']
                
                # Perform tamping motion
                writer.move_to(x=position.X, y=position.Y, feedrate=tamp_cfg['travel_feedrate'])
                writer.move_to(z=position.Z - depth_offset, feedrate=type_cfg['feedrate'])
                writer.write_line(f"G4 P{type_cfg['dwell_time']}")
                writer.move_to(z=position.Z + tamp_cfg['lift_height'], feedrate=tamp_cfg['lift_feedrate'])

        # Turn part cooling fan back on
        writer.write_line("M106")

    # --- 5. FINAL G-CODE ASSEMBLY ---
    with GcodeWriter(final_output_path) as writer:
        # Write preamble
        with open(os.path.join(snippet_dir, f"{file_prefix}preamble.gcode"), "r") as f:
            for line in f:
                writer.write_line(line.rstrip())

        # Write setup G-code (skip preamble, start from layer change)
        with open(setup_gcode_path, "r") as f:
            lines = f.readlines()
            start_idx = next((i for i, l in enumerate(lines) if ";LAYER_CHANGE" in l), 0)
            for line in lines[start_idx:]:
                writer.write_line(line.rstrip())

        last_setup_z = writer.state.current_z
        writer.pause()
        post_pause_position = writer.state.position
        perform_nozzle_wipe(writer, wipe_location, retract_amount)
        writer.move_to(x=post_pause_position.x, y=post_pause_position.y, z=post_pause_position.z, feedrate=24000)
        writer.unretract(amount=retract_amount)

        # Process part G-code with dynamic pick and place insertion
        writer.state.current_layer = 0
        z_has_been_adjusted = False
        part_start_prime_done = False
        completed_embeddable_indices = set()

        def get_embeddable_type(embeddable):
            """Resolve embeddable type from CLR object shape/name."""
            type_name = ""
            if hasattr(embeddable, 'GetType'):
                try:
                    type_name = str(embeddable.GetType().Name).lower()
                except Exception:
                    type_name = ""

            if type_name == 'print':
                return 'print'
            if hasattr(embeddable, 'Radius'):
                return 'plug'
            if hasattr(embeddable, 'Geometry'):
                return 'pcb'
            return 'trace_braid' if use_trace_braid else 'trace_cloth'

        def process_layer_embeddables(layer_embeddables, context_label):
            """Run pick-and-place for a list of (index, embeddable) pairs."""
            if not layer_embeddables:
                return

            writer.comment(f"=== {context_label} ===")

            # Save current position and pressure advance before pick and place operations
            saved_position = writer.state.position
            saved_pa = writer.get_pressure_advance()

            # Disable pressure advance for pick and place operations
            writer.set_pressure_advance(extruder=saved_pa[0], value=0.0)

            # Process all embeddables for this insertion point
            for i, embeddable in layer_embeddables:
                embeddable_type = get_embeddable_type(embeddable)

                writer.comment(f"Placing {embeddable_type.upper()} #{i+1}")
                perform_pick_and_place(writer, embeddable, embeddable_type)
                completed_embeddable_indices.add(i)

            # After all placements, wipe and return to saved position
            perform_nozzle_wipe(writer, wipe_location, retract_amount)
            writer.move_to(x=saved_position.x, y=saved_position.y, z=saved_position.z + 10, feedrate=6000)
            writer.unretract(amount=retract_amount)

            # Restore pressure advance
            writer.set_pressure_advance(extruder=saved_pa[0], value=saved_pa[1], time_range=saved_pa[2])

        with open(part_gcode_path, "r") as f:
            part_lines = f.readlines()
            start_idx = next((i for i, l in enumerate(part_lines) if ";LAYER_CHANGE" in l), 0)

            # Find where post-print footer begins (after last printable moves).
            end_section_idx = next(
                (i for i in range(start_idx, len(part_lines)) if part_lines[i].rstrip().startswith(";TYPE:Custom")),
                None
            )

            # Determine the number of printable layers from layer-change markers.
            max_layer_in_part = sum(1 for l in part_lines[start_idx:] if l.rstrip().startswith(";LAYER_CHANGE"))
            print(f"Detected {max_layer_in_part} printable layers in part.gcode")
            if end_section_idx is not None:
                print(f"Late-placement anchor found at line {end_section_idx + 1} (;TYPE:Custom)")
            
            for line_idx in range(start_idx, len(part_lines)):
                line = part_lines[line_idx]
                clean_line = line.rstrip()

                # Insert any remaining operations right before the end/custom section.
                if end_section_idx is not None and line_idx == end_section_idx:
                    pending_embeddables = [
                        (i, embeddable) for i, embeddable in enumerate(operations)
                        if i not in completed_embeddable_indices
                    ]
                    if pending_embeddables:
                        print(
                            f"Inserting {len(pending_embeddables)} late operation(s) after last print layer "
                            f"(current layer={writer.state.current_layer}, max layer={max_layer_in_part})."
                        )
                        process_layer_embeddables(pending_embeddables, "Late Placement After Last Print Move")
                
                # Check for layer change to trigger pick and place
                if clean_line.startswith(";LAYER_CHANGE"):
                    writer.write_line(clean_line)
                    
                    # Find all embeddables scheduled for this layer
                    layer_embeddables = [
                        (i, embeddable) for i, embeddable in enumerate(operations)
                        if writer.state.current_layer == embeddable.PauseLayer and i not in completed_embeddable_indices
                    ]
                    
                    if layer_embeddables:
                        process_layer_embeddables(layer_embeddables, f"Layer {writer.state.current_layer} Placement")
                    
                    continue

                # Adjust the very first Z-move to be relative to the previous setup height
                if not z_has_been_adjusted and "G1" in clean_line and "Z" in clean_line:
                    adjusted_z = last_setup_z + PART_START_Z_HOP
                    clean_line = re.sub(r'Z[\d\.]+', f'Z{adjusted_z:.1f}', clean_line)
                    z_has_been_adjusted = True
                
                writer.write_line(clean_line)

                # One-time extra prime at part start to recover from transition ooze.
                if (not part_start_prime_done
                    and z_has_been_adjusted
                    and re.match(r'^G1\s+E\.?8\b', clean_line)):
                    writer.comment("Part-start extra prime")
                    writer.write_line(f"G1 E{PART_START_EXTRA_PRIME:.2f} F1500")
                    part_start_prime_done = True

        # Fallback: if no explicit end marker was found, append any still-pending operations now.
        final_pending_embeddables = [
            (i, embeddable) for i, embeddable in enumerate(operations)
            if i not in completed_embeddable_indices
        ]
        if final_pending_embeddables:
            print(f"Appending {len(final_pending_embeddables)} fallback late operation(s) at end of part stream.")
            process_layer_embeddables(final_pending_embeddables, "Fallback Late Placement")

        # Write end snippet
        with open(os.path.join(snippet_dir, f"{file_prefix}end.gcode"), "r") as f:
            for line in f:
                writer.write_line(line.rstrip())

    print("Process Complete. Final G-Code saved in output folder.")


if run:
    process_print()
# ---------- end py3 ----------
sp_2 = ScriptParasite2(Enable=Toggle(True), Path=panel_15, TargetComponent=py3)
panel_21 = Panel(c_script_2.out)
panel_22 = Panel("""C:\Users\Oliver\OneDrive - University of Bristol\PhD\UIST 2026 Print Place Printegrate\Designer\resources\xl_bed.stl
C:\Users\Oliver\OneDrive - University of Bristol\PhD\UIST 2026 Print Place Printegrate\Designer\resources\mini_bed.stl""")
panel_23 = Panel(sp_2)
panel_24 = Panel(py3.out)
keysearch = KeyValueSearch(Keys=panel_16, Values=panel_22, Search=values_3.Values)
panel_25 = Panel("C:\Users\Oliver\OneDrive - University of Bristol\PhD\UIST 2026 Print Place Printegrate\Designer\Scripts")
c_script_3 = CSharpScript(filePath=keysearch)  # -> out, a; inputs filePath: String, offset: Double
# ---------- c_script_3: C# ----------
// Grasshopper Script Instance
#region Usings
using System;
using System.Linq;
using System.Collections;
using System.Collections.Generic;
using System.Drawing;

using Rhino;
using Rhino.Geometry;

using Grasshopper;
using Grasshopper.Kernel;
using Grasshopper.Kernel.Data;
using Grasshopper.Kernel.Types;
#endregion

public class Script_Instance : GH_ScriptInstance
{
    #region Notes
    /* 
      Members:
        RhinoDoc RhinoDocument
        GH_Document GrasshopperDocument
        IGH_Component Component
        int Iteration

      Methods (Virtual & overridable):
        Print(string text)
        Print(string format, params object[] args)
        Reflect(object obj)
        Reflect(object obj, string method_name)
    */
    #endregion

    private void RunScript(string filePath, double offset, ref object a)
        {
            if (string.IsNullOrEmpty(filePath) || !System.IO.File.Exists(filePath)) return;

            // 1. Reference the active Rhino Document
            RhinoDoc doc = RhinoDoc.ActiveDoc;

            // 2. Manage the "Print Bed" Layer
            string layerName = "Print Bed";
            int layerIndex = doc.Layers.Find(layerName, true);

            if (layerIndex != -1)
            {
                // Layer exists: Find and delete all objects on it
                var rhinoObjects = doc.Objects.FindByLayer(layerName);
                if (rhinoObjects != null)
                {
                    foreach (var obj in rhinoObjects)
                    {
                        doc.Objects.Delete(obj, true);
                    }
                }
            }
            else
            {
                // Layer doesn't exist: Create it
                Rhino.DocObjects.Layer newLayer = new Rhino.DocObjects.Layer();
                newLayer.Name = layerName;
                newLayer.Color = System.Drawing.Color.Cyan;
                layerIndex = doc.Layers.Add(newLayer);
            }

            // 3. Import the STL
            // We use a scripted command to ensure it goes directly to the active layer
            doc.Layers.SetCurrentLayerIndex(layerIndex, true);
            
            // Formatting the string for the Rhino command
            string command = string.Format("_-Import \"{0}\" _Enter", filePath);
            RhinoApp.RunScript(command, false);

            a = "Import Successful on " + DateTime.Now.ToString("HH:mm:ss");
        }
}
# ---------- end c_script_3 ----------
sp_3 = ScriptParasite2(
    Enable=Toggle(True),
    Path="C:\Users\Oliver\OneDrive - University of Bristol\PhD\UIST 2026 Print Place Printegrate\Designer\Scripts",
    TargetComponent=c_script_3)
brep_2 = Brep(geo_3)
c_script_4 = CSharpScript(brepGeometry=brep_2, LayerIndex=values.Values, S=values_2.Values, clear=Toggle(False))  # -> out, A, Layer; inputs brepGeometry: list of Brep, LayerIndex: Int32, S: Double, tracePoints: list of Point3d, clear: Boolean
# ---------- c_script_4: C# ----------
// Main Pick Place Logic Script
// Handles geometry generation, positioning, intersections, and tray layout
// This one hello

using System;
using System.Linq;
using System.Collections.Generic;
using Rhino;
using Rhino.DocObjects;
using Rhino.Geometry;
using Rhino.Geometry.Intersect;
using Grasshopper.Kernel;
using Grasshopper;
using Grasshopper.Kernel.Data;

// ============================================================================
// ENUMS AND DATA STRUCTURES
// ============================================================================

/// <summary>
/// Types of tamping points based on intersection context
/// </summary>
public enum TampingType
{
    End,          // Tamping points at the ends of traces
    TraceTrace,   // Tamping points at trace-trace intersections
    TracePlug,    // Tamping points at trace-plug intersections
    TracePCB      // Tamping points at trace-PCB intersections
}

/// <summary>
/// Represents a single tamping point with position and type
/// Depth offset is managed by Python G-code generation
/// </summary>
public class TampingPoint
{
    public Point3d Position { get; set; }
    public TampingType Type { get; set; }
    public Dictionary<string, string> Overrides { get; set; }
    
    public TampingPoint(Point3d position, TampingType type)
    {
        Position = position;
        Type = type;
        Overrides = new Dictionary<string, string>();
    }

    /// <summary>
    /// Parse user text string in format "key1=value1;key2=value2" into the Overrides dictionary
    /// </summary>
    public void ParseOverridesFromUserText(string userText)
    {
        if (string.IsNullOrWhiteSpace(userText))
            return;

        var pairs = userText.Split(new[] { ';' }, System.StringSplitOptions.RemoveEmptyEntries);
        foreach (var pair in pairs)
        {
            var kv = pair.Split(new[] { '=' }, System.StringSplitOptions.RemoveEmptyEntries);
            if (kv.Length == 2)
            {
                string key = kv[0].Trim();
                string value = kv[1].Trim();
                Overrides[key] = value;
            }
        }
    }
}

/// <summary>
/// Represents a single prinjection point (PCB hole) with position and customizable parameters
/// Per-hole overrides are managed by Python G-code generation
/// </summary>
public class PrinjectionPoint
{
    public Point3d Position { get; set; }
    public Dictionary<string, string> Overrides { get; set; }
    
    public PrinjectionPoint(Point3d position)
    {
        Position = position;
        Overrides = new Dictionary<string, string>();
    }

    /// <summary>
    /// Parse user text string in format "key1=value1;key2=value2" into the Overrides dictionary
    /// Typically used for prinjection_extrude_amount, prinjection_inject_z_offset, etc.
    /// </summary>
    public void ParseOverridesFromUserText(string userText)
    {
        if (string.IsNullOrWhiteSpace(userText))
            return;

        var pairs = userText.Split(new[] { ';' }, System.StringSplitOptions.RemoveEmptyEntries);
        foreach (var pair in pairs)
        {
            var kv = pair.Split(new[] { '=' }, System.StringSplitOptions.RemoveEmptyEntries);
            if (kv.Length == 2)
            {
                string key = kv[0].Trim();
                string value = kv[1].Trim();
                Overrides[key] = value;
            }
        }
    }
}

/// <summary>
/// Represents a contact point (embedGeometry point) for trace-PCB intersections
/// Per-point overrides customize tamping behavior where traces cross PCB contact points
/// </summary>
public class ContactPoint
{
    public Point3d Position { get; set; }
    public Dictionary<string, string> Overrides { get; set; }
    
    public ContactPoint(Point3d position)
    {
        Position = position;
        Overrides = new Dictionary<string, string>();
    }

    /// <summary>
    /// Parse user text string in format "key1=value1;key2=value2" into the Overrides dictionary
    /// Typically used for depth_offset, feedrate, dwell_time for trace-PCB tamping
    /// </summary>
    public void ParseOverridesFromUserText(string userText)
    {
        if (string.IsNullOrWhiteSpace(userText))
            return;

        var pairs = userText.Split(new[] { ';' }, System.StringSplitOptions.RemoveEmptyEntries);
        foreach (var pair in pairs)
        {
            var kv = pair.Split(new[] { '=' }, System.StringSplitOptions.RemoveEmptyEntries);
            if (kv.Length == 2)
            {
                string key = kv[0].Trim();
                string value = kv[1].Trim();
                Overrides[key] = value;
            }
        }
    }
}

// ============================================================================
// ABSTRACT BASE CLASS
// ============================================================================

/// <summary>
/// Base class for all embeddable elements (traces and plugs)
/// </summary>
public abstract class Embeddable
{
    public Point3d PickPt { get; protected set; }
    public Point3d PlacePt { get; protected set; }
    public Point3d PreferredPickPoint { get; private set; }
    public bool HasPreferredPickPoint { get; private set; }
    public List<TampingPoint> TampingPts { get; protected set; }
    public double PickTemperature { get; protected set; }
    public int PauseLayer { get; protected set; }
    public double PickupExtrusionMultiplier { get; protected set; }
    public Dictionary<string, string> Overrides { get; set; }

    public abstract void CalcIntersections(List<Embeddable> allEmbeddables);
    public abstract void CalculatePickPlace(Point3d pickCentre);

    protected Embeddable()
    {
        TampingPts = new List<TampingPoint>();
        PickPt = Point3d.Unset;
        PlacePt = Point3d.Unset;
        PreferredPickPoint = Point3d.Unset;
        HasPreferredPickPoint = false;
        PickupExtrusionMultiplier = 1.0;
        Overrides = new Dictionary<string, string>();
    }

    public void SetPreferredPickPoint(Point3d point)
    {
        PreferredPickPoint = point;
        HasPreferredPickPoint = true;
    }

    /// <summary>
    /// Parse user text string in format "key1=value1;key2=value2" into the Overrides dictionary
    /// Trims whitespace around keys and values
    /// </summary>
    public void ParseOverridesFromUserText(string userText)
    {
        if (string.IsNullOrWhiteSpace(userText))
            return;

        var pairs = userText.Split(new[] { ';' }, System.StringSplitOptions.RemoveEmptyEntries);
        foreach (var pair in pairs)
        {
            var kv = pair.Split(new[] { '=' }, System.StringSplitOptions.RemoveEmptyEntries);
            if (kv.Length == 2)
            {
                string key = kv[0].Trim();
                string value = kv[1].Trim();
                Overrides[key] = value;
            }
        }
    }
}

// ============================================================================
// CONCRETE IMPLEMENTATIONS
// ============================================================================

/// <summary>
/// Represents a conductive trace element with pick/place/tamp logic
/// </summary>
public class TraceElement : Embeddable
{
    // Public properties
    public double Length { get; private set; }
    public bool IsHorizontal { get; private set; }
    public double Width { get; private set; }
    public double Height { get; private set; }
    public List<Point3d> Intersections = new List<Point3d>();
    public Line ModelLine;
    public Brep ModelBox;
    public Curve TrayCurve;
    public List<string> SafePickDebugLog { get; private set; }
    
    // Static list of contact points (populated from embedGeometry points)
    public static List<ContactPoint> ContactPoints = new List<ContactPoint>();
    
    // Private fields
    private double traceHeight;
    private double traceWidth;
    private double safeDistAlongLine;

    /// <summary>
    /// Check if a line is perpendicular (horizontal or vertical)
    /// </summary>
    public static bool IsPerpendicular(Line line, out bool isHorizontal)
    {
        Vector3d dir = line.Direction;
        dir.Unitize();
        
        double angleThreshold = 0.01; // ~0.57 degrees tolerance
        isHorizontal = Math.Abs(dir.Y) < angleThreshold;
        bool isVertical = Math.Abs(dir.X) < angleThreshold;
        
        return isHorizontal || isVertical;
    }
    
    /// <summary>
    /// Create an extruded box from a line (for bad geometry visualization)
    /// </summary>
    public static Brep CreateBadGeometryBox(Line line, double width, double height, double endOffset)
    {
        Vector3d dir = line.Direction;
        dir.Unitize();
        double endExtension = width / 2.0 + endOffset;
        Point3d extendedFrom = line.From - dir * endExtension;
        Point3d extendedTo = line.To + dir * endExtension;
        Line extendedLine = new Line(extendedFrom, extendedTo);
        
        Vector3d perp = Vector3d.CrossProduct(extendedLine.Direction, Vector3d.ZAxis);
        perp.Unitize();
        perp *= width / 2.0;
        
        Point3d[] corners = new Point3d[4];
        corners[0] = extendedLine.From + perp;
        corners[1] = extendedLine.To + perp;
        corners[2] = extendedLine.To - perp;
        corners[3] = extendedLine.From - perp;
        
        Polyline poly = new Polyline(corners);
        poly.Add(corners[0]);
        Curve crv = poly.ToNurbsCurve();
        
        if (crv.ClosedCurveOrientation(Vector3d.ZAxis) == CurveOrientation.Clockwise)
            crv.Reverse();
        
        return Extrusion.Create(crv, height, true).ToBrep();
    }

    public TraceElement(Line line, double width, double height, double layerHeight, double endOffset)
    {
        this.SafePickDebugLog = new List<string>();
        // Check if line is perpendicular (horizontal or vertical) BEFORE any processing
        Vector3d dir = line.Direction;
        dir.Unitize();
        
        double angleThreshold = 0.01; // ~0.57 degrees tolerance
        bool isHorizontal = Math.Abs(dir.Y) < angleThreshold;
        bool isVertical = Math.Abs(dir.X) < angleThreshold;
        
        if (!isHorizontal && !isVertical)
        {
            throw new Exception("TraceElement constructor called with non-perpendicular line. Use IsPerpendicular() to check first.");
        }
        
        // Extend by half trace width plus extra side offset on each end.
        double endExtension = width / 2.0 + endOffset;
        Point3d extendedFrom = line.From - dir * endExtension;
        Point3d extendedTo = line.To + dir * endExtension;
        Line extendedLine = new Line(extendedFrom, extendedTo);
        
        this.ModelLine = extendedLine;
        this.Length = extendedLine.Length;
        this.Height = height;
        this.Width = width;
        this.traceHeight = height;
        this.traceWidth = width;
        this.IsHorizontal = isHorizontal;
        this.PauseLayer = (int)Math.Round(extendedLine.FromZ / layerHeight) + 1;
        this.ModelBox = CreateBoxFromLine(extendedLine, width, height);
        this.PickTemperature = 210;
        
        // Add tamping points, ensuring they are at least 1.0mm away from the extreme ends
        double tampInset = Math.Max(1.0 - endExtension, 0.0);
        if (line.Length >= Math.Max(width, tampInset * 2.0))
        {
            Point3d startTamp = line.From + dir * tampInset;
            Point3d endTamp = line.To - dir * tampInset;
            this.TampingPts.Add(new TampingPoint(startTamp, TampingType.End));
            this.TampingPts.Add(new TampingPoint(endTamp, TampingType.End));
        }
    }

    public override void CalcIntersections(List<Embeddable> allEmbeddables)
    {
        // Find embeddables one layer below this trace or on the same layer
        double targetZ = Math.Round(this.ModelLine.FromZ - this.traceHeight, 4);
        double thisZ = Math.Round(this.ModelLine.FromZ, 4);
        int thisIndex = allEmbeddables.IndexOf(this);
        
        foreach (var embeddable in allEmbeddables)
        {
            // Check Trace-Trace intersections
            if (embeddable is TraceElement otherTrace && embeddable != this)
            {
                double otherZ = Math.Round(otherTrace.ModelLine.FromZ, 4);
                bool isLayerBelow = Math.Abs(otherZ - targetZ) < 0.001;
                bool isSameLayer = Math.Abs(otherZ - thisZ) < 0.001;

                // For same layer intersections, only tamp if the other trace was placed BEFORE this one
                if (isLayerBelow || (isSameLayer && allEmbeddables.IndexOf(otherTrace) < thisIndex))
                {
                    Point3d intersectPt;
                    if (TryGetIntersection(this.ModelLine, otherTrace.ModelLine, this.traceWidth, out intersectPt))
                    {
                        // Use the appropriate Z level for Intersections list
                        double intersectZ = isSameLayer ? thisZ : targetZ;
                        Point3d correctedPt = new Point3d(intersectPt.X, intersectPt.Y, intersectZ);
                        this.Intersections.Add(correctedPt);
                        
                        // Add to tamping points at this line's Z height
                        Point3d tampPt = new Point3d(intersectPt.X, intersectPt.Y, this.ModelLine.FromZ);
                        this.TampingPts.Add(new TampingPoint(tampPt, TampingType.TraceTrace));
                    }
                }
            }
            // Check Trace-Plug intersections
            else if (embeddable is Plug plug)
            {
                double plugZ = Math.Round(plug.PlacePt.Z, 4);
                if (Math.Abs(plugZ - targetZ) < 0.001)
                {
                    // Check if trace line passes through plug location (2D check at Z level)
                    Point3d plug2D = new Point3d(plug.PlacePt.X, plug.PlacePt.Y, 0);
                    Line trace2D = new Line(
                        new Point3d(this.ModelLine.FromX, this.ModelLine.FromY, 0),
                        new Point3d(this.ModelLine.ToX, this.ModelLine.ToY, 0)
                    );
                    
                    double t = trace2D.ClosestParameter(plug2D);
                    if (t >= -0.01 && t <= 1.01)
                    {
                        Point3d closestPt = trace2D.PointAt(t);
                        double dist = closestPt.DistanceTo(plug2D);
                        
                        // If trace passes within width/2 of plug center, it intersects
                        if (dist < this.traceWidth / 2.0 + 0.001)
                        {
                            // Add intersection at the plug's Z level
                            Point3d intersectPt = new Point3d(closestPt.X, closestPt.Y, plug.PlacePt.Z);
                            this.Intersections.Add(intersectPt);
                            
                            // Add to tamping points at this line's Z height
                            Point3d tampPt = new Point3d(closestPt.X, closestPt.Y, this.ModelLine.FromZ);
                            this.TampingPts.Add(new TampingPoint(tampPt, TampingType.TracePlug));
                        }
                    }
                }
            }
        }
        
        // Check Trace-ContactPoint intersections
        double traceTopZ = this.ModelLine.FromZ;
        double traceBottomZ = this.ModelLine.FromZ - this.traceHeight - 0.01;
        
        foreach (ContactPoint contactPt in ContactPoints)
        {
            Point3d contactPos = contactPt.Position;
            // Check if contact point Z is within the trace's vertical range
            if (contactPos.Z <= traceTopZ && contactPos.Z >= traceBottomZ)
            {
                // Check if contact point is on/near the trace line (2D check)
                Point3d contact2D = new Point3d(contactPos.X, contactPos.Y, 0);
                Line trace2D = new Line(
                    new Point3d(this.ModelLine.FromX, this.ModelLine.FromY, 0),
                    new Point3d(this.ModelLine.ToX, this.ModelLine.ToY, 0)
                );
                
                double t = trace2D.ClosestParameter(contact2D);
                if (t >= -0.01 && t <= 1.01)
                {
                    Point3d closestPt = trace2D.PointAt(t);
                    double dist = closestPt.DistanceTo(contact2D);
                    
                    // If contact point is within trace width
                    if (dist < this.traceWidth / 2.0 + 0.001)
                    {
                        // Add intersection at the contact point's Z level
                        this.Intersections.Add(contactPos);
                        
                        // Add tamping point at this trace's Z height
                        Point3d tampPt = new Point3d(contactPos.X, contactPos.Y, this.ModelLine.FromZ);
                        TampingPoint tp = new TampingPoint(tampPt, TampingType.TracePCB);
                        // Copy contact point overrides to tamping point
                        if (contactPt.Overrides != null)
                        {
                            foreach (var kvp in contactPt.Overrides)
                            {
                                tp.Overrides[kvp.Key] = kvp.Value;
                            }
                        }
                        this.TampingPts.Add(tp);
                    }
                }
            }
        }
        
        // Remove end tamping points that are within 3mm of any intersection tamping point
        var intersectionTamps = this.TampingPts.Where(t => t.Type != TampingType.End).ToList();
        this.TampingPts.RemoveAll(t => 
            t.Type == TampingType.End && 
            intersectionTamps.Any(ip => t.Position.DistanceTo(ip.Position) <= 3.0)
        );
    }

    public void CalculateSafePickDistance(List<Brep> partGeometry = null)
    {
        SafePickDebugLog.Clear();

        double L = this.Length;
        double mid = L / 2.0;
        
        // Convert 3D intersection points to 1D distances along the line
        List<double> intersectDistances = Intersections.Select(pt => ModelLine.From.DistanceTo(pt)).ToList();

        // 1. Generate a discrete set of candidates radiating outward from the midpoint
        HashSet<double> candidateSet = new HashSet<double>();
        candidateSet.Add(mid);
        
        double step = 0.5; // 0.5mm physical increments
        int steps = (int)((L / step) / 2.0) + 1;
        for (int i = 1; i <= steps; i++)
        {
            candidateSet.Add(Math.Round(mid + i * step, 4));
            candidateSet.Add(Math.Round(mid - i * step, 4));
        }

        // Add exact boundaries of intersection danger zones (to hug the clearances tightly if needed)
        foreach (double d in intersectDistances)
        {
            candidateSet.Add(Math.Round(d - this.Width/2, 4));
            candidateSet.Add(Math.Round(d + this.Width/2, 4));
        }

        // Filter out-of-bounds and sort by proximity to trace center
        var validCandidates = candidateSet
            .Where(c => c >= 0 && c <= L)
            .OrderBy(c => Math.Abs(c - mid))
            .ToList();

        double bestDistAlong = -1;

        // 2. Test candidates sequentially
        foreach (double current in validCandidates)
        {
            // Cheap Check: Is it in the "Danger Zone" of any intersection?
            bool inDanger = intersectDistances.Any(d => current > d - this.Width/2 + 0.001 && current < d + this.Width/2 - 0.001);
            if (inDanger) 
            {
                continue;
            }

            // Expensive Check: Part Geometry Bounds
            if (partGeometry != null && partGeometry.Count > 0)
            {
                Vector3d dir = ModelLine.Direction;
                dir.Unitize();
                Point3d candidatePt = ModelLine.From + (dir * current);
                
                // Check just below the bottom of the trace for solid material
                Point3d checkPt = new Point3d(candidatePt.X, candidatePt.Y, candidatePt.Z - this.traceHeight - 0.05);
                
                // Only enforce if we're above the build plate
                if (checkPt.Z > 0)
                {
                    double minInsetDistance = 0.6; // Matches original threshold
                    bool sufficientlyInside = false;

                    foreach (Brep brep in partGeometry)
                    {
                        if (brep == null) continue;
                        if (!brep.IsSolid) continue;
                        if (!brep.IsPointInside(checkPt, 0.001, false)) continue;
                        
                        // To avoid being tricked by short Z-distances to thin floors/ceilings,
                        // we directly verify an XY perimeter ring at the exact same Z height.
                        bool allInside = true;
                        int numTests = 6;
                        for (int i = 0; i < numTests; i++)
                        {
                            double angle = (2.0 * Math.PI / numTests) * i;
                            Point3d p = new Point3d(
                                checkPt.X + minInsetDistance * Math.Cos(angle),
                                checkPt.Y + minInsetDistance * Math.Sin(angle),
                                checkPt.Z
                            );
                            
                            if (!brep.IsPointInside(p, 0.001, false))
                            {
                                allInside = false;
                                break;
                            }
                        }
                        
                        if (allInside)
                        {
                            sufficientlyInside = true;
                            break; 
                        }
                    }
                    
                    if (!sufficientlyInside)
                    {
                        continue; // Fails geometry test, try next sample
                    }
                }
            }
            
            // If it passed both intersection and geometry checks, it's our best safe point
            bestDistAlong = current;
            break;
        }

        if (bestDistAlong == -1)
        {
            throw new Exception($"No safe pick spot found for trace at Z={ModelLine.FromZ}");
        }

        this.safeDistAlongLine = bestDistAlong;
    }

    public void SetSafePickDistanceToMidpoint()
    {
        this.safeDistAlongLine = this.Length / 2.0;
        SafePickDebugLog.Add($"Fallback: forced midpoint d={this.safeDistAlongLine:F3}");
    }

    public override void CalculatePickPlace(Point3d pickCentre)
    {
        if (this.TrayCurve == null)
            throw new Exception("TrayCurve must be set before calling CalculatePickPlace");

        if (this.HasPreferredPickPoint)
        {
            Vector3d projectedDir = ModelLine.Direction;
            projectedDir.Unitize();
            double projectedDist = Vector3d.Multiply(this.PreferredPickPoint - ModelLine.From, projectedDir);
            safeDistAlongLine = Math.Max(0.0, Math.Min(this.Length, projectedDist));
        }

        Vector3d dir = ModelLine.Direction;
        dir.Unitize();
        
        // Determine original line direction (positive or negative axis)
        bool pointsLeft = dir.X < -0.5; // Horizontal pointing negative X
        bool pointsDown = dir.Y < -0.5; // Vertical pointing negative Y
        
        // Check orientation by comparing dimensions of the tray slot
        BoundingBox bbox = this.TrayCurve.GetBoundingBox(true);
        double rectWidth = bbox.Max.X - bbox.Min.X;
        double rectHeight = bbox.Max.Y - bbox.Min.Y;
        bool horizontalInTray = rectWidth > rectHeight;
        
        // If the model line was drawn "backwards" (right-to-left or top-to-bottom),
        // we must flip the mapping inside the left-to-right/bottom-to-top tray cutout.
        double remappedDist = safeDistAlongLine;
        if ((horizontalInTray && pointsLeft) || (!horizontalInTray && pointsDown))
        {
            remappedDist = this.Length - safeDistAlongLine;
        }
        
        Point3d pickPt;
        if (horizontalInTray)
            pickPt = new Point3d(bbox.Min.X + remappedDist, pickCentre.Y, this.Height);
        else
            pickPt = new Point3d(pickCentre.X, bbox.Min.Y + remappedDist, this.Height);

        // Place point is calculated by moving along the ModelLine direction
        Point3d placePt = this.HasPreferredPickPoint ? this.PreferredPickPoint : ModelLine.From + (dir * safeDistAlongLine);

        this.PickPt = pickPt;
        this.PlacePt = placePt;
    }

    private static bool TryGetIntersection(Line top, Line bottom, double width, out Point3d result)
    {
        result = Point3d.Unset;
        Line t2 = new Line(new Point3d(top.FromX, top.FromY, 0), new Point3d(top.ToX, top.ToY, 0));
        Line b2 = new Line(new Point3d(bottom.FromX, bottom.FromY, 0), new Point3d(bottom.ToX, bottom.ToY, 0));

        double a, b;
        if (Intersection.LineLine(t2, b2, out a, out b))
        {
            if (t2.PointAt(a).DistanceTo(b2.PointAt(b)) < 0.01 && a >= -0.01 && a <= 1.01 && b >= -0.01 && b <= 1.01)
            {
                result = top.PointAt(a);
                return true;
            }
        }
        
        // Co-linear check (parallel traces on the same line)
        if (t2.DistanceTo(b2.From, true) < 0.01 && t2.DistanceTo(b2.To, true) < 0.01)
        {
            double tS = t2.ClosestParameter(b2.From);
            double tE = t2.ClosestParameter(b2.To);
            double oMin = Math.Max(0, Math.Min(tS, tE));
            double oMax = Math.Min(1, Math.Max(tS, tE));
            if (oMax - oMin > 0.01)
            {
                result = top.PointAt((oMin + oMax) / 2.0);
                return true;
            }
        }
        
        // Parallel traces check (traces that are parallel and cross over each other)
        Vector3d t2Dir = t2.Direction;
        Vector3d b2Dir = b2.Direction;
        t2Dir.Unitize();
        b2Dir.Unitize();
        
        // Check if lines are parallel (dot product close to 1 or -1)
        double dotProduct = Math.Abs(Vector3d.Multiply(t2Dir, b2Dir));
        if (dotProduct > 0.99) // Lines are parallel
        {
            // Check if traces overlap along their length
            // Project bottom line endpoints onto top line
            double t2_b2From = t2.ClosestParameter(b2.From);
            double t2_b2To = t2.ClosestParameter(b2.To);
            
            // Find overlap region
            double overlapMin = Math.Max(0, Math.Min(t2_b2From, t2_b2To));
            double overlapMax = Math.Min(1, Math.Max(t2_b2From, t2_b2To));
            
            if (overlapMax > overlapMin) // There is some overlap
            {
                // Check if traces are close enough (within width distance)
                Point3d overlapCenter = t2.PointAt((overlapMin + overlapMax) / 2.0);
                double distanceBetweenTraces = b2.DistanceTo(overlapCenter, true);
                
                if (distanceBetweenTraces < width + 0.01)
                {
                    result = top.PointAt((overlapMin + overlapMax) / 2.0);
                    return true;
                }
            }
        }
        
        return false;
    }

    private Brep CreateBoxFromLine(Line l, double w, double h)
    {
        Vector3d side = Vector3d.CrossProduct(l.Direction / l.Length, Vector3d.ZAxis) * (w / 2.0);
        Polyline p = new Polyline { l.From + side, l.From - side, l.To - side, l.To + side, l.From + side };
        Curve crv = p.ToNurbsCurve();
        if (crv.ClosedCurveOrientation(Vector3d.ZAxis) == CurveOrientation.Clockwise)
            crv.Reverse();
        return Extrusion.Create(crv, -h, true).ToBrep();
    }
}

/// <summary>
/// Represents a plug/connector element with pick/place logic (no tamping)
/// </summary>
public class Plug : Embeddable
{
    public List<Point3d> Intersections = new List<Point3d>();
    public double Radius { get; private set; }
    public double Height { get; private set; }
    private Point3d nominalPlacePoint;

    public Plug(Point3d centerPt, double radius, double plugHeight, double plateHeight, double layerHeight)
    {
        this.Radius = radius;
        this.Height = plugHeight;
        this.PlacePt = centerPt;
        this.nominalPlacePoint = centerPt;
        this.PickTemperature = 100;
        this.PauseLayer = (int)Math.Round(centerPt.Z / layerHeight) + 1;
        // Note: Plugs have no tamping points (TampingPts remains empty)
    }

    public override void CalcIntersections(List<Embeddable> allEmbeddables)
    {
        // Check if plug's base intersects with traces or other plugs
        double baseZ = Math.Round(this.PlacePt.Z - this.Height, 4);
        Point3d plug2D = new Point3d(this.PlacePt.X, this.PlacePt.Y, 0);
        
        foreach (var embeddable in allEmbeddables)
        {
            if (embeddable == this) continue;
            
            // Check Plug-Trace intersections
            if (embeddable is TraceElement trace)
            {
                double traceZ = Math.Round(trace.ModelLine.FromZ, 4);
                if (Math.Abs(traceZ - baseZ) < 0.001)
                {
                    Line trace2D = new Line(
                        new Point3d(trace.ModelLine.FromX, trace.ModelLine.FromY, 0),
                        new Point3d(trace.ModelLine.ToX, trace.ModelLine.ToY, 0)
                    );
                    
                    double t = trace2D.ClosestParameter(plug2D);
                    if (t >= -0.01 && t <= 1.01)
                    {
                        Point3d closestPt = trace2D.PointAt(t);
                        double dist = closestPt.DistanceTo(plug2D);
                        
                        if (dist < this.Radius + 0.001)
                        {
                            Point3d intersectPt = new Point3d(this.PlacePt.X, this.PlacePt.Y, baseZ);
                            this.Intersections.Add(intersectPt);
                        }
                    }
                }
            }
            // Check Plug-Plug intersections
            else if (embeddable is Plug otherPlug)
            {
                double otherZ = Math.Round(otherPlug.PlacePt.Z, 4);
                if (Math.Abs(otherZ - baseZ) < 0.001)
                {
                    Point3d other2D = new Point3d(otherPlug.PlacePt.X, otherPlug.PlacePt.Y, 0);
                    double dist = plug2D.DistanceTo(other2D);
                    
                    if (dist < this.Radius + otherPlug.Radius + 0.001)
                    {
                        Point3d intersectPt = new Point3d(this.PlacePt.X, this.PlacePt.Y, baseZ);
                        this.Intersections.Add(intersectPt);
                    }
                }
            }
        }
    }

    public override void CalculatePickPlace(Point3d pickCentre)
    {
        if (this.HasPreferredPickPoint)
        {
            Vector3d delta = this.PreferredPickPoint - this.nominalPlacePoint;
            this.PickPt = new Point3d(pickCentre.X + delta.X, pickCentre.Y + delta.Y, this.Height + delta.Z);
            this.PlacePt = this.PreferredPickPoint;
            return;
        }

        // Pick point is at the center of the cutout at the plug height
        this.PickPt = new Point3d(pickCentre.X, pickCentre.Y, this.Height);
        // Place point is already set in constructor
    }
}

/// <summary>
/// Represents a PCB or arbitrary embedded geometry with pick/place logic
/// </summary>
public class PCB : Embeddable
{
    public Brep Geometry { get; private set; }
    public BoundingBox BBox { get; private set; }
    public double TrayOffset { get; private set; }
    public List<PrinjectionPoint> PrinjectionPoints { get; set; }
    private Point3d nominalPlacePoint;
    
    public PCB(Brep geometry, double trayOffset, double layerHeight)
    {
        if (geometry == null)
            throw new Exception("PCB requires a Brep.");
        
        this.Geometry = geometry;
        this.TrayOffset = trayOffset;
        this.PrinjectionPoints = new List<PrinjectionPoint>();
        
        // Calculate bounding box
        this.BBox = geometry.GetBoundingBox(true);
        
        // Calculate pickup extrusion multiplier based on bounding box volume
        double bboxVolume = (this.BBox.Max.X - this.BBox.Min.X) 
                          * (this.BBox.Max.Y - this.BBox.Min.Y) 
                          * (this.BBox.Max.Z - this.BBox.Min.Z);
        if (bboxVolume > 100.0)
            this.PickupExtrusionMultiplier = bboxVolume / 500.0;
        
        // Place point is the center of the top surface of the bounding box
        Point3d bboxCenter = this.BBox.Center;
        this.PlacePt = new Point3d(bboxCenter.X, bboxCenter.Y, this.BBox.Max.Z);
        this.nominalPlacePoint = this.PlacePt;
        
        this.PauseLayer = (int)Math.Round(this.BBox.Max.Z / layerHeight) + 1;
        this.PickTemperature = 0; // No heating for PCBs
    }
    
    public override void CalcIntersections(List<Embeddable> allEmbeddables)
    {
        // PCBs don't calculate intersections with other embeddables
        // They are placed independently
    }
    
    public override void CalculatePickPlace(Point3d pickCentre)
    {
        double nominalPickZ = this.BBox.Max.Z - this.BBox.Min.Z + 1.0;

        if (this.HasPreferredPickPoint)
        {
            Vector3d delta = this.PreferredPickPoint - this.nominalPlacePoint;
            this.PickPt = new Point3d(pickCentre.X + delta.X, pickCentre.Y + delta.Y, nominalPickZ + delta.Z);
            this.PlacePt = this.PreferredPickPoint;
            return;
        }

        // Pick point is at the center of the tray cutout at the correct height
        this.PickPt = new Point3d(pickCentre.X, pickCentre.Y, nominalPickZ);
        // Place point is already set in constructor
    }
}

/// <summary>
/// Represents printed embedded geometry with PCB-like pick/place mapping.
/// Thermal behavior differences are handled in Python toolpath generation.
/// </summary>
public class Print : PCB
{
    public Print(Brep geometry, double trayOffset, double layerHeight)
        : base(geometry, trayOffset, layerHeight)
    {
    }
}

// ============================================================================
// TRAY LAYOUT HELPER
// ============================================================================

/// <summary>
/// Manages tray layout and cutout generation for embeddables
/// </summary>
public class Tray
{
    public Brep TrayBrep { get; private set; }
    public List<Line> PickPlaceLines { get; private set; }
    private List<Curve> cutoutCurves;
    private List<List<Curve>> hColumns;
    private List<List<Curve>> vColumns;
    private List<Curve> plugCutoutCurves;
    private List<List<Curve>> pcbColumns;
    
    public Tray(List<Embeddable> allEmbeddables, Point3d origin, double spacing)
    {
        cutoutCurves = new List<Curve>();
        hColumns = new List<List<Curve>>();
        vColumns = new List<List<Curve>>();
        plugCutoutCurves = new List<Curve>();
        pcbColumns = new List<List<Curve>>();
        PickPlaceLines = new List<Line>();
        
        // Toggle this flag to turn on/off the extra widenings at the trace pick points
        bool enablePickClearanceCutouts = true; 
        
        // Separate traces, plugs, and PCBs
        List<TraceElement> allTraces = allEmbeddables.OfType<TraceElement>().ToList();
        List<Plug> allPlugs = allEmbeddables.OfType<Plug>().ToList();
        List<PCB> allPCBs = allEmbeddables.OfType<PCB>().ToList();
        
        // Group traces by orientation, width, and height
        var hTraceGroups = allTraces
            .Where(t => t.IsHorizontal)
            .GroupBy(t => new { t.Width, t.Height })
            .OrderBy(g => g.Key.Width).ThenBy(g => g.Key.Height)
            .ToList();
            
        var vTraceGroups = allTraces
            .Where(t => !t.IsHorizontal)
            .GroupBy(t => new { t.Width, t.Height })
            .OrderBy(g => g.Key.Width).ThenBy(g => g.Key.Height)
            .ToList();
        
        // Group plugs by radius and height
        var plugGroups = allPlugs
            .GroupBy(p => new { p.Radius, p.Height })
            .OrderBy(g => g.Key.Radius).ThenBy(g => g.Key.Height)
            .ToList();
        
        // Calculate dimensions for horizontal traces
        double maxHLength = 0;
        double hTracesHeight = 0;
        foreach (var group in hTraceGroups)
        {
            double groupMaxLength = group.Max(t => t.Length);
            if (groupMaxLength > maxHLength) maxHLength = groupMaxLength;
            hTracesHeight += group.Count() * (group.First().Width + spacing);
        }
        
        // Calculate dimensions for vertical traces
        double maxVLength = 0;
        double vTracesWidth = 0;
        foreach (var group in vTraceGroups)
        {
            double groupMaxLength = group.Max(t => t.Length);
            if (groupMaxLength > maxVLength) maxVLength = groupMaxLength;
            vTracesWidth += group.Count() * (group.First().Width + spacing);
        }
        
        // Calculate plug area dimensions
        double plugAreaWidth = 0;
        if (allPlugs.Count > 0)
        {
            foreach (var plugGroup in plugGroups)
            {
                double plugRadius = plugGroup.First().Radius;
                double plugDiameter = plugRadius * 2.0;
                plugAreaWidth = Math.Max(plugAreaWidth, plugDiameter + spacing);
            }
        }
        
        // Maximum tray height before wrapping to a new column
        double maxTrayHeight = 110;
        
        // Track the right edge of each section for positioning the next section
        double hSectionRightEdge = origin.X;
        
        // Layout horizontal traces with column wrapping
        double currentY = origin.Y + spacing;
        double hColumnX = origin.X + spacing;
        double hColumnMaxLength = 0; // Track max trace length in current column
        double hSectionRequiredHeight = spacing * 2;
        int hColumnCount = 0;
        
        List<Curve> currentHCol = new List<Curve>();

        foreach (var group in hTraceGroups)
        {
            double groupWidth = group.First().Width;
            
            foreach (var trace in group)
            {
                // Start first column or wrap to new column if exceeding max height
                if (hColumnCount == 0)
                {
                    hColumnCount = 1;
                }
                else if (currentY + groupWidth + spacing - origin.Y > maxTrayHeight)
                {
                    // Save previous column
                    if (currentHCol.Count > 0) hColumns.Add(new List<Curve>(currentHCol));
                    currentHCol.Clear();

                    // Advance X by the max trace length in the column we just finished
                    hColumnX += hColumnMaxLength + spacing;
                    hColumnMaxLength = 0;
                    currentY = origin.Y + spacing;
                    hColumnCount++;
                }
                
                // Track the widest (longest) trace in this column
                if (trace.Length > hColumnMaxLength)
# ---------- end c_script_4 ----------
sp_4 = ScriptParasite2(Enable=Toggle(True), Path=panel_25, TargetComponent=c_script_4)
panel_26 = Panel(c_script_4.out)
panel_27 = Panel(sp_4)
